# Grasshopper definition Analyze.gh (Grasshopper 1.0.8)
# plug-ins: Imaging Library, MeshEdit Components, Pufferfish, Rhino.Inside for Autodesk Revit
# Script developed by BIMTech Innovations AB

# upskiller Daylight-Factor
# Runs daylight analysis for the selected room in Revit.
# Extracts relevant geometry, prepares input, and sends data to the ML server.
# The resulting daylight metrics and heatmap are returned and visualized in Revit.
# 
# Part of the "Daylight Factor Plugin"
# → https://github.com/upskiller-xyz/Daylight-Factor
# Inputs determined from the model
# Transfer of value from another location
panel = Panel("Userinputs")

# ----
# Used to define the domain for encoding. Must be adapted if a different ML model is used.
max_ceiling_over_floor_heigth_in_mm = Panel("5000")

# ---- group: Parameters for recognizing relevant context geometries
distance_of_context_recognition_mm = Panel("500000")
angle_from_the_center_of_the_window_to_d = Panel("""71
-71""")  # "Angle from the center of the window to detect the context (deg)"

# ---- group: Selected Room in Revit
active_selection = GraphicalElement()
# USER INPUTS
element = Element(active_selection)

# ---- group: Parameters for detecting relevant building parts per window
filtering_z__from_window_mm = Panel("2000")
filtering_z__from_window_mm_2 = Panel("5000")
size_bounding_box_mm = Panel("20000")
number = Number(filtering_z__from_window_mm_2)
number_2 = Number(filtering_z__from_window_mm)
number_3 = Number(size_bounding_box_mm)

# ---- group: Extract Usersettings from settings_daylight.json
python_3_script = Python3Script(check_input=element)  # -> out, multilayerWall, transmissionValue, deletionStatus, cleanedFolderPath, level_elevation, executionMode, writeResults
# ---------- python_3_script: Python ----------
# -*- coding: utf-8 -*-
"""
GHPython Script: Reads JSON settings from 1 level up, clears a target directory.

    Inputs:
        trigger: Connect a button or boolean toggle to run. (Input 'x' by default)
    Outputs:
        multilayerWall: Value of 'multilayer_wall' from JSON.
        transmissionValue: Value of 'transmission_value' from JSON.
        levelElevation: Value of 'level_elevation' from JSON.
        deletionStatus: Status message of the directory clearing operation.
        cleanedFolderPath: Full path of the directory targeted for cleaning.
        executionMode: Decides if Inference runs locally or on a web server
        writeResults: Decitdes if Results are written back to Revit elements
"""
import Rhino
import os
import json
import shutil # Required for rmtree (deleting non-empty folders)
# Access Grasshopper environment automatically via 'ghenv'

# --- Default output values ---
multilayerWall_out = None
transmissionValue_out = None
levelElevation_out = None 
deletionStatus_out = "Script not executed or error occurred."
cleanedFolderPath_out = None
executionMode_out = None
writeResults_out = None

# --- Get Grasshopper document ---
# ghenv is a special variable available in the GHPython editor
ghdoc = ghenv.Component.OnPingDocument()

# --- Main logic ---
if ghdoc is None:
    deletionStatus_out = "Error: Could not access Grasshopper document."
elif not ghdoc.IsFilePathDefined:
    deletionStatus_out = "Error: Grasshopper document must be saved first."
else:
    try:
        # 1. Get current GH document directory
        gh_file_path = ghdoc.FilePath
        gh_dir = os.path.dirname(gh_file_path)

        # 2. Navigate 1 level up
        base_dir = gh_dir
        for _ in range(1):
            parent_dir_check = os.path.dirname(base_dir)
            if parent_dir_check == base_dir: # Prevent infinite loop at root
                raise ValueError("Cannot go up one level from the current path.")
            base_dir = parent_dir_check
        # print("Target base directory: {}".format(base_dir)) # Uncomment for debugging

        # 3. Construct path to JSON and read settings
        settings_file_path = os.path.join(base_dir, "settings_daylight.json")
        # print("Looking for settings file at: {}".format(settings_file_path)) # Uncomment for debugging

        if os.path.exists(settings_file_path):
            try:
                with open(settings_file_path, 'r') as f:
                    settings_data = json.load(f)
                    multilayerWall_out = settings_data.get("multilayer_wall") # Use .get() for safety
                    transmissionValue_out = settings_data.get("transmission_value")
                    levelElevation_out = settings_data.get("level_elevation") # Read level_elevation
                    executionMode_out = settings_data.get("execution_mode")
                    writeResults_out = settings_data.get("write_results")
            except json.JSONDecodeError:
                deletionStatus_out = "Error: Could not decode JSON file."
                # Ensure other outputs are None if JSON is malformed
                multilayerWall_out = None
                transmissionValue_out = None
                levelElevation_out = None
            except Exception as e:
                deletionStatus_out = "Error reading settings file: {}".format(e)
                multilayerWall_out = None
                transmissionValue_out = None
                levelElevation_out = None
        else:
            # Set status only if no previous error occurred during JSON reading
            if deletionStatus_out == "Script not executed or error occurred.":
                deletionStatus_out = "Error: settings_daylight.json not found."
            # Ensure other outputs are None if file not found
            multilayerWall_out = None
            transmissionValue_out = None
            levelElevation_out = None

        # 4. Find "DaylightPrediction" folder and clear contents
        prediction_dir_path = os.path.join(base_dir, "DaylightPrediction")
        cleanedFolderPath_out = prediction_dir_path # Assign path to the new output
        # print("Target directory for cleaning: {}".format(prediction_dir_path)) # Uncomment for debugging

        if os.path.isdir(prediction_dir_path):
            items_deleted_count = 0
            items_failed_count = 0

            for item_name in os.listdir(prediction_dir_path):
                item_path = os.path.join(prediction_dir_path, item_name)
                try:
                    if os.path.isfile(item_path) or os.path.islink(item_path):
                        os.unlink(item_path) # Delete file/link
                        items_deleted_count += 1
                    elif os.path.isdir(item_path):
                        shutil.rmtree(item_path) # Delete directory recursively
                        items_deleted_count += 1
                except Exception as e:
                    print("Failed to delete {}: {}".format(item_path, e)) # Log specific error
                    items_failed_count += 1
            
            # Update status based on deletion results
            current_status = deletionStatus_out # Preserve previous JSON errors if any
            if current_status == "Script not executed or error occurred." or current_status == "Error: settings_daylight.json not found." or "Could not decode JSON file" in current_status or "Error reading settings file" in current_status :
                current_status = "" # Clear default/JSON error if deletion happens or is attempted

            if items_failed_count == 0:
                if items_deleted_count > 0:
                    deletionStatus_out = "{}Successfully deleted {} items from DaylightPrediction.".format(current_status + " " if current_status else "", items_deleted_count)
                else: # Folder was empty
                    deletionStatus_out = "{}DaylightPrediction directory found but was empty.".format(current_status + " " if current_status else "")
            else:
                deletionStatus_out = "{}Deleted {} items, but failed to delete {} items from DaylightPrediction.".format(current_status + " " if current_status else "", items_deleted_count, items_failed_count)

        else:
            # Update status only if directory not found and no prior critical error occurred
            if deletionStatus_out == "Script not executed or error occurred." or deletionStatus_out == "Error: settings_daylight.json not found.":
                # This case implies JSON file wasn't found, so deletionStatus_out already reflects that.
                # We append the directory not found message.
                deletionStatus_out += " DaylightPrediction directory not found."
            elif "Could not decode JSON file" in deletionStatus_out or "Error reading settings file" in deletionStatus_out:
                # JSON error occurred, append directory status
                deletionStatus_out += " Additionally, DaylightPrediction directory not found."
            else: # JSON was likely read successfully, but directory is missing
                deletionStatus_out += " DaylightPrediction directory not found."
                
    except ValueError as ve: # Catches the "Cannot go up..." error
        deletionStatus_out = "Error: {}".format(ve)
        # Reset other outputs on critical path error
        multilayerWall_out = None
        transmissionValue_out = None
        levelElevation_out = None
        cleanedFolderPath_out = None
    except Exception as e: # Catch any other unexpected errors
        import traceback
        deletionStatus_out = "An unexpected error occurred: {}".format(e)
        print(traceback.format_exc()) # Print detailed traceback to Rhino Python console
        # Reset outputs on major error
        multilayerWall_out = None
        transmissionValue_out = None
        levelElevation_out = None
        cleanedFolderPath_out = None

# --- Assign values to Grasshopper component outputs ---
multilayerWall = multilayerWall_out
transmissionValue = transmissionValue_out
levelElevation = levelElevation_out
deletionStatus = deletionStatus_out
cleanedFolderPath = cleanedFolderPath_out
executionMode = executionMode_out
writeResults = writeResults_out
# ---------- end python_3_script ----------

# ---- group: Write Data and Results to Revit Elements
data = Data(python_3_script.writeResults)

# ---- group: Path to Save Images
text = Text(python_3_script.cleanedFolderPath)

# ---- group: Distance between z=0 and level of ground
number_4 = Number(python_3_script.level_elevation)

# ----
# Exterior Wall modelled as a single Wall? >> True
# Exterior Wall modelled as two Wall? >> False
data_2 = Data(python_3_script.multilayerWall)

# ---- group: Execution Mode of Server
data_3 = Data(python_3_script.executionMode)

# ----
element_parameter = ElementParameter(Element=element, Parameter="Number")  # -> Element, Value
element_passport = ElementPassport(Element=element_parameter.Element)  # -> DocumentGUID, Document, UniqueID, Id

# ---- group: Get all Windows
cluster = Cluster_7()  # -> ids_fromroom, ids_toroom, windows

# ---- group: Get Windows connected to given Room
equality = Equality(FirstNumber=element_passport.Id, SecondNumber=cluster.ids_toroom)  # -> Equality, Inequality
# AUTOMATIC INPUTS FROM
# REVIT DOCUMENT
equality_2 = Equality(FirstNumber=element_passport.Id, SecondNumber=cluster.ids_fromroom)  # -> Equality, Inequality
gate_or = GateOr(A=equality_2.Equality, B=equality.Equality)
cull_pattern = CullPattern(List=cluster.windows, CullPattern=gate_or)

# ---- group: Reset colour from previous analyses
cull_pattern_2 = CullPattern(List=cluster.windows, CullPattern=invert(gate_or))
reset_element_parameter = ResetElementParameter(Element=cull_pattern_2, Parameter="UPSKR_DF")

# ---- group: Specified Room
element_2 = Element(flatten(element_parameter.Element))
element_geometry = ElementGeometry(Elements=element_2)

# ----
# Floors
built_in_categories = BuiltInCategories("autodesk.revit.category.local:floors-1.0.0", SearchPattern="Floors")
category_filter = CategoryFilter(Categories=built_in_categories, Inverted=False)
query_elements = QueryElements(Filter=category_filter)  # -> Elements, Count
element_location = ElementLocation(Element=query_elements.Elements)  # -> Element, Location, Hand, Facing, WorkPlane
element_3 = Element(query_elements.Elements)
point = Point(element_location.Location)

# ----
# Roofs
built_in_categories_2 = BuiltInCategories("autodesk.revit.category.local:roofs-1.0.0", SearchPattern="Roof")
category_filter_2 = CategoryFilter(Categories=built_in_categories_2, Inverted=False)
query_elements_2 = QueryElements(Filter=category_filter_2)  # -> Elements, Count
element_location_2 = ElementLocation(Element=query_elements_2.Elements)  # -> Element, Location, Hand, Facing, WorkPlane
element_4 = Element(query_elements_2.Elements)
point_2 = Point(element_location_2.Location)

# ---- group: Connected Windows
# Windows
element_5 = Element(flatten(cull_pattern))
element_geometry_2 = ElementGeometry(Elements=element_5)
element_location_3 = ElementLocation(Element=element_5)  # -> Element, Location, Facing
element_host = ElementHost(Element=element_5)
list_length = ListLength(List=element_5)
brep = Brep(element_geometry_2)
point_3 = Point(element_location_3.Location)

# ----
# Room
brep_2 = Brep(element_geometry)

# ---- group: Gate Setting
data_4 = Data(data_2)

# ---- group: Geometry of specified Room(s)
brep_3 = Brep(brep_2)

# ---- group: Window Location
point_4 = Point(point_3)

# ---- group: Window Hosts
element_6 = Element(element_host)

# ---- group: Roof Elements
element_7 = Element(element_4)

# ---- group: Floor Elements
element_8 = Element(element_3)

# ---- group: Location Roofs
point_5 = Point(point_2)

# ----
# Get Room Data
cluster_2 = Cluster(brep=brep_3)  # -> list, list_2, list_3
brep_4 = Brep(cluster_2.list_2)

# ---- group: Location Floors
# Elements to clash with BBox
# "BALCONIES"
point_6 = Point(point)

# ---- group: Room_Height
area = Area(Geometry=cluster_2.list_3)  # -> Area, Centroid
area_2 = Area(Geometry=cluster_2.list_2)  # -> Area, Centroid
deconstruct = Deconstruct(Point=area.Centroid)  # -> XComponent, YComponent, ZComponent
deconstruct_2 = Deconstruct(Point=area_2.Centroid)  # -> XComponent, YComponent, ZComponent
subtraction = Subtraction(A=deconstruct.ZComponent, B=deconstruct_2.ZComponent)

# ---- group: Windows Normal
vector = Vector(element_location_3.Facing)

# ---- group: Window Location
point_7 = Point(element_location_3.Location)

# ----
detail_level = DetailLevel({"Coarse": 1, "Medium": 2, "Fine": 3}, selected="Coarse")

# ---- group: Distance for checking the surroundings
# MODE OF USE
# 
# Mode 1: Create datapoints. Create datapoints
# by saving all files such as encodings, outputs,
# and other feature files. This requires running DF
# and DA (daylight factor and daylight autonomy)
# simulations, so each datapoint takes 2-3
# minutes to generate.
# 
# The interface provides information during this process:
# 
# 
# (seed) Displays the seed of the room being processed
# in each iteration.
# 
# Usage:
# - Ensure that redoEncodingsOnly is set to false.
# - Set the startseed for the seed you want to start from.
# 
# - Specify the directory where the folders will be
# saved temporarily on your computer before being sent
# to the GCP bucket
# - Specify the location of the the .epw file the json with
# the credentials and the name of the GCP bucket where
# the resulting files will be saved.
# - Reset if it is not already set to 0.
# - Press “play” to start the process.
# 
# 
# Mode 2: Re-encoding of all rooms in our dataset
# for both pix2pix and graph2pix. This is
# particularly useful for testing new encoding
# strategies without the need to rerun time-
# consuming simulations.
# How to use it:
# 
#  same as model 1 except you neet to
# Activate the mode by setting the toggle to true.
# 
# The interface provides information during this process:
# 
# (number of iterations) Shows the total number
# of iterations required, which corresponds to the
# number of rooms in the dataset.
# (current iteration)
# Indicates the current iteration
# number.
# Continue the process until the number
# shown in (current iteration) matches the total in
# (number of iterations). This indicates that all
# rooms have been re-encoded.
number_5 = Number(distance_of_context_recognition_mm)

# ---- group: Angles for checking the surroundings
number_6 = Number(angle_from_the_center_of_the_window_to_d)

# ---- group: Z Heigth of Floors over 0
number_7 = Number(deconstruct_2.ZComponent)

# ---- group: Room Heigth
number_8 = Number(subtraction)

# ---- group: Z Heigth of Ceiling over 0
number_9 = Number(deconstruct.ZComponent)

# ---- group: Geometry of connected Window(s)
brep_5 = Brep(simplify(brep))

# ---- group: Room Ceiling Heigth over 0
number_10 = Number(number_9)

# ---- group: Filter out floors and roof beyond the room
element_geometry_3 = ElementGeometry(Elements=element_7)  # -> flatten(Geometry)
element_parameter_2 = ElementParameter(Element=element_8, Parameter="Level")  # -> Element, Value
element_parameter_3 = ElementParameter(Element=element_8, Parameter="Height Offset From Level")  # -> Element, Value
area_3 = Area(Geometry=element_geometry_3)  # -> Area, Centroid
element_parameter_4 = ElementParameter(Element=element_parameter_2.Value, Parameter="Elevation")  # -> Element, Value
deconstruct_3 = Deconstruct(Point=area_3.Centroid)  # -> XComponent, YComponent, ZComponent
addition = Addition(A=element_parameter_4.Value, B=element_parameter_3.Value)
larger_than = LargerThan(FirstNumber=addition, SecondNumber=number_10)  # -> LargerThan, OrEqualTo
larger_than_2 = LargerThan(FirstNumber=deconstruct_3.ZComponent, SecondNumber=number_10)  # -> LargerThan, OrEqualTo
cull_pattern_3 = CullPattern(List=element_8, CullPattern=larger_than.LargerThan)
cull_pattern_4 = CullPattern(List=element_geometry_3, CullPattern=larger_than_2.LargerThan)
element_geometry_4 = ElementGeometry(Elements=cull_pattern_3)  # -> flatten(Geometry)

# ---- group: Geometry of connected Window
brep_6 = Brep(simplify(brep))

# ---- group: Size BoundingBox
number_11 = Number(number_3)

# ---- group: Floors
element_9 = Element(element_3)

# ---- group: Roofs
element_10 = Element(element_4)

# ----
midpoint = Slider(0.5, range=0..10)
detail_level_2 = DetailLevel({"Coarse": 1, "Medium": 2, "Fine": 3}, selected="Coarse")
detail_level_3 = DetailLevel({"Coarse": 1, "Medium": 2, "Fine": 3}, selected="Coarse")
construct_point = ConstructPoint(XCoordinate=midpoint, YCoordinate=midpoint, ZCoordinate=0)
settings_speed = SettingsSpeed()

# ---- group: Floor Room
brep_7 = Brep(simplify(brep_4))

# ----
# Determine highest element
# (roof or florrslab) above room
merge = Merge(Data1=cull_pattern_4, Data2=element_geometry_4)  # -> flatten(Result)

# ---- group: Geometry of specified Room(s)
brep_8 = Brep(brep_2)

# ---- group: Highest Element over room / Room Height
number_12 = Number(number_8)

# ---- group: Highest Element over room / Determines test length for highest element above room
panel_2 = Panel("20")

# ---- group: Highest Element over room / Centroid of Room
point_8 = Point(area_2.Centroid)

# ---- group: Highest Element over room
unit_z = UnitZ(Factor=1)
multiplication = Multiplication(A=number_12, B=panel_2)
line_sdl = LineSDL(Start=point_8, Direction=unit_z, Length=multiplication)
brep_line = BrepLine(Brep=merge, Line=line_sdl, LimitToFirst=False)  # -> Curves, Points
deconstruct_4 = Deconstruct(Point=brep_line.Points)  # -> XComponent, YComponent, ZComponent
bounds = Bounds(Numbers=flatten(deconstruct_4.ZComponent))
deconstruct_domain = DeconstructDomain(Domain=bounds)  # -> Start, End
number_13 = Number(deconstruct_domain.End)

# ---- group: Highlight Element
# PREFILTERING GEOMETRIES AND
# INFORMATION PROCESSING
cull_pattern_5 = CullPattern(List=element_7, CullPattern=larger_than_2.LargerThan)
merge_2 = Merge(Data1=cull_pattern_3, Data2=cull_pattern_5)  # -> flatten(Result)
equality_3 = Equality(FirstNumber=deconstruct_4.ZComponent, SecondNumber=deconstruct_domain.End)  # -> Equality, Inequality
mass_addition = MassAddition(Input=equality_3.Equality)  # -> Result, PartialResults
cull_pattern_6 = CullPattern(List=graft(merge_2), CullPattern=mass_addition.Result)  # -> flatten(List)

# ---- group: Centroid of Room
point_9 = Point(area_2.Centroid)

# ---- group: Floor Heigth of Room
number_14 = Number(number_7)

# ---- group: Host Walls
element_11 = Element(element_host)

# ---- group: Window Direction
vector_2 = Vector(vector)

# ---- group: Gate Settings
data_5 = Data(data_2)

# ---- group: Extend sill to a second wall if given / Window Direction
vector_3 = Vector(vector)

# ---- group: 128 Rays
brep_9 = Brep([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])  # disabled

# ---- group: 64 Rays
brep_10 = Brep([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])

# ---- group: Number of connected Windows
number_15 = Number(list_length)

# ---- group: Distance between z=0 and level of Terrain
number_16 = Number(number_4)

# ---- group: Z Heigth of Floors over 0
number_17 = Number(number_7)

# ---- group: Number of connected Windows
number_18 = Number(list_length)

# ---- group: Room Floor
brep_11 = Brep(brep_4)

# ---- group: Fixed value taken from original script
data_6 = Data(max_ceiling_over_floor_heigth_in_mm)

# ---- group: Heigth_Roof
number_19 = Number(number_13)

# ---- group: Z Heigth of Floors over 0
number_20 = Number(number_7)

# ---- group: Room Heigth
number_21 = Number(number_8)

# ---- group: Path
text_2 = Text(text)

# ----
# Prepare Translation vector and file names
translation_of_analysis_area_in_mm = Panel("20000")
series = Series(Start=0, Step=translation_of_analysis_area_in_mm, Count=number_18)
series_2 = Series(Start=0, Step=1, Count=number_18)
unit_x = UnitX(Factor=series)
concatenate = Concatenate(Path=text_2, Slash="\", Floorplan="floorplan", Number=series_2, PNG=".png")  # -> simplify(graft(Result))
vector_4 = Vector(unit_x)

# ---- group: Vector to Move Embedding
vector_5 = Vector(vector_4)

# ---- group: Room_Floor
brep_12 = Brep(brep_4)

# ---- group: Translation Vector
vector_6 = Vector(simplify(graft(vector_4)))

# ---- group: Room Floor
brep_13 = Brep(brep_4)

# ---- group: Vector to Move Emebdings
vector_7 = Vector(vector_4)

# ----
# White Frame
curve = Curve(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)
boundary_surfaces = BoundarySurfaces(Edges=curve)
color = ColourSwatch(SwatchColor=RGB(255, 255, 255))
move = Move(Geometry=boundary_surfaces, Motion=vector_7)  # -> simplify(graft(Geometry)), Transform
create_gdi_fill = CreateGdiFill(Colour=color)
create_gdi_shape = CreateGdiShape(Geometry=move.Geometry, Fill=create_gdi_fill)

# ---- group: Vector to Move Embedding
vector_8 = Vector(vector_4)

# ---- group: Filepath
text_3 = Text(concatenate)

text_4 = Text(text)

# ----
vector_9 = Vector(vector_4)
point_10 = Point(Point(6400, 11564.26604, -500))
move_2 = Move(Geometry=point_10, Motion=vector_9)  # -> graft(Geometry), Transform

# ---- group: Execution Mode of Server
data_7 = Data(data_3)

# ----
panel_3 = Panel("local")

# ---- group: Write Data and Results to Revit Elements
data_8 = Data(data)

# ---- group: Selected Room
element_12 = Element(element)

# ----
# External Walls
built_in_categories_3 = BuiltInCategories("autodesk.revit.category.local:walls-1.0.0", SearchPattern="Walls")
category_filter_3 = CategoryFilter(Categories=built_in_categories_3, Inverted=False)
query_elements_3 = QueryElements(Filter=category_filter_3)  # -> Elements, Count

# ---- group: Filter Elements by Type Parameter
cluster_3 = Cluster_8(relay=query_elements_3.Elements, parameter="Function", pattern="Exterior")

# ----
element_location_4 = ElementLocation(Element=cluster_3)  # -> Element, Location, Hand, Facing, WorkPlane
point_11 = Point(element_location_4.Location)
element_13 = Element(cluster_3)

# ---- group: External Walls
element_14 = Element(element_13)

# ---- group: Location External Walls
point_12 = Point(point_11)

# ---- group: External Walls
element_15 = Element(element_13)

# ---- group: Using BBoxes instead of Real Geometry / Hand Orientation - External Wall
vector_10 = Vector(element_location_4.Hand)

# ---- group: Using BBoxes instead of Real Geometry / Location - External Wall
point_13 = Point(point_11)

# ---- group: Using BBoxes instead of Real Geometry / Facing Orientation - External Wall
vector_11 = Vector(element_location_4.Facing)

# ----
# Get Information of Surroundings
built_in_categories_4 = BuiltInCategories("autodesk.revit.category.family:site-1.0.0", SearchPattern="Site")
category_filter_4 = CategoryFilter(Categories=built_in_categories_4, Inverted=False)
query_elements_4 = QueryElements(Filter=category_filter_4, Limit=100)  # -> Elements, Count
element_geometry_5 = ElementGeometry(Elements=query_elements_4.Elements, DetailLevel=detail_level)  # -> flatten(Geometry)

deconstruct_5 = Deconstruct(Point=point_4)  # -> XComponent, YComponent, ZComponent
deconstruct_6 = Deconstruct(Point=point_5)  # -> XComponent, YComponent, ZComponent
deconstruct_7 = Deconstruct(Point=point_6)  # -> XComponent, YComponent, ZComponent
deconstruct_8 = Deconstruct(Point=point_12)  # -> XComponent, YComponent, ZComponent
bounds_2 = Bounds(Numbers=deconstruct_5.ZComponent)
deconstruct_domain_2 = DeconstructDomain(Domain=bounds_2)  # -> Start, End
number_22 = Number(number_2)
number_23 = Number(number)
expression = Expression(
    window_minZ=deconstruct_domain_2.Start,
    elements_Z=deconstruct_8.ZComponent,
    x=number_23,
    y=number_22,
    Expression="(elements_Z > (window_minZ-y)) and (elements_Z < (window_minZ + x))")
expression_2 = Expression(
    window_minZ=deconstruct_domain_2.Start,
    elements_Z=deconstruct_7.ZComponent,
    x=number_23,
    Expression="(elements_Z > window_minZ) and (elements_Z < (window_minZ + x))")
expression_3 = Expression(
    window_minZ=deconstruct_domain_2.Start,
    elements_Z=deconstruct_6.ZComponent,
    x=number_23,
    Expression="(elements_Z > window_minZ) and (elements_Z < (window_minZ + x))")
cull_pattern_7 = CullPattern(List=element_10, CullPattern=expression_3)
cull_pattern_8 = CullPattern(List=element_9, CullPattern=expression_2)
cull_pattern_9 = CullPattern(List=element_15, CullPattern=expression)
element_geometry_6 = ElementGeometry(Elements=cull_pattern_7, DetailLevel=detail_level_3)
element_geometry_7 = ElementGeometry(Elements=cull_pattern_8, DetailLevel=detail_level_2)
mesh = Mesh(flatten(element_geometry_6))

mesh_brep = MeshBrep(Brep=element_geometry_7, Settings=settings_speed)

# ---- group: Using BBoxes instead of Real Geometry
cull_pattern_10 = CullPattern(List=point_13, CullPattern=expression)
cull_pattern_11 = CullPattern(List=vector_10, CullPattern=expression)
cull_pattern_12 = CullPattern(List=vector_11, CullPattern=expression)
construct_plane = ConstructPlane(Origin=cull_pattern_10, XAxis=cull_pattern_11, YAxis=cull_pattern_12)
bounding_box = BoundingBox(Content=graft(cull_pattern_9), Plane=graft(construct_plane))  # -> flatten(Box), Box_2
mesh_2 = Mesh(bounding_box.Box)

# ----
# Get Information of second exterior Walls
stream_gate = StreamGate(Stream=element_14, Gate=data_4)  # -> Target0, Target1
stream_gate_2 = StreamGate(Stream=element_6, Gate=data_4)  # -> Target0, Target1
bboxscale = Slider(5, range=0..20)
element_16 = Element(graft(stream_gate_2.Target0))

# ---- group: Filter Elements by Proximity
cluster_4 = Cluster_10(relay=stream_gate.Target0, content=stream_gate_2.Target0, scale_x=bboxscale, scale_y=bboxscale)  # -> list_2, list

# ---- group: Filter Walls parallel to Window Hosts
cluster_5 = Cluster_9(element=element_16, relay=cluster_4.list, list=cluster_4.list_2)  # -> list_2, list_3

# ---- group: Filter out Window Hosts from Wall List
element_parameter_5 = ElementParameter(Element=element_16, Parameter="Id")  # -> Element, Value
element_parameter_6 = ElementParameter(Element=cluster_5.list_2, Parameter="Id")  # -> Element, Value
equality_4 = Equality(FirstNumber=element_parameter_5.Value, SecondNumber=element_parameter_6.Value)  # -> Equality, Inequality
cull_pattern_13 = CullPattern(List=element_parameter_6.Element, CullPattern=equality_4.Inequality)  # -> simplify(List)
cull_pattern_14 = CullPattern(List=cluster_5.list_3, CullPattern=equality_4.Inequality)  # -> simplify(List)

# ----
element_bounding_geometry = ElementBoundingGeometry(Element=element_parameter_5.Element)
element_17 = Element(cull_pattern_13)
deconstruct_brep = DeconstructBrep(Brep=element_bounding_geometry)  # -> Faces, Edges, Vertices
area_4 = Area(Geometry=deconstruct_brep.Faces)  # -> Area, Centroid
sort_list = SortList(Keys=area_4.Area, ValuesFaces=deconstruct_brep.Faces, ValuesCentroid=area_4.Centroid)  # -> Keys, ValuesFaces, ValuesCentroid
split_list = SplitList(List=sort_list.ValuesFaces, Index="4")  # -> ListA, ListB
split_list_2 = SplitList(List=sort_list.ValuesCentroid, Index="4")  # -> ListA, ListB
distance = Distance(PointA=point_9, PointB=split_list_2.ListB)
sort_list_2 = SortList(Distance=distance, ValuesFaces=split_list.ListB)  # -> Distance, ValuesFaces
list_item = ListItem(List=sort_list_2.ValuesFaces, Index=0, Wrap=True)  # -> Item, Item1
mesh_3 = Mesh(cull_pattern_14)
mesh_4 = Mesh(simplify(list_item.Item1))
collision_one_many = CollisionOneMany(Collider=mesh_4, Obstacles=mesh_3)  # -> Collision, Index
list_item_2 = ListItem(List=mesh_3, Index=collision_one_many.Index, Wrap=True)
list_item_3 = ListItem(List=element_17, Index=collision_one_many.Index, Wrap=True)
element_type = ElementType(Element=list_item_3)  # -> Element, Type
element_parameter_7 = ElementParameter(Element=element_type.Type, Parameter="Width")  # -> Element, Value

# ---- group: Thickness Outer Wall
data_9 = Data(element_parameter_7.Value)

# ---- group: Extend sill to a second wall if given / Thickness Outer Wall
data_10 = Data(flatten(data_9))

# ----
# WINDOWS
plane_normal = PlaneNormal(Origin=point_7, ZAxis=vector)  # -> simplify(graft(Plane))

# ---- group: Window Center
point_14 = Point(flatten(plane_normal))

# ----
# Prefiltering by neglecting Z-Dimension
deconstruct_brep_2 = DeconstructBrep(Brep=element_geometry_5)  # -> Faces, Edges, Vertices
evaluate_surface = EvaluateSurface(Surface=deconstruct_brep_2.Faces, Point="0.5,0.5")  # -> Point, Normal, UDirection, VDirection, Frame
unit_z_2 = UnitZ(Factor=1)
dot_product = DotProduct(VectorA=unit_z_2, VectorB=evaluate_surface.Normal, Unitize=False)
equality_5 = Equality(FirstNumber=dot_product, SecondNumber="-1")  # -> Equality, Inequality
cull_pattern_15 = CullPattern(List=deconstruct_brep_2.Faces, CullPattern=equality_5.Equality)  # -> flatten(List)
project = Project(Geometry=cull_pattern_15, Plane=PlaneXY(0, 0, 0))  # -> Geometry, Transform

# ----
# Identify Glass and calculate Ratio
brep_14 = Brep(simplify(brep_5))
bounding_box_2 = BoundingBox(Content=brep_14, Plane=plane_normal)  # -> simplify(Box), Box_2
deconstruct_brep_3 = DeconstructBrep(Brep=bounding_box_2.Box)  # -> Faces, Edges, Vertices
evaluate_surface_2 = EvaluateSurface(Surface=reparameterize(deconstruct_brep_3.Faces), Point=construct_point)  # -> Point, Normal, UDirection, VDirection, Frame
trim_tree = TrimTree(Tree=evaluate_surface_2.Normal, Depth=1)
list_length_2 = ListLength(List=evaluate_surface_2.Normal)
angle = Angle(VectorA=trim_tree, VectorB=plane_normal)  # -> Angle, Reflex
trim_tree_2 = TrimTree(Tree=list_length_2, Depth=1)
degrees = Degrees(Radians=angle.Angle)
round = Round(Number=degrees)  # -> Nearest, Floor, Ceiling
expression_4 = Expression(x=round.Nearest, Expression="x = 180")
expression_5 = Expression(x=round.Nearest, Expression="x = 0")
gate_or_2 = GateOr(A=expression_5, B=expression_4)
partition_list = PartitionList(List=gate_or_2, Size=trim_tree_2)

# ---- group: All Faces with Normal 0° or 180° to Window
cull_pattern_16 = CullPattern(List=deconstruct_brep_3.Faces, CullPattern=partition_list)

# ----
area_5 = Area(Geometry=cull_pattern_16)  # -> Area, Centroid
list_item_4 = ListItem(List=area_5.Centroid, Index=0, Wrap=True)  # -> Item, Item1
distance_2 = Distance(PointA=list_item_4.Item, PointB=list_item_4.Item1)
trim_tree_3 = TrimTree(Tree=area_5.Area, Depth=1)
trim_tree_4 = TrimTree(Tree=distance_2, Depth=1)
bounds_3 = Bounds(Numbers=trim_tree_3)
cull_nth = CullNth(List=trim_tree_3, CullFrequency=2)
bounds_4 = Bounds(Numbers=trim_tree_4)
deconstruct_domain_3 = DeconstructDomain(Domain=bounds_3)  # -> Start, End
deconstruct_domain_4 = DeconstructDomain(Domain=bounds_4)  # -> Start, End
equality_within_tolerance = EqualityWithinTolerance(FirstNumber=trim_tree_4, SecondNumber=deconstruct_domain_4.Start, Tolerance=0.1595272236)  # -> Equality, Inequality

# ---- group: GlassArea
cull_pattern_17 = CullPattern(List=cull_nth, CullPattern=equality_within_tolerance.Equality)

mass_addition_2 = MassAddition(Input=cull_pattern_17)  # -> simplify(Result), PartialResults

# ---- group: GlassElements
cull_pattern_18 = CullPattern(List=brep_14, CullPattern=equality_within_tolerance.Equality)  # disabled

# ---- group: FrameArea (filled) / Opening
number_24 = Number(deconstruct_domain_3.End)

# ---- group: Frame Area (only Frame)
subtraction_2 = Subtraction(A=number_24, B=mass_addition_2.Result)

# ----
division = Division(A=subtraction_2, B=number_24)  # -> flatten(Result)

# ---- group: Frame Ratio
number_25 = Number(flatten(division))

number_26 = Number(number_25)

# ----
# Various Window Data
bounding_box_3 = BoundingBox(Content=brep_6, Plane=plane_normal, UnionBox=True)  # -> Box, Box_2
cluster_6 = Cluster_3(brep=bounding_box_3.Box)  # -> vertical, bottom, top
area_6 = Area(Geometry=cluster_6.vertical)  # -> Area, Centroid
volume = Volume(Geometry=brep_8)  # -> Volume, Centroid
sort_list_3 = SortList(Keys=area_6.Area, ValuesCentroids=area_6.Centroid, ValuesFaces=cluster_6.vertical)  # -> Keys, ValuesCentroids, ValuesFaces
cluster_7 = Cluster_4(roombrep=brep_8, list=sort_list_3.ValuesCentroids, list_2=sort_list_3.ValuesFaces)  # -> window_outside_face, normal

# ---- group: Bottom of Window BBox
brep_15 = Brep(flatten(cluster_6.bottom))

# ---- group: Top of Window BBox
brep_16 = Brep(flatten(cluster_6.top))

# ---- group: Sill Window
brep_17 = Brep(simplify(brep_15))

# ----
# Expand Sill to Room
project_2 = Project(Geometry=brep_7, Plane=brep_17)  # -> Geometry, Transform
deconstruct_brep_4 = DeconstructBrep(Brep=brep_17)  # -> Faces, Edges, Vertices
deconstruct_brep_5 = DeconstructBrep(Brep=project_2.Geometry)  # -> Faces, Edges, Vertices
join_curves = JoinCurves(Curves=deconstruct_brep_5.Edges, Preserve=False)
pull_point = PullPoint(Point=deconstruct_brep_4.Vertices, Geometry=join_curves, ClosestOnly=True)  # -> ClosestPoint, Distance, Index
sort_list_4 = SortList(Distance=pull_point.Distance, ValuesVertices=deconstruct_brep_4.Vertices)  # -> Distance, ValuesVertices; disabled
sort_list_5 = SortList(Distance=pull_point.Distance, ValuesVertices=pull_point.ClosestPoint)  # -> Distance, ValuesVertices
list_item_5 = ListItem(List=sort_list_4.ValuesVertices, Index=0, Wrap=True)  # -> Item2, Item1, Item; disabled
list_item_6 = ListItem(List=sort_list_5.ValuesVertices, Index=0, Wrap=True)  # -> Item, Item1
point_15 = Point(simplify(list_item_6.Item))
point_16 = Point(simplify(list_item_6.Item1))
point_17 = Point(list_item_5.Item1)  # disabled

# ---- group: Window Heigth
area_7 = Area(Geometry=brep_16)  # -> Area, Centroid
area_8 = Area(Geometry=brep_15)  # -> Area, Centroid
deconstruct_9 = Deconstruct(Point=area_7.Centroid)  # -> XComponent, YComponent, ZComponent
deconstruct_10 = Deconstruct(Point=area_8.Centroid)  # -> XComponent, YComponent, ZComponent
subtraction_3 = Subtraction(A=deconstruct_9.ZComponent, B=deconstruct_10.ZComponent)

# ----
subtraction_4 = Subtraction(A=deconstruct_10.ZComponent, B=number_14)

element_type_2 = ElementType(Element=element_11)  # -> Element, Type
element_parameter_8 = ElementParameter(Element=element_type_2.Type, Parameter="Width")  # -> Element, Value
amplitude = Amplitude(Vector=vector_2, Amplitude=element_parameter_8.Value)  # -> graft(Vector)
move_3 = Move(Geometry=point_16, Motion=amplitude)  # -> Geometry, Transform
move_4 = Move(Geometry=point_15, Motion=amplitude)  # -> Geometry, Transform

round_2 = Round(Number=subtraction_4)  # -> Nearest, Floor, Ceiling

# ---- group: Centroid of Window BBox (outside face)
point_18 = Point(flatten(cluster_7.window_outside_face))

# ---- group: Normal of Window BBox (outside face)
vector_12 = Vector(flatten(cluster_7.normal))

# ---- group: Window Normal
vector_13 = Vector(flatten(vector_12))

# ----
line_sdl_2 = LineSDL(Start=point_14, Direction=vector_13, Length=number_5)
rotate = Rotate(Geometry=line_sdl_2, Angle=graft(degrees(number_6)), Plane=point_14)  # -> Geometry, Transform
flip_matrix = FlipMatrix(Data=rotate.Geometry)
end_points = EndPoints(Curve=flip_matrix)  # -> Start, End
list_item_7 = ListItem(List=end_points.End, Index=0, Wrap=True)  # -> Item, Item1
line = Line(StartPoint=list_item_7.Item, EndPoint=list_item_7.Item1)
join_curves_2 = JoinCurves(Curves=[line, flip_matrix], Preserve=False)  # -> flatten(Curves)
project_3 = Project(Geometry=join_curves_2, Plane=PlaneXY(0, 0, 0))  # -> Geometry, Transform
boundary_surfaces_2 = BoundarySurfaces(Edges=project_3.Geometry)
mesh_mesh = MeshMesh(MeshA=graft(project.Geometry), MeshB=boundary_surfaces_2)
trim_tree_5 = TrimTree(Tree=mesh_mesh, Depth=1)  # -> simplify(Tree)
list_length_3 = ListLength(List=trim_tree_5)
larger_than_3 = LargerThan(FirstNumber=list_length_3, SecondNumber="0")  # -> flatten(LargerThan), OrEqualTo

# ---- group: Window_Normal
vector_14 = Vector(vector_12)

# ----
cull_pattern_19 = CullPattern(List=element_geometry_5, CullPattern=larger_than_3.LargerThan)
cull_pattern_20 = CullPattern(List=query_elements_4.Elements, CullPattern=larger_than_3.LargerThan)

# ---- group: SillHeigth
number_27 = Number(flatten(round_2.Nearest))

# ---- group: WindowHeigth
number_28 = Number(flatten(subtraction_3))

# ----
stream_gate_3 = StreamGate(Stream=move_3.Geometry, Gate=data_5)  # -> Target0, Target1

# ---- group: Centroid Window BBox
point_19 = Point(point_18)

# ---- group: Window Normal
vector_15 = Vector(vector_12)

# ---- group: Sill Heigth
number_29 = Number(number_27)

# ---- group: Window Heigth
number_30 = Number(number_28)

# ---- group: Window vectors
vector_16 = Vector(simplify(graft(vector_12)))

# ---- group: MESH Surroundings
mesh_5 = Mesh(cull_pattern_19)

# ---- group: Window Facing Vector
vector_17 = Vector(vector_12)

# ----
# BBox in front of windows
amplitude_2 = Amplitude(Vector=vector_14, Amplitude=number_11)
unit_z_3 = UnitZ(Factor=number_11)

# ----
# Generate Sill Faces
# Expand Sill Outer Wall
point_20 = Point(list_item_5.Item2)  # disabled
stream_gate_4 = StreamGate(Stream=move_4.Geometry, Gate=data_5)  # -> Target0, Target1

# ---- group: Extend sill to a second wall if given
# Expand Sill to 2nd Outer Wall
amplitude_3 = Amplitude(Vector=vector_3, Amplitude=data_10)
move_5 = Move(Geometry=stream_gate_3.Target0, Motion=graft(amplitude_3))  # -> Geometry, Transform
move_6 = Move(Geometry=stream_gate_4.Target0, Motion=graft(amplitude_3))  # -> Geometry, Transform

# ----
point_21 = Point([stream_gate_4.Target1, move_6.Geometry])
rectangle_3pt = Rectangle3Pt(PointA=point_15, PointB=point_16, PointC=point_21)  # -> Rectangle, Length
boundary_surfaces_3 = BoundarySurfaces(Edges=rectangle_3pt.Rectangle)  # -> flatten(Surfaces)

# ---- group: Window_Outside1
point_22 = Point(flatten(point_21))

# ----
point_23 = Point([move_5.Geometry, stream_gate_3.Target1])

# ---- group: Window_Outside2
point_24 = Point(flatten(point_23))

# ----
line_2 = Line(StartPoint=point_22, EndPoint=point_24)
extend_curve = ExtendCurve(Curve=line_2, Type=0, Start=number_11, End=number_11)
move_7 = Move(Geometry=extend_curve, Motion=amplitude_2)  # -> Geometry, Transform
entwine = Entwine(Branch00=extend_curve, Branch01=move_7.Geometry, FlattenInputs=True)
flip_matrix_2 = FlipMatrix(Data=entwine)
loft = Loft(Curves=flip_matrix_2, Options={Adjust=False, Closed=False, LoftEnds=0, LoftSimp=0, LoftType=0, Rebuild=10, Refit=0.01})
extrude = Extrude(Base=loft, Direction=unit_z_3)
mesh_6 = Mesh(flatten(extrude))

mesh_join = MeshJoin(Meshes=mesh_6)

clash = Clash(FirstSet=mesh_2, SecondSet=mesh_join, Distance=0, ResultLimit=100)  # -> ClashCount, ClashPoints, ClashRadii, FirstIndex, SecondIndex
clash_2 = Clash(FirstSet=mesh, SecondSet=mesh_join, Distance=0, ResultLimit=100)  # -> ClashCount, ClashPoints, ClashRadii, FirstIndex, SecondIndex
clash_3 = Clash(FirstSet=mesh_brep, SecondSet=mesh_join, Distance=0, ResultLimit=100)  # -> ClashCount, ClashPoints, ClashRadii, FirstIndex, SecondIndex
list_item_8 = ListItem(List=mesh, Index=clash_2.FirstIndex, Wrap=True)
list_item_9 = ListItem(List=cull_pattern_9, Index=clash.FirstIndex, Wrap=True)
list_item_10 = ListItem(List=mesh_2, Index=clash.FirstIndex, Wrap=True)
list_item_11 = ListItem(List=cull_pattern_8, Index=clash_3.FirstIndex, Wrap=True)
list_item_12 = ListItem(List=mesh_brep, Index=clash_3.FirstIndex, Wrap=True)

# ----
# Project Centerpoint to Facade Outside
unit_z_4 = UnitZ(Factor=1)
move_8 = Move(Geometry=point_23, Motion=unit_z_4)  # -> Geometry, Transform
plane_3pt = Plane3Pt(PointA=point_21, PointB=point_23, PointC=move_8.Geometry)
project_4 = Project(Geometry=point_19, Plane=flatten(plane_3pt))  # -> Geometry, Transform

# ---- group: Sill Breps
brep_18 = Brep(boundary_surfaces_3)

# ---- group: Move the measuring point in front of the façade (necessary if the geometry is determined using BBOXes)
amplitude_4 = Amplitude(Vector=vector_12, Amplitude=Slider(10, range=0..10))
move_9 = Move(Geometry=project_4.Geometry, Motion=amplitude_4)  # -> Geometry, Transform

# ---- group: CenterPoint Window (on outside Facade)
point_25 = Point(move_9.Geometry)

# ---- group: Center Point Window
point_26 = Point(point_25)

# ---- group: Sill Breps
brep_19 = Brep(brep_18)

# ----
# Encode Windows
cluster_8 = Cluster_5(
    translation_vector=vector_5,
    G=brep_19,
    point=point_26,
    vector=vector_15,
    input=brep_11,
    heightsilloverfloor=number_29,
    frameratio=number_26,
    windowheight=number_30)  # -> encodedwindow, windowsillmesh_2, orientation, C
previewroom = CustomPreview(Geometry=cluster_8.windowsillmesh_2, Material=cluster_8.C)  # disabled

# ---- group: Window CenterPoints
point_27 = Point(point_25)

# ----
# Encode Room
subtraction_5 = Subtraction(A=number_17, B=number_16)
subtraction_6 = Subtraction(A=number_19, B=number_20)
repeat_data = RepeatData(Data=number_21, Length=number_18)
repeat_data_2 = RepeatData(Data=data_6, Length=number_18)
repeat_data_3 = RepeatData(Data=subtraction_6, Length=number_18)
repeat_data_4 = RepeatData(Data=subtraction_5, Length=number_18)
cluster_9 = Cluster_2(
    heightroofoverfloor=repeat_data_3,
    heightflooroverterrain=repeat_data_4,
    heightceilingoverfloor=repeat_data,
    translation_vector=vector_4,
    maxceilingoverfloorheight=repeat_data_2,
    floor=brep_12,
    point=point_27,
    vector=vector_17)  # -> scaled_gdi_shape, S, C, mesh_2, roomedges, transformation_matrix, orientedroomfloor, roomxdimension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
# ENCODING
previewroom_2 = CustomPreview(Geometry=cluster_9.mesh_2, Material=cluster_9.C)  # disabled

# ---- group: Window Points
point_28 = Point(simplify(graft(point_25)))

# ---- group: MESH Walls
mesh_7 = Mesh(list_item_10)

# ---- group: MESH Floors and Roofs
mesh_8 = Mesh([list_item_8, list_item_12])

# ----
# Encode Context
panel_4 = Panel("1000")  # disabled
pixelsforcontextbar = Brep([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])  # disabled
scale = Scale(Geometry=pixelsforcontextbar, Center=Point(0, 0, 0), Factor=panel_4)  # -> Geometry, Transform; disabled
repeat_data_5 = RepeatData(Data=graft(brep_10), Length=number_15)
flip_matrix_3 = FlipMatrix(Data=repeat_data_5)  # -> simplify(Data)
move_10 = Move(Geometry=flip_matrix_3, Motion=vector_6)  # -> Geometry, Transform
mesh_9 = Mesh(flatten([mesh_5, mesh_7]))
cluster_10 = Cluster_6(
    window_vector=vector_16,
    window_point=point_28,
    floor=brep_13,
    meshes=mesh_9,
    floorandroofs=mesh_8,
    contextpixelsascrv=move_10.Geometry)  # -> R_2, R, C, S
contextbargeo = Mesh(move_10.Geometry)  # disabled
previewcodedcntxt = CustomPreview(Geometry=contextbargeo, Material=cluster_10.C)  # disabled

# ----
# The drawing sequence of the shapes is determined by the sequence in the merge node. Lower inputs are displayed first (Exp: D4 over D3 over D2 over D1)
merge_3 = Merge(
    Data1=flatten(cluster_8.encodedwindow),
    Data2=flatten(cluster_9.S),
    Data3=flatten(create_gdi_shape),
    Data4=flatten(cluster_10.S))

# ----
# generate encoded image DF
clean_tree = CleanTree(RemoveNulls=True, RemoveInvalid=True, RemoveEmpty=False, Tree=merge_3)
frame = Brep(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)  # disabled
panel_5 = Panel("1000")  # disabled
scale_2 = Scale(Geometry=frame, Center=Point(0, 0, 0), Factor=panel_5)  # -> Geometry, Transform; disabled
brep_20 = Brep(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)
move_11 = Move(Geometry=brep_20, Motion=vector_8)  # -> simplify(graft(Geometry)), Transform
factor_for_1024x1024 = Slider(0.08, range=0..0.1)
color_2 = ColourSwatch(SwatchColor=RGB(255, 255, 255))
draw = DrawImage(
    Shapes=clean_tree,
    Size=move_11.Geometry,
    Factor=factor_for_1024x1024,
    Background=color_2,
    AntiAlias=False,
    FileLocation=text_3)

# ---- group: Transformations from OriginalPos. to PhotoFrame
transform = Transform(cluster_8.orientation)

# ---- group: Room Edges
curve_2 = Curve(cluster_9.roomedges)

# ----
# determine if floorplans
# are out of bounds and selects the
# basis floorplan
brep_21 = Brep(move_11.Geometry)
list_length_4 = ListLength(List=curve_2)  # -> flatten(Length)
end_points_2 = EndPoints(Curve=curve_2)  # -> Start, End
point_29 = Point(simplify(end_points_2.Start))
list_item_13 = ListItem(List=list_length_4, Index=0, Wrap=True)
project_5 = Project(Geometry=point_29, Plane=brep_21)  # -> Geometry, Transform
surface_closest_point = SurfaceClosestPoint(Point=project_5.Geometry, Surface=brep_21)  # -> Point, UVPoint, Distance
equality_within_tolerance_2 = EqualityWithinTolerance(FirstNumber=surface_closest_point.Distance, SecondNumber="0", Tolerance=0.1595272236)  # -> Equality, Inequality
# PREPARE REQUEST FOR SERVER
mass_addition_3 = MassAddition(Input=equality_within_tolerance_2.Equality)  # -> Result, PartialResults
equality_6 = Equality(FirstNumber=mass_addition_3.Result, SecondNumber=list_item_13)  # -> flatten(Equality), Inequality
python_3_script_2 = Python3Script(image_flags=equality_6.Equality)  # -> out, selected_index; inputs image_flags: list of Boolean
# ---------- python_3_script_2: Python ----------
if True in image_flags:
    selected_index = image_flags.index(1)
else:
    selected_index = 0
# ---------- end python_3_script_2 ----------

# ---- group: Index of Floorplan in Bounds
data_11 = Data(python_3_script_2.selected_index)

# ---- group: Rotate all Rooms to align with Room0 / Midpoint of PhotoFrame
mesh_10 = Mesh(brep_20)

# ---- group: Rotate all Rooms to align with Room0 / Rooms
mesh_11 = Mesh(cluster_9.orientedroomfloor)

# ---- group: Index of Floorplan in Bounds
data_12 = Data(python_3_script_2.selected_index)

# ---- group: Testing Areas
brep_22 = Brep(move_11.Geometry)

# ---- group: GDI Shapes of Floorplan
data_13 = Data(cluster_9.scaled_gdi_shape)

# ----
# mask to
# input result
list_item_14 = ListItem(List=flatten(brep_22), Index=data_12, Wrap=True)
list_item_15 = ListItem(List=data_13, Index=data_12, Wrap=True)
factor_for_128x128 = Slider(0.01, range=0..1)
concatenate_2 = Concatenate(FragmentA=text_4, FragmentB="\mask.png")
color_3 = ColourSwatch(SwatchColor=RGB(255, 255, 255))
draw_2 = DrawImage(
    Shapes=list_item_15,
    Size=list_item_14,
    Factor=factor_for_128x128,
    Background=color_3,
    AntiAlias=False,
    FileLocation=concatenate_2)

point_30 = Point(project_5.Geometry)
vector_2pt = Vector2Pt(PointA=point_30, PointB=move_2.Geometry, Unitize=False)  # -> Vector, Length
deconstruct_vector = DeconstructVector(Vector=vector_2pt.Vector)  # -> XComponent, YComponent, ZComponent
bounds_5 = Bounds(Numbers=deconstruct_vector.XComponent)
bounds_6 = Bounds(Numbers=deconstruct_vector.YComponent)
deconstruct_domain_5 = DeconstructDomain(Domain=bounds_5)  # -> flatten(Start), End
deconstruct_domain_6 = DeconstructDomain(Domain=bounds_6)  # -> flatten(Start), End

# ---- group: Y
list_item_16 = ListItem(List=deconstruct_domain_5.Start, Index=python_3_script_2.selected_index, Wrap=True)

# ---- group: X
list_item_17 = ListItem(List=deconstruct_domain_6.Start, Index=python_3_script_2.selected_index, Wrap=True)

# ---- group: Analysis Areas
brep_23 = Brep(brep_20)

# ---- group: Index of Floorplan in Bounds
data_14 = Data(python_3_script_2.selected_index)

# ----
# preparing for flask
list_length_5 = ListLength(List=transform)
equality_7 = Equality(FirstNumber=list_length_5, SecondNumber="1")  # -> Equality, Inequality
invert_matrix = InvertMatrix(Matrix=transform, Tolerance=0)  # -> Matrix, Success
stream_gate_5 = StreamGate(Stream=invert_matrix.Matrix, Gate=equality_7.Equality)  # -> Target0, Target1
deconstruct_matrix = DeconstructMatrix(Matrix=stream_gate_5.Target0)  # -> Rows, Columns, simplify(Values)
panel_6 = Panel("""0
4""")
list_item_18 = ListItem(List=deconstruct_matrix.Values, Index=panel_6, Wrap=True)  # -> Item, Item1
expression_6 = Expression(x=list_item_18.Item1, y=list_item_18.Item, Expression="Atan2(x,y)")
tree_branch = TreeBranch(Tree=expression_6, Path=data_11, MaintainPaths=True)
list_item_19 = ListItem(List=expression_6, Index=0, Wrap=True)
list_item_20 = ListItem(List=tree_branch, Index=0, Wrap=True)
subtraction_7 = Subtraction(A=list_item_20, B=list_item_19)  # -> flatten(Result)

# ---- group: Rotate all Rooms to align with Room0
area_9 = Area(Geometry=mesh_10)  # -> Area, Centroid
rotate_2 = Rotate(Geometry=mesh_11, Angle=subtraction_7, Plane=area_9.Centroid)  # -> Geometry, Transform

# ---- group: Translation of Rooms to align with Room0
area_10 = Area(Geometry=rotate_2.Geometry)  # -> Area, simplify(graft(Centroid))
list_item_21 = ListItem(List=area_10.Centroid, Index=0, Wrap=True)
tree_branch_2 = TreeBranch(Tree=area_10.Centroid, Path=data_11, MaintainPaths=True)
list_item_22 = ListItem(List=tree_branch_2, Index=0, Wrap=True)
vector_2pt_2 = Vector2Pt(PointA=list_item_21, PointB=list_item_22, Unitize=False)  # -> flatten(Vector), Length

# ----
# send 0 if only one picture
vector_xyz = VectorXYZ(XComponent=0, YComponent=0, ZComponent=0)  # -> Vector, Length
stream_filter = StreamFilter(Gate=equality_7.Equality, Stream0=subtraction_7, Stream1="0")
stream_filter_2 = StreamFilter(Gate=equality_7.Equality, Stream0=vector_2pt_2.Vector, Stream1=vector_xyz.Vector)
vector_18 = Vector(stream_filter_2)
number_31 = Number(stream_filter)

# ---- group: with metrics
number_32 = Number(list_length)
text_5 = Text(text)
python_3_script_3 = Python3Script(rotations_rad=number_31, gh_translation_vectors=vector_18, image_folder_path=text_5, num_images=number_32)  # -> out, a, success_output, output_image_path, average_value_output, ratio_gt1_output; inputs rotations_rad: list of Double, gh_translation_vectors: list of Vector3d, image_folder_path: String, num_images: Int32; disabled
# ---------- python_3_script_3: Python ----------
# r: requests
# Inputs for the GHPython component:
# image_folder_path (Type string, path to the folder with the images)
# rotations_rad (Type float, List Access)
# gh_translation_vectors (Type Vector or Point, List Access - this is the list of Vector/Point objects from GH)
# num_images (Type int, Item Access)
# trigger (Type boolean, Item Access - optional, to trigger the script)

import requests
import json
import os
import Rhino.Geometry # Necessary to access .X, .Y, .Z of Point3d/Vector3d
import System # For System.Convert and file handling

# --- Hardcoded server URL (adjust if necessary) ---
#SERVER_URL = "http://localhost:8081/df_gh_orchestrator"
#SERVER_URL = "http://localhost:5000/process_images_pipeline"
SERVER_URL = "https://daylight-server-182483330095.europe-north2.run.app/df_gh_orchestrator"

# --- Default outputs ---
# 'a' will be the status message or the path to the result image
# 'success_output' will be a boolean indicating success
# 'output_image_path' will be the path to the final file (empty on error)
# NEW: Metrics
# 'average_value_output' will be the average value of non-white pixels
# 'ratio_gt1_output' will be the ratio of pixels with value > 1 to all non-white pixels

a = "Script not executed or trigger not active."
success_output = False
output_image_path = ""
average_value_output = 0.0 # Default value for new metric
ratio_gt1_output = 0.0     # Default value for new metric


# --- Plausibility checks ---
if not image_folder_path or not os.path.isdir(image_folder_path):
    a = "Error: Image folder path is invalid or not specified."
    success_output = False
elif not isinstance(num_images, int) or num_images < 0:
    a = "Error: num_images must be a positive integer or 0."
    success_output = False
elif num_images > 0 and (not rotations_rad or len(rotations_rad) != num_images):
    a = "Error: Number of rotation angles does not match num_images or is missing."
    success_output = False
elif num_images > 0 and (not gh_translation_vectors or len(gh_translation_vectors) != num_images):
    a = "Error: Number of translation vectors does not match num_images or is missing."
    success_output = False
else:
    # --- Execute main logic only if inputs are plausible ---
    prepared_ok = True

    translations_mm_list = []
    if num_images > 0:
        for i in range(num_images):
            vec = gh_translation_vectors[i]
            if hasattr(vec, 'X') and hasattr(vec, 'Y') and hasattr(vec, 'Z'):
                translations_mm_list.append([vec.X, vec.Y, vec.Z])
            else:
                print("Warning: Object #{} in gh_translation_vectors does not have the expected X,Y,Z attributes. Using [0,0,0]. Object: {}".format(i, vec))
                translations_mm_list.append([0.0, 0.0, 0.0])

    files_to_send_tuples = []
    if prepared_ok and num_images > 0:
        for i in range(num_images):
            filename_on_server = "floorplan{}.png".format(i)
            filepath_local = os.path.join(image_folder_path, "floorplan{}.png".format(i))

            if os.path.exists(filepath_local):
                try:
                    file_object = open(filepath_local, 'rb')
                    files_to_send_tuples.append(
                        (filename_on_server, (os.path.basename(filepath_local), file_object, 'image/png'))
                    )
                except IOError as e:
                    a = "Error: Could not open image file {}: {}".format(filepath_local, e)
                    prepared_ok = False
                    for _, f_tuple_data in files_to_send_tuples:
                        file_obj_to_close = f_tuple_data[1] # This is the fileobject in the tuple (filename, fileobject, content_type)
                        if hasattr(file_obj_to_close, 'close') and not file_obj_to_close.closed:
                            file_obj_to_close.close()
                    files_to_send_tuples = []
                    break
            else:
                a = "Error: Image file not found: {}".format(filepath_local)
                prepared_ok = False
                break
    
    elif num_images == 0:
        a = "No images to process (num_images is 0). Not sending a request."
        success_output = True # Not an error, but no processing; or False, depending on definition
        prepared_ok = False

    if prepared_ok and num_images > 0:
        if len(files_to_send_tuples) != num_images:
            a = "Error: Not all image files could be prepared for upload. Expected: {}, Found: {}".format(num_images, len(files_to_send_tuples))
            prepared_ok = False
            for _, f_tuple_data in files_to_send_tuples:
                file_obj_to_close = f_tuple_data[1] # This is the fileobject
                if hasattr(file_obj_to_close, 'close') and not file_obj_to_close.closed:
                    file_obj_to_close.close()

    if prepared_ok and num_images > 0:
        payload_data = {
            "rotations_rad": json.dumps(list(rotations_rad)),
            "translations_mm": json.dumps(translations_mm_list),
            "num_images": str(num_images)
        }

        response_message = "Initial value for response."
        try:
            print("Sending request to server: {} with {} images.".format(SERVER_URL, num_images))
            response = requests.post(SERVER_URL, data=payload_data, files=dict(files_to_send_tuples))

            print("Server response status code: {}".format(response.status_code))
            
            is_successful_header = response.headers.get('X-Processing-Success', 'False').lower() == 'true'

            if response.status_code == 200 and is_successful_header:
                image_data_bytes = response.content
                content_disposition = response.headers.get('Content-Disposition')
                received_filename = "final_processed_image.png"
                if content_disposition:
                    parts = content_disposition.split(';')
                    for part in parts:
                        if 'filename=' in part:
                            received_filename = part.split('=')[1].strip('"')
                            break
                
                output_image_path = os.path.join(image_folder_path, received_filename)
                
                try:
                    with open(output_image_path, 'wb') as f_out:
                        f_out.write(image_data_bytes)
                    response_message = "Success: Image received and saved under {}".format(output_image_path)
                    a = response_message
                    success_output = True
                    print(response_message)

                    # NEW: Read metrics from headers
                    try:
                        avg_val_str = response.headers.get('X-Average-Value')
                        ratio_gt1_str = response.headers.get('X-Ratio-Pixels-GT1')

                        if avg_val_str is not None:
                            average_value_output = float(avg_val_str)
                            print("Received average value: {}".format(average_value_output))
                        else:
                            print("Warning: Header 'X-Average-Value' not found in server response.")
                            # average_value_output retains default value 0.0

                        if ratio_gt1_str is not None:
                            ratio_gt1_output = float(ratio_gt1_str)
                            print("Received ratio (value > 1): {}".format(ratio_gt1_output))
                        else:
                            print("Warning: Header 'X-Ratio-Pixels-GT1' not found in server response.")
                            # ratio_gt1_output retains default value 0.0
                            
                    except ValueError as ve:
                        print("Error converting metric headers to float: {}".format(ve))
                        # Metrics retain their default values on error or missing headers
                    except Exception as e_metrics: # Catches other unexpected errors during metric handling
                        print("General error reading metric headers: {}".format(e_metrics))


                except IOError as e:
                    response_message = "Error: Could not save received image under {}: {}".format(output_image_path, e)
                    a = response_message
                    success_output = False
                    print(response_message)
                    output_image_path = ""
                    # Metrics retain default values

            else:
                success_output = False
                error_detail = "No further details."
                try:
                    error_json = response.json()
                    error_detail = error_json.get("error", response.text[:200])
                except ValueError:
                    error_detail = response.text[:200]

                response_message = "Error from server (Status {}): {}. Header X-Processing-Success: {}".format(
                    response.status_code,
                    error_detail,
                    response.headers.get('X-Processing-Success', 'Not present')
                    )
                a = response_message
                print(response_message)
                # Metrics and output_image_path retain default/empty values

        except requests.exceptions.ConnectionError as e:
            response_message = "Error: Connection to server failed. Is the Flask server started and reachable at {}? Details: {}".format(SERVER_URL, e)
            a = response_message; success_output = False; print(response_message)
        except requests.exceptions.Timeout as e:
            response_message = "Error: Timeout during request to server: {}".format(e)
            a = response_message; success_output = False; print(response_message)
        except requests.exceptions.RequestException as e:
            response_message = "Error during request to server: {}".format(e)
            a = response_message; success_output = False; print(response_message)
        finally:
            # Ensure all open file handles are closed
            for field_name, file_tuple_data_in_finally in files_to_send_tuples:
                # file_tuple_data_in_finally is (filename, fileobject, content_type)
                file_object_to_close = file_tuple_data_in_finally[1]
                if hasattr(file_object_to_close, 'close') and not file_object_to_close.closed:
                    file_object_to_close.close()
                    # Output of the field name (as seen by the server) and the original filename
                    print("File for field '{}' (Original name: {}) closed.".format(field_name, file_tuple_data_in_finally[0]))
    
    elif not prepared_ok and num_images > 0 :
        success_output = False
        print("Data preparation failed. Reason: {}".format(a))
        # Metrics retain default values

# Ensure that 'a' and success_output always have a meaningful value
if 'a' not in locals() or not a: # Should not happen due to initialization of 'a'
    if num_images > 0 and prepared_ok:
        a = "Unknown state or error before sending the request."
    elif num_images == 0 and not prepared_ok:
        pass # 'a' is already set
    elif not prepared_ok:
        pass # 'a' should already be set by a preparation error
    else:
        a = "Unknown error or state."
    # When in doubt, set 'success_output' to False if not explicitly marked as successful
    if not success_output: # Only set if it is not already True (e.g., for num_images == 0)
        success_output = False
    # Metrics retain their initial default values
# ---------- end python_3_script_3 ----------

# ---- group: sending metric in html body
python_3_script_4 = Python3Script(rotations_rad=number_31, gh_translation_vectors=vector_18, image_folder_path=text_5, num_images=number_32)  # -> out, a, success_output, output_image_path, average_value_output, ratio_gt1_output; inputs rotations_rad: list of Double, gh_translation_vectors: list of Vector3d, image_folder_path: String, num_images: Int32; disabled
# ---------- python_3_script_4: Python ----------
# r: requests
# Inputs for the GHPython component:
# image_folder_path (Type string, path to the folder with the images)
# rotations_rad (Type float, List Access)
# gh_translation_vectors (Type Vector or Point, List Access - this is the list of Vector/Point objects from GH)
# num_images (Type int, Item Access)
# trigger (Type boolean, Item Access - optional, to trigger the script)

import requests
import json
import os
import Rhino.Geometry 
import System 
import base64 # Python's own base64 module

# --- Hardcoded server URL (adjust if necessary) ---
#SERVER_URL = "http://localhost:5000/process_images_pipeline" #local script
SERVER_URL = "http://localhost:8081/df_gh_orchestrator" #gcp-script localls

# --- Default outputs ---
a = "Script not executed or trigger not active."
success_output = False
output_image_path = ""
average_value_output = 0.0 
ratio_gt1_output = 0.0   

# --- Plausibility checks ---
if not image_folder_path or not os.path.isdir(image_folder_path):
    a = "Error: Image folder path is invalid or not specified."
    success_output = False
elif not isinstance(num_images, int) or num_images < 0:
    a = "Error: num_images must be a positive integer or 0."
    success_output = False
elif num_images > 0 and (not rotations_rad or len(rotations_rad) != num_images):
    a = "Error: Number of rotation angles does not match num_images or is missing."
    success_output = False
elif num_images > 0 and (not gh_translation_vectors or len(gh_translation_vectors) != num_images):
    a = "Error: Number of translation vectors does not match num_images or is missing."
    success_output = False
else:
    prepared_ok = True
    translations_mm_list = []
    if num_images > 0:
        for i in range(num_images):
            vec = gh_translation_vectors[i]
            if hasattr(vec, 'X') and hasattr(vec, 'Y') and hasattr(vec, 'Z'):
                translations_mm_list.append([vec.X, vec.Y, vec.Z])
            else:
                print("Warning: Object #{} in gh_translation_vectors does not have X,Y,Z. Using [0,0,0]. Object: {}".format(i, vec))
                translations_mm_list.append([0.0, 0.0, 0.0])

    files_to_send_tuples = []
    if prepared_ok and num_images > 0:
        for i in range(num_images):
            filename_on_server = "floorplan{}.png".format(i)
            filepath_local = os.path.join(image_folder_path, "floorplan{}.png".format(i))
            if os.path.exists(filepath_local):
                try:
                    file_object = open(filepath_local, 'rb') 
                    files_to_send_tuples.append(
                        (filename_on_server, (os.path.basename(filepath_local), file_object, 'image/png'))
                    )
                except IOError as e:
                    a = "Error: Could not open image file {}: {}".format(filepath_local, e)
                    prepared_ok = False
                    for _, f_tuple_data in files_to_send_tuples:
                        if hasattr(f_tuple_data[1], 'close') and not f_tuple_data[1].closed: f_tuple_data[1].close()
                    files_to_send_tuples = []
                    break
            else:
                a = "Error: Image file not found: {}".format(filepath_local)
                prepared_ok = False
                break
    
    elif num_images == 0:
        a = "No images to process (num_images is 0). Not sending a request."
        success_output = True 
        prepared_ok = False

    if prepared_ok and num_images > 0:
        if len(files_to_send_tuples) != num_images:
            a = "Error: Not all image files prepared. Expected: {}, Found: {}".format(num_images, len(files_to_send_tuples))
            prepared_ok = False
            for _, f_tuple_data in files_to_send_tuples:
                if hasattr(f_tuple_data[1], 'close') and not f_tuple_data[1].closed: f_tuple_data[1].close()

    if prepared_ok and num_images > 0:
        payload_data = {
            "rotations_rad": json.dumps(list(rotations_rad)),
            "translations_mm": json.dumps(translations_mm_list),
            "num_images": str(num_images)
        }
        response_message = "Initial value for response."
        try:
            print("Sending request to server: {} with {} images.".format(SERVER_URL, num_images))
            actual_files_to_send = dict(files_to_send_tuples) if files_to_send_tuples else None
            response = requests.post(SERVER_URL, data=payload_data, files=actual_files_to_send)
            print("Server response status code: {}".format(response.status_code))
            
            if response.status_code == 200:
                try:
                    print("Raw server response text (first 500 chars): {}".format(response.text[:500]))
                    response_data = json.loads(response.text) 
                    
                    if response_data.get("success"):
                        image_base64_str = response_data.get("image_base64") # Renamed to avoid confusion
                        received_filename = response_data.get("filename", "processed_image_from_server.png") 
                        
                        if image_base64_str and received_filename:
                            image_data_bytes = None
                            try:
                                print("Attempting Base64 decoding using Python's base64 module...")
                                print("Input string length: {}".format(len(image_base64_str)))
                                # Verwende base64.b64decode anstelle von System.Convert.FromBase64String
                                image_data_bytes = base64.b64decode(image_base64_str)
                                print("Base64 decoding successful. Byte array length: {}".format(len(image_data_bytes) if image_data_bytes else "None"))
                                
                                output_image_path = os.path.join(image_folder_path, received_filename)
                                print("Output image path: {}".format(output_image_path))
                                
                                with open(output_image_path, 'wb') as f_out:
                                    f_out.write(image_data_bytes)
                                print("Image successfully written to disk.")
                                
                                response_message = "Success: Image received from JSON body and saved as {}".format(output_image_path)
                                a = response_message
                                success_output = True
                            
                            except (TypeError, base64.binascii.Error) as b64e: # Specific errors for base64.b64decode
                                response_message = "Error: Python's base64.b64decode failed: {}".format(b64e)
                                a = response_message; success_output = False; print(response_message)
                                output_image_path = ""
                            except IOError as e_io:
                                response_message = "Error: Could not save received image from JSON under {}: {}".format(output_image_path, e_io)
                                a = response_message; success_output = False; print(response_message)
                                output_image_path = ""
                            except Exception as e_b64_file_write: 
                                response_message = "Error during Base64 decoding or file writing: {}".format(e_b64_file_write)
                                a = response_message; success_output = False; print(response_message)
                                output_image_path = ""
                            
                            if success_output: # Metriken nur verarbeiten, wenn Bild erfolgreich war
                                try:
                                    metrics_data = response_data.get("metrics")
                                    if metrics_data:
                                        avg_val_json = metrics_data.get("average_value")
                                        ratio_gt1_json = metrics_data.get("ratio_gt1")

                                        if avg_val_json is not None:
                                            average_value_output = float(avg_val_json)
                                            print("Received average value from JSON: {}".format(average_value_output))
                                        else:
                                            print("Warning: 'average_value' not found in JSON metrics.")
                                        
                                        if ratio_gt1_json is not None:
                                            ratio_gt1_output = float(ratio_gt1_json)
                                            print("Received ratio (value > 1) from JSON: {}".format(ratio_gt1_output))
                                        else:
                                            print("Warning: 'ratio_gt1' not found in JSON metrics.")
                                    else:
                                        print("Warning: 'metrics' object not found in JSON response.")
                                except Exception as e_metrics:
                                    # Log error but don't necessarily fail the whole process if image was saved
                                    print("Error processing metrics data: {}".format(e_metrics))
                        else:
                            response_message = "Error: 'image_base64' or 'filename' missing in successful JSON response."
                            a = response_message; success_output = False; print(response_message)
                    else: 
                        error_detail = response_data.get("error", "Unknown error from server (success:false in JSON).")
                        response_message = "Server reported failure in JSON body: {}".format(error_detail)
                        a = response_message; success_output = False; print(response_message)
                
                except ValueError as ve: 
                    response_message = "Error: Could not decode JSON response from server (ValueError). Content: {}".format(response.text[:200])
                    a = response_message; success_output = False; print(response_message)
                    print("ValueError details: {}".format(ve)) 
                except Exception as e_inner: 
                    response_message = "Error processing successful JSON response (outer try): {}".format(e_inner) 
                    a = response_message; success_output = False; print(response_message)
                    output_image_path = ""
            else: 
                success_output = False
                error_detail = "No further details."
                try:
                    error_json = response.json() 
                    error_detail = error_json.get("error", response.text[:200])
                except: 
                    error_detail = response.text[:200]
                response_message = "Error from server (Status {}): {}".format(response.status_code, error_detail)
                a = response_message; print(response_message)

        except requests.exceptions.ConnectionError as e:
            response_message = "Error: Connection to server failed. Is server at {} started? Details: {}".format(SERVER_URL, e)
            a = response_message; success_output = False; print(response_message)
        except requests.exceptions.Timeout as e:
            response_message = "Error: Timeout during request to server: {}".format(e)
            a = response_message; success_output = False; print(response_message)
        except requests.exceptions.RequestException as e:
            response_message = "Error during request to server: {}".format(e)
            a = response_message; success_output = False; print(response_message)
        finally:
            for field_name, file_tuple_data in files_to_send_tuples:
                file_object_to_close = file_tuple_data[1]
                if hasattr(file_object_to_close, 'close') and not file_object_to_close.closed:
                    file_object_to_close.close()
                    print("File for field '{}' (Original: {}) closed.".format(field_name, file_tuple_data[0]))
    
    elif not prepared_ok and num_images > 0 :
        success_output = False 
        print("Data preparation failed before sending. Reason: {}".format(a))

if 'a' not in locals() or not a:
    if num_images > 0 and prepared_ok: 
        a = "Unknown state or error before sending the request."
    else:
        a = "Unknown error or state." 
    if not success_output:
        success_output = False
# ---------- end python_3_script_4 ----------

# ----
python_3_script_5 = Python3Script(
    rotations_rad=number_31,
    image_folder_path=text_5,
    num_images=number_32,
    x_value=list_item_17,
    y_value=list_item_16,
    executionMode=data_7)  # -> out, a, success_output, output_image_path, average_value_output, ratio_gt1_output; inputs rotations_rad: list of Double, image_folder_path: String, num_images: Int32, x_value: Double, y_value: Double, executionMode: String; disabled
# ---------- python_3_script_5: Python ----------
# Inputs for the GHPython component:
# image_folder_path (Type string, path to the folder with the images)
# rotations_rad (Type float, List Access)
# x_value (Type float, Item Access)
# y_value (Type float, Item Access)
# num_images (Type int, Item Access)
# trigger (Type boolean, Item Access - optional, to trigger the script)
# requirements: numpy
# requirements: opencv-python
# requirements: requests

import requests
import json
import os
import Rhino.Geometry # Necessary to access .X, .Y, .Z of Point3d/Vector3d
import System # For System.Convert and file handling
import base64
import io

# Try to import numpy and cv2, which are required for processing the response
try:
    import numpy as np
    import cv2
    libs_loaded = True
except ImportError:
    libs_loaded = False

# --- Server URLs  ---
LOCAL_SERVER_URL = "http://127.0.0.1:8081/get_df"
WEB_SERVER_URL   = "https://daylight-server-jia3y72oka-ma.a.run.app/get_df"

# --- Server selection based on executionMode input ---
if executionMode == "local":
    SERVER_URL = LOCAL_SERVER_URL
elif executionMode == "web":
    SERVER_URL = WEB_SERVER_URL
else:
    a = "Error: executionMode must be 'local' or 'web'."
    success_output = False
    # Abort further processing
    prepared_ok = False

# --- Default outputs ---
a = "Script not executed or trigger not active."
success_output = False
output_image_path = ""

# --- Pre-computation checks ---
if not libs_loaded:
    a = "Error: numpy and/or cv2 are not installed. These are required to process the server response."
    success_output = False
# --- Plausibility checks ---
elif not image_folder_path or not os.path.isdir(image_folder_path):
    a = "Error: Image folder path is invalid or not specified."
    success_output = False
elif not isinstance(num_images, int) or num_images < 0:
    a = "Error: num_images must be a positive integer or 0."
    success_output = False
elif not isinstance(x_value, (float, int)):
    a = "Error: x_value must be a single number."
    success_output = False
elif not isinstance(y_value, (float, int)):
    a = "Error: y_value must be a single number."
    success_output = False
elif num_images > 0 and (not rotations_rad or len(rotations_rad) != num_images):
    a = "Error: Number of rotation angles does not match num_images or is missing."
    success_output = False
else:
    # --- Execute main logic only if inputs are plausible ---
    prepared_ok = True

    files_to_send_tuples = []
    if num_images > 0:
        for i in range(num_images):
            filename_on_server = "floorplan{}.png".format(i)
            filepath_local = os.path.join(image_folder_path, "floorplan{}.png".format(i))

            if os.path.exists(filepath_local):
                try:
                    file_object = open(filepath_local, 'rb')
                    # The server expects all files under the key "file"
                    files_to_send_tuples.append(
                        ("file", (filename_on_server, file_object, 'image/png'))
                    )
                except IOError as e:
                    a = "Error: Could not open image file {}: {}".format(filepath_local, e)
                    prepared_ok = False
                    # Clean up already opened files
                    for _, f_tuple_data in files_to_send_tuples:
                        file_obj_to_close = f_tuple_data[1]
                        if hasattr(file_obj_to_close, 'close') and not file_obj_to_close.closed:
                            file_obj_to_close.close()
                    files_to_send_tuples = []
                    break
            else:
                a = "Error: Image file not found: {}".format(filepath_local)
                prepared_ok = False
                break
    
    elif num_images == 0:
        a = "No images to process (num_images is 0). Not sending a request."
        success_output = True 
        prepared_ok = False

    if prepared_ok and num_images > 0:
        if len(files_to_send_tuples) != num_images:
            a = "Error: Not all image files could be prepared for upload. Expected: {}, Found: {}".format(num_images, len(files_to_send_tuples))
            prepared_ok = False
            for _, f_tuple_data in files_to_send_tuples:
                file_obj_to_close = f_tuple_data[1]
                if hasattr(file_obj_to_close, 'close') and not file_obj_to_close.closed:
                    file_obj_to_close.close()

    if prepared_ok and num_images > 0:
        # --- Construct payload with the new structure ---
        payload_data = {
            "rotation": json.dumps(list(rotations_rad)),
            "translation": json.dumps({"x": x_value, "y": y_value})
        }

        response_message = "Initial value for response."
        try:
            print("Sending request to server: {} with {} images.".format(SERVER_URL, num_images))
            # Use 'files' parameter for list of tuples
            response = requests.post(SERVER_URL, data=payload_data, files=files_to_send_tuples)

            print("Server response status code: {}".format(response.status_code))
            
            if response.status_code == 200:
                try:
                    # --- New response handling ---
                    response_json = response.json()
                    base64_content = response_json["content"]
                    
                    # Decode the base64 string and load with numpy
                    decoded_bytes = base64.b64decode(base64_content)
                    image_array = np.load(io.BytesIO(decoded_bytes))
                    
                    # Define output path and save the image using cv2
                    received_filename = "final_processed_image.png"
                    output_image_path = os.path.join(image_folder_path, received_filename)

                    # cv2.imwrite expects BGR, but matplotlib/many libs use RGB.
                    image_to_save = cv2.cvtColor(image_array, cv2.COLOR_RGB2BGR)
                    cv2.imwrite(output_image_path, image_to_save)

                    response_message = "Success: Image received and saved under {}".format(output_image_path)
                    a = response_message
                    success_output = True
                    print(response_message)

                except KeyError:
                    a = "Error: 'content' key not found in server's JSON response."
                    success_output = False
                    print(a)
                except Exception as e_proc:
                    a = "Error processing server response: {}".format(e_proc)
                    success_output = False
                    print(a)

            else:
                success_output = False
                error_detail = response.text[:200]
                try:
                    error_json = response.json()
                    error_detail = error_json.get("error", error_detail)
                except ValueError:
                    pass 

                response_message = "Error from server (Status {}): {}".format(response.status_code, error_detail)
                a = response_message
                print(response_message)

        except requests.exceptions.ConnectionError as e:
            response_message = "Error: Connection to server failed. Is the server started and reachable at {}? Details: {}".format(SERVER_URL, e)
            a = response_message; success_output = False; print(response_message)
        except requests.exceptions.Timeout as e:
            response_message = "Error: Timeout during request to server: {}".format(e)
            a = response_message; success_output = False; print(response_message)
        except requests.exceptions.RequestException as e:
            response_message = "Error during request to server: {}".format(e)
            a = response_message; success_output = False; print(response_message)
        finally:
            # Ensure all open file handles are closed
            for field_name, file_tuple_data_in_finally in files_to_send_tuples:
                file_object_to_close = file_tuple_data_in_finally[1]
                if hasattr(file_object_to_close, 'close') and not file_object_to_close.closed:
                    file_object_to_close.close()
                    print("File for field '{}' (Original name: {}) closed.".format(field_name, file_tuple_data_in_finally[0]))
    
    elif not prepared_ok and num_images > 0 :
        success_output = False
        print("Data preparation failed. Reason: {}".format(a))
# ---------- end python_3_script_5 ----------
python_3_script_6 = Python3Script(
    rotations_rad=number_31,
    image_folder_path=text_5,
    num_images=number_32,
    x_value=list_item_17,
    y_value=list_item_16,
    executionMode=data_7)  # -> out, a, success_output, output_image_path, average_value_output, ratio_gt1_output; inputs rotations_rad: list of Double, image_folder_path: String, num_images: Int32, x_value: Double, y_value: Double, executionMode: String
# ---------- python_3_script_6: Python ----------
# GHPython inputs:
# image_folder_path : str   – folder with local PNGs
# rotations_rad     : list  – rotation angles (radians)
# x_value, y_value  : float – translation values
# num_images        : int   – number of images to upload
# executionMode     : str   – "local" | "web"
# trigger           : bool  – optional execution trigger

import os, io, json, base64, requests, clr, System
import numpy as np
import Rhino.Geometry

# .NET bitmap tools
clr.AddReference("System.Drawing")
from System.Drawing import Bitmap, Imaging
import System.Runtime.InteropServices as RM

LOCAL_SERVER_URL = "http://127.0.0.1:8081/get_df"
WEB_SERVER_URL   = "https://daylight-server-jia3y72oka-ma.a.run.app/get_df"
SERVER_URL       = LOCAL_SERVER_URL if executionMode == "local" else WEB_SERVER_URL

# default Grasshopper outputs
a                 = "Script not executed."
success_output    = False
output_image_path = ""

# basic validation
if not os.path.isdir(image_folder_path):
    a = "Error: image_folder_path is invalid."
elif num_images < 0 or (num_images > 0 and len(rotations_rad) != num_images):
    a = "Error: rotation list length does not match num_images."
elif SERVER_URL is None:
    a = "Error: executionMode must be 'local' or 'web'."
else:
    # collect image files
    files_to_send = []
    for i in range(num_images):
        p = os.path.join(image_folder_path, f"floorplan{i}.png")
        if not os.path.exists(p):
            a = f"Error: image not found – {p}"
            break
        files_to_send.append(("file", (f"floorplan{i}.png", open(p, "rb"), "image/png")))
    else:
        payload = {
            "rotation": json.dumps(list(rotations_rad)),
            "translation": json.dumps({"x": x_value, "y": y_value})
        }
        try:
            resp = requests.post(SERVER_URL, data=payload, files=files_to_send)
            if resp.status_code == 200:
                b64   = resp.json()["content"]
                arr   = np.load(io.BytesIO(base64.b64decode(b64)))       # RGB
                h, w, _ = arr.shape

                # save as PNG using .NET Bitmap (expects BGR)
                bmp     = Bitmap(w, h, Imaging.PixelFormat.Format24bppRgb)
                rect    = System.Drawing.Rectangle(0, 0, w, h)
                bmpData = bmp.LockBits(rect, Imaging.ImageLockMode.WriteOnly, bmp.PixelFormat)

                bgr = arr[:, :, ::-1].copy(order='C')                    # RGB→BGR
                buf = System.Array[System.Byte](bgr.flatten().tolist())
                RM.Marshal.Copy(buf, 0, bmpData.Scan0, buf.Length)
                bmp.UnlockBits(bmpData)

                output_image_path = os.path.join(image_folder_path, "final_processed_image.png")
                bmp.Save(output_image_path, Imaging.ImageFormat.Png)
                bmp.Dispose()

                a              = f"Success: image saved to {output_image_path}"
                success_output = True
            else:
                err = resp.text[:200]
                try: err = resp.json().get("error", err)
                except ValueError: pass
                a = f"Server error {resp.status_code}: {err}"
        except requests.exceptions.RequestException as e:
            a = f"HTTP error: {e}"
        finally:
            for _, f in files_to_send:
                if f[1] and not f[1].closed:
                    f[1].close()
# ---------- end python_3_script_6 ----------

merge_4 = Merge(Data1=python_3_script_5.output_image_path, Data2=concatenate_2)  # -> flatten(Result); disabled
stream_gate_6 = StreamGate(Stream=merge_4, Gate=python_3_script_5.success_output)  # -> Target0, Target1; disabled

# ---- group: Average DF
data_15 = Data(python_3_script_5.average_value_output)  # disabled

# ---- group: Ratio over 1% DF
data_16 = Data(python_3_script_5.ratio_gt1_output)  # disabled

# ----
dispatch = Dispatch(List=stream_gate_6.Target1, DispatchPattern=[True, False])  # -> ListA, ListB

import_image = ImportImage(File=dispatch.ListA, Rectangle=brep_23, XSamples="128", YSamples="128")
import_image_2 = ImportImage(File=dispatch.ListB, Rectangle=brep_23, XSamples="128", YSamples="128")

# ---- group: Ratio over 1% DF
data_17 = Data(data_16)

# ----
# write values to room parameters
# and display in revit
area_11 = Area(Geometry=brep_4)  # -> Area, Centroid
division_2 = Division(A=area_11.Area, B="1000000")
multiplication_2 = Multiplication(A=division_2, B=data_17)
round_to_decimal_place = RoundToDecimalPlace(NumberX=multiplication_2, DecimalPlace="2", RoundType=0)  # -> Rounded, Difference
unit_z_5 = UnitZ(Factor="1200")
concatenate_3 = Concatenate(FragmentA=round_to_decimal_place.Rounded, FragmentB="m²")
move_12 = Move(Geometry=area_11.Centroid, Motion=unit_z_5)  # -> Geometry, Transform
xy = XYPlane(Origin=move_12.Geometry)
negative = Negative(Value=Slider(100, range=0..100))
unit_y = UnitY(Factor=negative)
python_3_script_7 = Python3Script()  # -> out, a
# ---------- python_3_script_7: Python ----------
import rhinoscriptsyntax as rs
import Rhino

dsc = Rhino.RhinoDoc.ActiveDoc.DimStyles.Count
a = [Rhino.RhinoDoc.ActiveDoc.DimStyles.FindIndex(i) for i in range(0,dsc)]
# ---------- end python_3_script_7 ----------
move_13 = Move(Geometry=xy, Motion=unit_y)  # -> Geometry, Transform
item = ListItem(List=python_3_script_7.a, Index=Slider(0, range=0..10), Wrap=True)
python_3_script_8 = Python3Script(pl=move_13.Geometry, ds=item, txt="≥ 1% DF")  # -> out, a
# ---------- python_3_script_8: Python ----------
import rhinoscriptsyntax as rs
import Rhino.Geometry as rg
import Rhino.DocObjects as rd
import Rhino


rg.Plane.WorldXY
rW = 10
rR = 0
oTxt = rg.TextEntity.Create(txt, pl, ds, False, rW, rR)
ds.TextHeight = 150
ds.TextHorizontalAlignment =  rd.TextHorizontalAlignment.Center
ds.TextVerticalAlignment = rd.TextVerticalAlignment.Top

a = rg.TextEntity.CreateCurves(oTxt, ds,False,1)
# ---------- end python_3_script_8 ----------
python_3_script_9 = Python3Script(pl=xy, ds=item, txt=concatenate_3)  # -> out, a
# ---------- python_3_script_9: Python ----------
import rhinoscriptsyntax as rs
import Rhino.Geometry as rg
import Rhino.DocObjects as rd
import Rhino


rg.Plane.WorldXY
rW = 10
rR = 0
oTxt = rg.TextEntity.Create(txt, pl, ds, False, rW, rR)
ds.TextHeight = 300
ds.TextHorizontalAlignment =  rd.TextHorizontalAlignment.Center
ds.TextVerticalAlignment = rd.TextVerticalAlignment.Bottom

a = rg.TextEntity.CreateCurves(oTxt, ds,False,1)
# ---------- end python_3_script_9 ----------
merge_5 = Merge(Data1=python_3_script_9.a, Data2=python_3_script_8.a)
convert_material = ConvertMaterial(Shader=ColourSwatch(SwatchColor=RGB(255, 255, 255)), TrackingMode=2)
boundary_surfaces_4 = BoundarySurfaces(Edges=merge_5)
add_directshape_geometry = AddDirectShapeGeometry(Geometry=flatten(boundary_surfaces_4), Material=convert_material, TrackingMode=2)
panel_7 = Panel(add_directshape_geometry)

mesh_12 = Mesh(import_image_2)
mesh_13 = Mesh(import_image)
mesh_explode = MeshExplode(Mesh=mesh_13, Interpolate=invert(False))
mesh_explode_2 = MeshExplode(Mesh=mesh_12, Interpolate=invert(False))

# ----
# Filter room geometry
deconstruct_mesh = DeconstructMesh(Mesh=mesh_explode_2)  # -> Vertices, Faces, Colours, Normals
deconstruct_face = DeconstructFace(Face=deconstruct_mesh.Faces)  # -> CornerA, CornerB, CornerC, CornerD
item_2 = ListItem(List=deconstruct_mesh.Colours, Index=deconstruct_face.CornerA, Wrap=True)
col = Colour(flatten(item_2))
# DRAW RESULT IN REVIT
rgb_values = Panel(col)
python_3_script_10 = Python3Script(data=rgb_values)  # -> out, sums; inputs data: list of String
# ---------- python_3_script_10: Python ----------
import rhinoscriptsyntax as rs

# Input: data (list of strings)
# Output: sums (list of sums)

def split_and_sum(data):
    if data is None:
        return [None]  # If the entire input data is None, return a list with None
    
    sums = []
    for item in data:
        if item is None:
            sums.append(None)
            continue
        
        item = item.strip()
        if item == "":
            sums.append(None)
            continue
        
        numbers = item.split(',')
        
        try:
            numbers = [float(num) for num in numbers]
            sums.append(sum(numbers))
        except ValueError:
            sums.append(None)
    return sums

# Call the function and assign to output
sums = split_and_sum(data)
# ---------- end python_3_script_10 ----------
multiplication_3 = Multiplication(A="255", B="3")
# when this component writes the area value to the room, it ungroups the whole apartment!
# 
# White uses groups for common apartments and copies them across several floors
equality_8 = Equality(FirstNumber=python_3_script_10.sums, SecondNumber=multiplication_3)  # -> Equality, Inequality

dispatch_2 = Dispatch(List=mesh_explode, DispatchPattern=equality_8.Equality)  # -> ListA, ListB

# ----
# mark the elements
#  involved in the analysis
# write results to rooms
element_18 = Element(flatten(list_item_9))
element_19 = Element(flatten(cull_pattern_6))
element_20 = Element(flatten(cull_pattern))
element_21 = Element(flatten(list_item_11))
element_22 = Element(flatten(cull_pattern_20))
stream_gate_7 = StreamGate(Stream=element_18, Gate=data_8)  # -> Target0, Target1
stream_gate_8 = StreamGate(Stream=element_20, Gate=data_8)  # -> Target0, Target1
stream_gate_9 = StreamGate(Stream=element_19, Gate=data_8)  # -> Target0, Target1
stream_gate_10 = StreamGate(Stream=element_21, Gate=data_8)  # -> Target0, Target1
stream_gate_11 = StreamGate(Stream=element_22, Gate=data_8)  # -> Target0, Target1
stream_gate_12 = StreamGate(Stream=element_12, Gate=data_8)  # -> Target0, Target1
element_parameter_9 = ElementParameter(Element=stream_gate_12.Target1, Parameter="UPSKR_PASSING_DF_AREA", Value=round_to_decimal_place.Rounded)
element_parameter_10 = ElementParameter(Element=stream_gate_8.Target1, Parameter="UPSKR_DF", Value="SelectedWindow")  # -> Element, Value
element_parameter_11 = ElementParameter(Element=stream_gate_9.Target1, Parameter="UPSKR_DF", Value="SelectedRoof")  # -> Element, Value
element_parameter_12 = ElementParameter(Element=stream_gate_10.Target1, Parameter="UPSKR_DF", Value="SelectedRoof")  # -> Element, Value
element_parameter_13 = ElementParameter(Element=stream_gate_11.Target1, Parameter="UPSKR_DF", Value="SelectedSite")  # -> Element, Value
element_parameter_14 = ElementParameter(Element=stream_gate_7.Target1, Parameter="UPSKR_DF", Value="SelectedWall")  # -> Element, Value

# ---- group: Transformation Matrix
transform_2 = Transform(invert_matrix.Matrix)

# ----
deconstruct_mesh_2 = DeconstructMesh(Mesh=dispatch_2.ListB)  # -> simplify(Vertices), simplify(Faces), simplify(Colours), Normals
list_item_23 = ListItem(List=deconstruct_mesh_2.Colours, Index=0, Wrap=True)  # -> flatten(Item)
list_item_24 = ListItem(List=transform_2, Index=data_14, Wrap=True)
python_3_script_11 = Python3Script(original_mesh_colors_input=list_item_23, Datatree1=deconstruct_mesh_2.Vertices)  # -> out, ResultTree_A, PaletteColors_B; inputs original_mesh_colors_input: list of Color, Datatree1: tree
# ---------- python_3_script_11: Python ----------
import math
import System # Erforderlich für System.Drawing.Color
from Grasshopper import DataTree
from Grasshopper.Kernel.Data import GH_Path

# # --- 1. PALETTE DEFINITION (Vom Benutzer einzufügen/anzupassen) ---
# # Kommentierte, längere Palette als Referenz
# palette_definition = [
#     {"Color": [0, 0, 255], "Value": 0}, {"Color": [11, 0, 244], "Value": 0.1},
#     {"Color": [21, 0, 234], "Value": 0.2}, {"Color": [32, 0, 223], "Value": 0.3},
#     {"Color": [42, 0, 213], "Value": 0.4}, {"Color": [53, 0, 202], "Value": 0.5},
#     {"Color": [64, 0, 191], "Value": 0.6}, {"Color": [75, 0, 180], "Value": 0.7},
#     {"Color": [85, 0, 170], "Value": 0.8}, {"Color": [96, 0, 159], "Value": 0.9},
#     {"Color": [107, 0, 148], "Value": 1}, {"Color": [118, 0, 137], "Value": 1.1},
#     {"Color": [128, 0, 127], "Value": 1.2}, {"Color": [139, 0, 116], "Value": 1.3},
#     {"Color": [149, 0, 106], "Value": 1.4}, {"Color": [160, 0, 95], "Value": 1.5},
#     {"Color": [171, 0, 84], "Value": 1.6}, {"Color": [182, 0, 73], "Value": 1.7},
#     {"Color": [192, 0, 63], "Value": 1.8}, {"Color": [203, 0, 52], "Value": 1.9},
#     {"Color": [214, 0, 41], "Value": 2}, {"Color": [222, 2, 33], "Value": 2.1},
#     {"Color": [230, 5, 25], "Value": 2.2}, {"Color": [239, 7, 16], "Value": 2.3},
#     {"Color": [247, 10, 8], "Value": 2.4}, {"Color": [255, 12, 0], "Value": 2.5},
#     {"Color": [255, 23, 0], "Value": 2.6}, {"Color": [255, 34, 0], "Value": 2.7},
#     {"Color": [255, 44, 0], "Value": 2.8}, {"Color": [255, 55, 0], "Value": 2.9},
#     {"Color": [255, 66, 0], "Value": 3}, {"Color": [255, 77, 0], "Value": 3.1},
#     {"Color": [255, 87, 0], "Value": 3.2}, {"Color": [255, 98, 0], "Value": 3.3},
#     {"Color": [255, 108, 0], "Value": 3.4}, {"Color": [255, 119, 0], "Value": 3.5},
#     {"Color": [255, 130, 0], "Value": 3.6}, {"Color": [255, 141, 0], "Value": 3.7},
#     {"Color": [255, 151, 0], "Value": 3.8}, {"Color": [255, 162, 0], "Value": 3.9},
#     {"Color": [255, 173, 0], "Value": 4}, {"Color": [255, 184, 0], "Value": 4.1},
#     {"Color": [255, 194, 0], "Value": 4.2}, {"Color": [255, 205, 0], "Value": 4.3},
#     {"Color": [255, 215, 0], "Value": 4.4}, {"Color": [255, 226, 0], "Value": 4.5},
#     {"Color": [255, 232, 0], "Value": 4.6}, {"Color": [255, 238, 0], "Value": 4.7},
#     {"Color": [255, 243, 0], "Value": 4.8}, {"Color": [255, 249, 0], "Value": 4.9},
#     {"Color": [255, 255, 0], "Value": 5}, {"Color": [255, 255, 5], "Value": 5.1},
#     {"Color": [255, 255, 10], "Value": 5.2}, {"Color": [255, 255, 15], "Value": 5.3},
#     {"Color": [255, 255, 20], "Value": 5.4}, {"Color": [255, 255, 25], "Value": 5.5},
#     {"Color": [255, 255, 30], "Value": 5.6}, {"Color": [255, 255, 35], "Value": 5.7},
#     {"Color": [255, 255, 40], "Value": 5.8}, {"Color": [255, 255, 45], "Value": 5.9},
#     {"Color": [255, 255, 50], "Value": 6}, {"Color": [255, 255, 55], "Value": 6.1},
#     {"Color": [255, 255, 60], "Value": 6.2}, {"Color": [255, 255, 65], "Value": 6.3},
#     {"Color": [255, 255, 70], "Value": 6.4}, {"Color": [255, 255, 75], "Value": 6.5},
#     {"Color": [255, 255, 80], "Value": 6.6}, {"Color": [255, 255, 85], "Value": 6.7},
#     {"Color": [255, 255, 90], "Value": 6.8}, {"Color": [255, 255, 95], "Value": 6.9},
#     {"Color": [255, 255, 100], "Value": 7}, {"Color": [255, 255, 105], "Value": 7.1},
#     {"Color": [255, 255, 110], "Value": 7.2}, {"Color": [255, 255, 115], "Value": 7.3},
#     {"Color": [255, 255, 120], "Value": 7.4}, {"Color": [255, 255, 125], "Value": 7.5},
#     {"Color": [255, 255, 130], "Value": 7.6}, {"Color": [255, 255, 135], "Value": 7.7},
#     {"Color": [255, 255, 140], "Value": 7.8}, {"Color": [255, 255, 145], "Value": 7.9},
#     {"Color": [255, 255, 150], "Value": 8}, {"Color": [255, 255, 155], "Value": 8.1},
#     {"Color": [255, 255, 160], "Value": 8.2}, {"Color": [255, 255, 165], "Value": 8.3},
#     {"Color": [255, 255, 170], "Value": 8.4}, {"Color": [255, 255, 175], "Value": 8.5},
#     {"Color": [255, 255, 180], "Value": 8.6}, {"Color": [255, 255, 185], "Value": 8.7},
#     {"Color": [255, 255, 190], "Value": 8.8}, {"Color": [255, 255, 195], "Value": 8.9},
#     {"Color": [255, 255, 200], "Value": 9}, {"Color": [255, 255, 205], "Value": 9.1},
#     {"Color": [255, 255, 210], "Value": 9.2}, {"Color": [255, 255, 215], "Value": 9.3},
#     {"Color": [255, 255, 220], "Value": 9.4}, {"Color": [255, 255, 225], "Value": 9.5},
#     {"Color": [255, 255, 230], "Value": 9.6}, {"Color": [255, 255, 235], "Value": 9.7},
#     {"Color": [255, 255, 240], "Value": 9.8}, {"Color": [255, 255, 245], "Value": 9.9},
#     {"Color": [255, 255, 250], "Value": 10}
# ]

palette_definition = [
    {"Color": [0, 0, 255], "Value": 0}, {"Color": [53, 0, 202], "Value": 0.5},
    {"Color": [107, 0, 148], "Value": 1}, {"Color": [160, 0, 95], "Value": 1.5},
    {"Color": [214, 0, 41], "Value": 2}, {"Color": [255, 12, 0], "Value": 2.5},
    {"Color": [255, 66, 0], "Value": 3}, {"Color": [255, 119, 0], "Value": 3.5},
    {"Color": [255, 173, 0], "Value": 4}, {"Color": [255, 226, 0], "Value": 4.5},
    {"Color": [255, 255, 0], "Value": 5}, {"Color": [255, 255, 25], "Value": 5.5},
    {"Color": [255, 255, 50], "Value": 6}, {"Color": [255, 255, 75], "Value": 6.5},
    {"Color": [255, 255, 100], "Value": 7}, {"Color": [255, 255, 125], "Value": 7.5},
    {"Color": [255, 255, 150], "Value": 8}, {"Color": [255, 255, 175], "Value": 8.5},
    {"Color": [255, 255, 200], "Value": 9}, {"Color": [255, 255, 225], "Value": 9.5},
    {"Color": [255, 255, 250], "Value": 10}
]


# --- Hilfsfunktionen und Daten aus Palette extrahieren ---
palette_rgb_colors = [item["Color"] for item in palette_definition]
palette_system_colors = []
for item in palette_definition:
    try:
        r, g, b = item["Color"]
        palette_system_colors.append(System.Drawing.Color.FromArgb(int(r), int(g), int(b)))
    except Exception as e:
        # Fallback, falls eine Farbe in der Definition ungültig ist
        print("Warnung: Ungültige Farbe in Palette Definition: {}. Fehler: {}".format(item["Color"], e))
        palette_system_colors.append(System.Drawing.Color.Magenta) # Fehlerindikatorfarbe

def calculate_squared_distance(color1_rgb, color2_rgb): # OPTIMIERUNG 1: Name geändert
    """Berechnet den *quadrierten* euklidischen Abstand zwischen zwei RGB-Farben.""" # OPTIMIERUNG 1: Docstring angepasst
    dr = float(color1_rgb[0]) - float(color2_rgb[0])
    dg = float(color1_rgb[1]) - float(color2_rgb[1])
    db = float(color1_rgb[2]) - float(color2_rgb[2])
    return dr*dr + dg*dg + db*db # OPTIMIERUNG 1: math.sqrt entfernt

# --- Initialisierung der Ausgabe-DataTrees ---
# Diese werden den Ausgängen der Komponente zugewiesen (z.B. ResultTree_A, PaletteColors_B)
script_output_A = DataTree[object]()
script_output_B = DataTree[object]() # Wird System.Drawing.Color Objekte enthalten

# --- Prüfe Haupteingänge ---
if "Datatree1" not in globals() or Datatree1 is None: # Sicherere Prüfung, ob Datatree1 definiert ist
    print("Datatree1 fehlt oder ist nicht definiert. Die Ausgänge bleiben leer.")
    # Stelle sicher, dass die Ausgänge trotzdem zugewiesen werden
    ResultTree_A = script_output_A
    PaletteColors_B = script_output_B
    # In GHPython ist es üblich, die Variablen, die den Ausgängen entsprechen, am Ende zuzuweisen.
    # Wir fahren hier fort und die leeren Bäume werden am Ende zugewiesen.
    # Um Fehler zu vermeiden, wenn original_mesh_colors_input auch fehlt:
    if "original_mesh_colors_input" not in globals():
        original_mesh_colors_input = [] # Leere Liste, um Fehler im nächsten Block zu vermeiden
        
# --- 2. VERARBEITE DIE ORIGINAL-MESH-FARBEN (Logik aus Skript 1) ---
# Dieses Dictionary speichert {paletten_index: [original_mesh_farbindex1, ...]}
mapped_indices_by_palette_idx = {}

# Sicherstellen, dass original_mesh_colors_input existiert, bevor es verwendet wird
if "original_mesh_colors_input" in globals() and original_mesh_colors_input:
    for original_idx, gh_color in enumerate(original_mesh_colors_input):
        if gh_color is None:
            # print("Warnung: Ungültige Farbe (None) am originalen Index {}. Überspringe.".format(original_idx))
            continue
        
        try:
            original_color_rgb = [gh_color.R, gh_color.G, gh_color.B]
        except AttributeError:
            # print("Warnung: Objekt am Index {} ist keine Farbe. Typ: {}".format(original_idx, type(gh_color)))
            continue

        min_sq_dist = float('inf') # OPTIMIERUNG 1: Variable für quadrierte Distanz
        closest_palette_idx = -1

        for palette_idx, pal_rgb_color in enumerate(palette_rgb_colors):
            sq_dist = calculate_squared_distance(original_color_rgb, pal_rgb_color) # OPTIMIERUNG 1: Aufruf der neuen Funktion
            if sq_dist < min_sq_dist: # OPTIMIERUNG 1: Vergleich mit quadrierter Distanz
                min_sq_dist = sq_dist
                closest_palette_idx = palette_idx
        
        if closest_palette_idx != -1:
            if closest_palette_idx not in mapped_indices_by_palette_idx:
                mapped_indices_by_palette_idx[closest_palette_idx] = []
            mapped_indices_by_palette_idx[closest_palette_idx].append(original_idx)
        # else:
            # print("Warnung: Für Farbe am Index {} konnte keine nächste Palettenfarbe gefunden werden.".format(original_idx))


# --- 3. KOMBINIERE DATEN UND ERSTELLE AUSGABE-BÄUME (Logik aus Skript 2, angepasst) ---
num_palette_entries = len(palette_system_colors)

for current_palette_idx in range(num_palette_entries):
    # OPTIMIERUNG 2: Palettenfarbe einmal pro Hauptschleifeniteration abrufen
    current_palette_color_obj = palette_system_colors[current_palette_idx]
    
    # Hole die Liste der original_mesh_color_indices, die dieser Palettenfarbe zugeordnet wurden.
    # Diese Indizes verweisen auf Branches in Datatree1.
    indices_referencing_dt1 = mapped_indices_by_palette_idx.get(current_palette_idx, [])

    if not indices_referencing_dt1:
        # Fall: Keine original_mesh_colors wurden dieser Palettenfarbe zugeordnet.
        # Erzeuge einen leeren Branch in beiden Ausgabe-Bäumen unter dem Pfad {current_palette_idx; 0}.
        branch_path_list = [current_palette_idx, 0]
        gh_branch_path = GH_Path(branch_path_list)
        
        script_output_A.EnsurePath(gh_branch_path)
        script_output_B.EnsurePath(gh_branch_path)
    else:
        # Fall: Dieser Palettenfarbe wurden eine oder mehrere original_mesh_colors zugeordnet.
        # Iteriere durch jede dieser Zuordnungen (jeder zugeordnete Index wird ein Sub-Branch).
        for j_sub_branch_idx, dt1_branch_idx_to_fetch in enumerate(indices_referencing_dt1):
            
            branch_path_list = [current_palette_idx, j_sub_branch_idx]
            gh_branch_path = GH_Path(branch_path_list)
            
            # Pfad, um Daten aus Datatree1 abzurufen (Annahme: dt1_branch_idx_to_fetch ist ein einfacher Integer-Index)
            path_in_dt1 = GH_Path(dt1_branch_idx_to_fetch)

            # Überprüfen, ob Datatree1 existiert, bevor darauf zugegriffen wird
            if "Datatree1" in globals() and Datatree1 is not None and Datatree1.PathExists(path_in_dt1):
                items_from_dt1 = Datatree1.Branch(path_in_dt1)
                
                # Verwende .Count für IList<T> von GH, falls es kein Python list ist
                branch_has_items = False
                if items_from_dt1:
                    try: # Python Liste
                        if len(items_from_dt1) > 0:
                            branch_has_items = True
                    except TypeError: # Wahrscheinlich IList<T>
                        if items_from_dt1.Count > 0:
                            branch_has_items = True
                
                if branch_has_items: # Branch in D1 existiert und hat Inhalt
                    script_output_A.AddRange(items_from_dt1, gh_branch_path)
                    # Da script_output_A Items hat, füge die entsprechende Palettenfarbe zu script_output_B hinzu
                    # OPTIMIERUNG 2: Wiederverwendung des zuvor abgerufenen Farbobjekts
                    script_output_B.Add(current_palette_color_obj, gh_branch_path)
                else: # Branch in D1 existiert, ist aber leer
                    script_output_A.EnsurePath(gh_branch_path) # script_output_A Branch bleibt leer
                    script_output_B.EnsurePath(gh_branch_path) # script_output_B Branch bleibt auch leer
            else:
                # Branch in Datatree1 nicht gefunden oder Datatree1 ist None.
                # Füge eine Info/Fehlermeldung zu script_output_A und lasse script_output_B leer für diesen Pfad.
                info_message = "Info: D1 Branch {{{}}} nicht gefunden oder D1 ist None.".format(dt1_branch_idx_to_fetch)
                script_output_A.Add(info_message, gh_branch_path)
                script_output_B.EnsurePath(gh_branch_path)


# --- 4. DEN AUSGÄNGEN DER GHPYTHON-KOMPONENTE ZUWEISEN ---
# Stelle sicher, dass die Ausgänge in der Komponente so heißen, wie hier zugewiesen.
# Standardmäßig wären das 'a', 'b', etc.
ResultTree_A = script_output_A
PaletteColors_B = script_output_B
# ---------- end python_3_script_11 ----------

construct_mesh = ConstructMesh(Vertices=python_3_script_11.ResultTree_A, Faces="Q{0;1;2;3}")
trim_tree_6 = TrimTree(Tree=python_3_script_11.PaletteColors_B, Depth=1)
trim_tree_7 = TrimTree(Tree=construct_mesh, Depth=1)
list_item_25 = ListItem(List=trim_tree_6, Index=0, Wrap=True)
mesh_join_2 = MeshJoin(Meshes=trim_tree_7)
transform_3 = Transform(Geometry=mesh_join_2, Transform=list_item_24)
convert_material_2 = ConvertMaterial(Shader=list_item_25, TrackingMode=2)
add_directshape_geometry_2 = AddDirectShapeGeometry(Geometry=transform_3, Material=convert_material_2, TrackingMode=2)

# ==== cluster Cluster
brep = ClusterInput()
deconstruct_brep = DeconstructBrep(Brep=brep)  # -> Faces, Edges, Vertices
evaluate_surface = EvaluateSurface(Surface=deconstruct_brep.Faces, Point="0.5,0.5")  # -> Point, Normal, UDirection, VDirection, Frame
unit_z = UnitZ(Factor=1)
dot_product = DotProduct(VectorA=unit_z, VectorB=evaluate_surface.Normal, Unitize=False)
equality = Equality(FirstNumber=dot_product, SecondNumber="0")  # -> Equality, Inequality
equality_2 = Equality(FirstNumber=dot_product, SecondNumber="-1")  # -> Equality, Inequality
equality_3 = Equality(FirstNumber=dot_product, SecondNumber="1")  # -> Equality, Inequality

# ---- group: Wall
cull_pattern = CullPattern(List=deconstruct_brep.Faces, CullPattern=equality.Equality)

# ---- group: Bottom
cull_pattern_2 = CullPattern(List=deconstruct_brep.Faces, CullPattern=equality_2.Equality)

# ---- group: Top
cull_pattern_3 = CullPattern(List=deconstruct_brep.Faces, CullPattern=equality_3.Equality)

# ----
list = ClusterOutput(cull_pattern)
list_2 = ClusterOutput(cull_pattern_2)
list_3 = ClusterOutput(cull_pattern_3)

# ==== cluster Cluster_2
maxceilingoverfloorheight = ClusterInput()
floor = ClusterInput()
heightflooroverterrain = ClusterInput()
heightceilingoverfloor = ClusterInput()
heightroofoverfloor = ClusterInput()
floor_2 = Brep(floor)
maxceilingoverfloorheight_2 = Data(maxceilingoverfloorheight)
vector = ClusterInput()
point = ClusterInput()
orient = Orient(G_2=floor_2, O=point, x=vector, G=floor_2)  # -> G_3, transformation_matrix
panel = Panel(maxceilingoverfloorheight_2)
dom = ConstructDomain(DomainStart="0", DomainEnd="30000")
dom_2 = ConstructDomain(DomainStart="0", DomainEnd="1")
dom_3 = ConstructDomain(DomainStart="0", DomainEnd="10000")
dom_4 = ConstructDomain(DomainStart="0", DomainEnd="1")
dom_5 = ConstructDomain(DomainStart="0", DomainEnd=panel)
dom_6 = ConstructDomain(DomainStart="0", DomainEnd="1")
remap = RemapNumbers(HeightRoofOverFloor=heightroofoverfloor, Source=dom, Target=dom_2)  # -> Mapped, Clipped
transformation_matrix = ClusterOutput(orient.transformation_matrix)
remap_2 = RemapNumbers(HeightFloorOverTerrain=heightflooroverterrain, Source=dom_3, Target=dom_4)  # -> Mapped, Clipped
remap_3 = RemapNumbers(HeightCeilingOverFloor=heightceilingoverfloor, Source=dom_5, Target=dom_6)  # -> Mapped, Clipped
bbox = BoundingBox(Content=orient.G_3, Plane=PlaneXY(0, 0, 0))  # -> Box, Box_2
debox = DeconstructBox(Box=bbox.Box)  # -> Plane, X, Y, Z
explode = Explode(Curve=orient.G_3, Recursive=True)  # -> Segments, Vertices
orientedroomfloor = ClusterOutput(orient.G_3)
hsv = ColourHSV(Alpha=1, Hue=remap.Clipped, Saturation=remap_2.Clipped, Value=remap_3.Clipped)
curvepoint = PointOnCurve(explode.Segments, parameter=0.5)
dedomain = DeconstructDomain(Domain=debox.Y)  # -> Start, End
dedomain_2 = DeconstructDomain(Domain=debox.X)  # -> Start, End
pt = ConstructPoint(XCoordinate=dedomain_2.End, YCoordinate=dedomain.End, ZCoordinate=0)
pt_2 = ConstructPoint(XCoordinate=dedomain_2.Start, YCoordinate=dedomain.Start, ZCoordinate=0)
rec_2pt = Rectangle2Pt(Plane=PlaneXY(0, 0, 0), PointA=pt_2, PointB=pt, Radius=0)  # -> Rectangle, Length
area = Area(Geometry=rec_2pt.Rectangle)  # -> Area, Centroid
area_2 = Area(Geometry=orient.G_3)  # -> Area, Centroid
C = ClusterOutput(hsv)
translation_vector = ClusterInput()
subtraction = Subtraction(A=dedomain_2.End, B=dedomain_2.Start)
subtraction_2 = Subtraction(A=dedomain.End, B=dedomain.Start)
project = Project(Geometry=orient.G_3, Plane=PlaneXY(0, 0, 0))  # -> Geometry, Transform
pdecon = Deconstruct(Point=curvepoint)  # -> XComponent, YComponent, ZComponent
subtraction_3 = Subtraction(A=area.Area, B=area_2.Area)
sort = SortList(Keys=pdecon.YComponent, ValuesA=explode.Segments)  # -> Keys, ValuesA
expression = Expression(x=subtraction_2, Expression="Round(x,2)")
move = Move(Geometry=project.Geometry, Motion=translation_vector)  # -> Geometry, Transform

# ----
# Scale down GDI Shape for Mask
# to cut away borders of prediction
number_slider = Slider(0.95, range=0..1)
area_3 = Area(Geometry=move.Geometry)  # -> Area, Centroid
scale = Scale(Geometry=move.Geometry, Center=area_3.Centroid, Factor=number_slider)  # -> Geometry, Transform
fill = CreateGdiFill(Colour=hsv)
roomascrv = Curve(scale.Geometry)
shape = CreateGdiShape(Geometry=roomascrv, Fill=fill)

expression_2 = Expression(x=subtraction, Expression="Round(x,2)")
division = Division(A=subtraction_3, B=area.Area)
item = ListItem(List=sort.ValuesA, Index=0, Wrap=True)
multiplication = Multiplication(A=division, B=100)
len = Length(Curve=item)
expression_3 = Expression(x=area_2.Area, Expression="Round(x,2)")
expression_4 = Expression(x=multiplication, Expression="Round(x,2)")
roomydimension = ClusterOutput(expression)
roomxdimension = ClusterOutput(expression_2)
expression_5 = Expression(x=len, Expression="Round(x,2)")
mesh = Mesh(move.Geometry)
fill_2 = CreateGdiFill(Colour=hsv)
roomascrv_2 = Curve(move.Geometry)
shape_2 = CreateGdiShape(Geometry=roomascrv_2, Fill=fill_2)
ofroomrectaglecut = ClusterOutput(expression_4)
S = ClusterOutput(shape_2)
mesh_2 = ClusterOutput(mesh)
ofroomarea = ClusterOutput(expression_3)
windowwalllength = ClusterOutput(expression_5)
scaled_gdi_shape = ClusterOutput(shape)
brep_edges = BrepEdges(Brep=move.Geometry)  # -> Naked, Interior, NonManifold
roomedges = ClusterOutput(brep_edges.Naked)

# ==== cluster Cluster_3
brep = ClusterInput()
deconstruct_brep = DeconstructBrep(Brep=brep)  # -> Faces, Edges, Vertices
evaluate_surface = EvaluateSurface(Surface=deconstruct_brep.Faces, Point="0.5,0.5")  # -> Point, Normal, UDirection, VDirection, Frame
unit_z = UnitZ(Factor=1)
dot_product = DotProduct(VectorA=unit_z, VectorB=evaluate_surface.Normal, Unitize=False)
equality_within_tolerance = EqualityWithinTolerance(FirstNumber=dot_product, SecondNumber="0", Tolerance=0.1595272236)  # -> Equality, Inequality
equality_within_tolerance_2 = EqualityWithinTolerance(FirstNumber=dot_product, SecondNumber="-1", Tolerance=0.1595272236)  # -> Equality, Inequality
equality_within_tolerance_3 = EqualityWithinTolerance(FirstNumber=dot_product, SecondNumber="1", Tolerance=0.1595272236)  # -> Equality, Inequality

# ---- group: Wall
cull_pattern = CullPattern(List=deconstruct_brep.Faces, CullPattern=equality_within_tolerance.Equality)

# ----
cull_pattern_2 = CullPattern(List=deconstruct_brep.Faces, CullPattern=equality_within_tolerance_2.Equality)
vertical = ClusterOutput(cull_pattern)  # Vertical
bottom = ClusterOutput(cull_pattern_2)  # Bottom
cull_pattern_3 = CullPattern(List=deconstruct_brep.Faces, CullPattern=equality_within_tolerance_3.Equality)
top = ClusterOutput(cull_pattern_3)  # Top

# ==== cluster Cluster_4
roombrep = ClusterInput()  # RoomBREP
panel = Panel("""2
3""")
list = ClusterInput()
list_2 = ClusterInput()
brep = Brep(roombrep)
list_item = ListItem(List=list_2, Index=panel, Wrap=True)
list_item_2 = ListItem(List=list, Index=panel, Wrap=True)
brep_closest_point = BrepClosestPoint(Point=list_item_2, Brep=brep)  # -> Point, Normal, Distance
sort_list = SortList(Keys=brep_closest_point.Distance, ValuesCentroids=list_item_2, ValuesFaces=list_item)  # -> Keys, ValuesCentroids, ValuesFaces
number_slider = Slider(0.5, range=0..10)
construct_point = ConstructPoint(XCoordinate=number_slider, YCoordinate=number_slider, ZCoordinate=0)
list_item_3 = ListItem(List=sort_list.ValuesCentroids, Index="1", Wrap=True)
list_item_4 = ListItem(List=sort_list.ValuesFaces, Index="1", Wrap=True)
evaluate_surface = EvaluateSurface(Surface=reparameterize(list_item_4), Point=construct_point)  # -> Point, Normal, UDirection, VDirection, Frame
window_outside_face = ClusterOutput(list_item_3)
normal = ClusterOutput(evaluate_surface.Normal)

# ==== cluster Cluster_5
G = ClusterInput()
point = ClusterInput()
vector = ClusterInput()
input = ClusterInput()
orient = Orient_2(G_2=G, O=point, x=vector, G=input)  # -> G_3, orientation
orientation = ClusterOutput(orient.orientation)
frameratio = ClusterInput()
heightsilloverfloor = ClusterInput()
windowheight = ClusterInput()
panel = Panel("0.2")
panel_2 = Panel("5")
translation_vector = ClusterInput()
frameratio_2 = Data(frameratio)
windowheight_2 = Data(windowheight)
heightsilloverfloor_2 = Data(heightsilloverfloor)
dom = ConstructDomain(DomainStart="5000", DomainEnd="0")
dom_2 = ConstructDomain(DomainStart="5000", DomainEnd="200")
dom_3 = ConstructDomain(DomainStart="0", DomainEnd="1")
dom_4 = ConstructDomain(DomainStart="1", DomainEnd="0")
vector_2 = Vector(translation_vector)
remap = RemapNumbers(Value=heightsilloverfloor_2, Source=dom, Target=Domain(0, 1))  # -> Mapped, Clipped
remap_2 = RemapNumbers(Value=windowheight_2, Source=dom_2, Target=Domain(0, 1))  # -> Mapped, Clipped
remap_3 = RemapNumbers(Value=frameratio_2, Source=dom_3, Target=dom_4)  # -> Mapped, Clipped
windowsill = Brep(orient.G_3)
hsv = ColourHSV(Alpha=1, Hue=remap.Mapped, Saturation=remap_3.Mapped, Value=remap_2.Mapped)
windowsillcrv = Curve(windowsill)
move = Move(Geometry=windowsill, Motion=vector_2)  # -> Geometry, Transform
move_2 = Move(Geometry=windowsillcrv, Motion=vector_2)  # -> Geometry, Transform
C = ClusterOutput(hsv)
color_window = Colour(hsv)
windowsillmesh = Mesh(move.Geometry)
fill = CreateGdiFill(Colour=color_window)
shape = CreateGdiShape(Geometry=move_2.Geometry, Fill=fill)  # -> flatten(EncodedWindow)
encodedwindow = ClusterOutput(shape)
windowsillmesh_2 = ClusterOutput(windowsillmesh)

# ==== cluster Cluster_6
floorandroofs = ClusterInput()  # FloorAndRoofs
meshes = ClusterInput()
G = ClusterInput()
floor = ClusterInput()
window_vector = ClusterInput()
window_point = ClusterInput()
mesh_join = MeshJoin(Meshes=flatten(floorandroofs))
mesh_join_2 = MeshJoin(Meshes=flatten(meshes))
floor_2 = Brep(floor)
window_point_2 = Point(window_point)
window_vector_2 = Vector(window_vector)
orient = Orient_3(G_2=mesh_join, O=window_point_2, x=window_vector_2, G=floor_2)
orient_2 = Orient_3(G_2=mesh_join_2, O=window_point_2, x=window_vector_2, G=floor_2)
orient_3 = Orient_3(G_2=window_point_2, O=window_point_2, x=window_vector_2, G=floor_2)
mesh = Mesh(simplify(orient))
pt = Point([Point(-12.7, -4.282661231, -1), Point(-12.5, -4.282661231, -1), Point(-12.3, -4.282661231, -1), Point(-12.1, -4.282661231, -1), Point(-11.9, -4.282661231, -1), Point(-11.7, -4.282661231, -1)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])

# ---- group: Reducing the Rays
cull_nth = CullNth(List=pt, CullFrequency=2)

# ----
pln = Plane(orient_3)
pt_2 = Point(Point(0, 0, -1))
project = Project(Geometry=cull_nth, Plane=pln)  # -> Geometry, Transform
project_2 = Project(Geometry=pt_2, Plane=pln)  # -> Geometry, Transform
ln = Line(StartPoint=project.Geometry, EndPoint=project_2.Geometry)
Z = UnitZ(Factor=1)
list_length = ListLength(List=cull_nth)
series = Series(Start=0, Step="1", Count="90")
pl = ConstructPlane(Origin=project_2.Geometry, XAxis=ln, YAxis=Z)
neg = Negative(Value=series)
rotate = Rotate(Geometry=ln, Angle=graft(degrees(neg)), Plane=pl)  # -> Geometry, Transform
vec = Vector(unitize(simplify(rotate.Geometry)))
multiplication = Multiplication(A=vec, B=1000)
move = Move(Geometry=project_2.Geometry, Motion=expr("-X", multiplication))  # -> Geometry, Transform

scale = Scale(Geometry=move.Geometry, Center=project_2.Geometry, Factor="1000")  # -> Geometry, Transform

ln_2 = Line(StartPoint=project_2.Geometry, EndPoint=scale.Geometry)  # -> simplify(Line)
flip = FlipMatrix(Data=ln_2)  # -> graft(Data)
mesh_2 = Mesh(simplify(orient_2))
line = Line(flip)
intersection_points_as_output = BooleanToggle(False)

# ---- group: Testing Binary Search and Parallelisation (in IronPy)
# With Binary Search, all angles are counted up to the last piercing point.
# 
# Example: Last piercing point at beam 85 means 5 is written as the value, even if beams 88 and 89 do not hit a mesh. (Difference to training!)
ironpython_2_script = IronPython2Script(Meshes=mesh, Lines=line, CollectPoints=intersection_points_as_output)  # -> out, flatten(angleDurations), flatten(intersectionPoints); inputs Meshes: tree of Mesh, Lines: tree of Line, CollectPoints: Boolean
# ---------- ironpython_2_script: IronPython ----------
# coding=utf-8

import Rhino.Geometry as rg
from Grasshopper import DataTree
from Grasshopper.Kernel.Data import GH_Path
import System
import System.Threading.Tasks as tasks
import System.Collections.Generic as generic
import threading

# --- Configuration ---
MIN_ANGLE_IDX = 0
MAX_ANGLE_IDX = 89

# --- Global Variables for Parallel Access ---
lines_dict = {}
results_dict = {}
results_lock = threading.Lock()
# --- NEU: Globale Variable für den Input ---
collect_points_flag = False 
# ----------------------------------------

# --- Helper Function to Get Geometry ---
def get_geometry(obj, target_type):
    """Handles GH Goo and returns the base geometry or None."""
    if isinstance(obj, target_type):
        return obj
    if hasattr(obj, 'Value') and isinstance(obj.Value, target_type):
        return obj.Value
    return None

# --- Function to Process a Single Mesh-Plane Pair (for Parallel.ForEach) ---
def process_pair(pair):
    """Performs binary search and optionally intersection collection."""
    mesh_id, mesh_geom, plane_idx = pair

    # --- 4. Binary Search ---
    low = MIN_ANGLE_IDX
    high = MAX_ANGLE_IDX
    first_intersecting_angle_idx = MAX_ANGLE_IDX + 1

    while low <= high:
        mid_angle_idx = low + (high - low) // 2
        current_line = lines_dict.get((plane_idx, mid_angle_idx))
        intersection_found = False

        if current_line:
            try:
                intersection_data = rg.Intersect.Intersection.MeshLine(mesh_geom, current_line)
                if intersection_data is not None and len(intersection_data) > 0:
                    intersection_found = True
            except Exception as e:
                pass # Error handling

        if intersection_found:
            first_intersecting_angle_idx = mid_angle_idx
            high = mid_angle_idx - 1
        else:
            low = mid_angle_idx + 1

    # --- 5. Calculate Duration & Optionally Collect Points ---
    calculated_duration = 0
    all_points_for_plane = generic.List[rg.Point3d]()

    if first_intersecting_angle_idx <= MAX_ANGLE_IDX:
        calculated_duration = (MAX_ANGLE_IDX + 1) - first_intersecting_angle_idx

        # --- NUR Punkte sammeln, wenn Flag gesetzt ist ---
        if collect_points_flag:
            for angle_idx_to_collect in range(first_intersecting_angle_idx, MAX_ANGLE_IDX + 1):
                line_to_collect = lines_dict.get((plane_idx, angle_idx_to_collect))
                if line_to_collect:
                    try:
                        points = rg.Intersect.Intersection.MeshLine(mesh_geom, line_to_collect)
                        if points is not None and len(points) > 0:
                            all_points_for_plane.AddRange(points)
                    except Exception as e:
                       pass # Error handling
        # ----------------------------------------------

    # --- Store results thread-safely using Lock ---
    key = (mesh_id, plane_idx)
    value = (calculated_duration, all_points_for_plane)
    
    with results_lock:
        results_dict[key] = value

# --- Main Script Execution ---

# Initialize outputs and print list
angleDurationsTree = DataTree[int]()
intersectionPointsTree = DataTree[rg.Point3d]()
print_output = []

# --- NEU: Lese den booleschen Input ---
# Prüfen, ob der Input 'CollectPoints' existiert und ein Bool ist
if "CollectPoints" in globals() and isinstance(CollectPoints, bool):
    collect_points_flag = CollectPoints
    print_output.append("Info: Collecting points set to {}.".format(collect_points_flag))
else:
    # Setze auf False, wenn nicht verbunden oder kein Bool
    collect_points_flag = False 
    print_output.append("Warning: 'CollectPoints' input missing/invalid. Defaulting to False.")
# ------------------------------------

# 1. Collect unique Plane_Indices & Pre-process Lines
unique_plane_indices = set()
if Lines is not None and Lines.BranchCount > 0:
    for i in range(Lines.BranchCount):
        path = Lines.Path(i)
        if path.Length >= 2:
            plane_idx = path.Indices[0]
            angle_idx = path.Indices[1]
            unique_plane_indices.add(plane_idx)
            branch_content = Lines.Branch(path)
            if branch_content and len(branch_content) > 0:
                line_geom = get_geometry(branch_content[0], rg.Line)
                if line_geom:
                    lines_dict[(plane_idx, angle_idx)] = line_geom

sorted_plane_indices = sorted(list(unique_plane_indices))

# Pre-process Meshes into a List
valid_meshes_list = []
if Meshes is not None and Meshes.BranchCount > 0:
    for i in range(Meshes.BranchCount):
        mesh_path = Meshes.Path(i)
        mesh_id = mesh_path.Indices[0] if mesh_path.Length > 0 else i
        branch_content = Meshes.Branch(i)
        if not branch_content or len(branch_content) == 0:
            print_output.append("Info: Empty branch for mesh ID {}. Skipping.".format(mesh_id))
            continue
        mesh_geom = get_geometry(branch_content[0], rg.Mesh)
        if mesh_geom:
            valid_meshes_list.append((mesh_id, mesh_geom))
        else:
            print_output.append("Warning: Item for mesh ID {} not usable. Skipping.".format(mesh_id))

# Proceed only if inputs are valid
if valid_meshes_list and lines_dict and sorted_plane_indices:

    processing_pairs = []
    for mesh_id, mesh_geom in valid_meshes_list:
        for plane_idx in sorted_plane_indices:
            processing_pairs.append((mesh_id, mesh_geom, plane_idx))

    # --- Parallel Processing ---
    tasks.Parallel.ForEach(processing_pairs, process_pair)

    # --- 6. Populate Output DataTrees ---
    for key, value in results_dict.items():
        mesh_id = key[0]
        plane_idx = key[1]
        duration = value[0]
        points_list = value[1]

        result_path = GH_Path(System.Array[System.Int32]([mesh_id, plane_idx]))
        angleDurationsTree.Add(duration, result_path)

        # Nur Punkte hinzufügen, wenn welche gesammelt wurden (und vorhanden sind)
        if points_list.Count > 0:
            intersectionPointsTree.AddRange(points_list, result_path)

else:
    # Print info if major inputs are missing
    if not valid_meshes_list:
        print_output.append("Info: 'Meshes' input is empty or invalid.")
    if not lines_dict:
        print_output.append("Info: 'Lines' input is empty or invalid.")
    if not sorted_plane_indices:
        print_output.append("Info: Could not find valid Plane_Indices.")

# --- Final Output ---
angleDurations = angleDurationsTree
intersectionPoints = intersectionPointsTree

# Print collected messages
for msg in print_output:
    print(msg)
# ---------- end ironpython_2_script ----------

# ---- group: Testing Binary Search
python_3_script = Python3Script(Meshes=mesh, Lines=line)  # -> out, flatten(a); inputs Meshes: tree of Mesh, Lines: tree of Line; disabled
# ---------- python_3_script: Python ----------
import Rhino.Geometry as rg
from Grasshopper import DataTree
from Grasshopper.Kernel.Data import GH_Path
import Grasshopper.Kernel # Not strictly needed if GH_Conversion is not used, but good for completeness
import System


# --- Configuration ---
MIN_ANGLE_IDX = 0
MAX_ANGLE_IDX = 89

# Initialize the output DataTree
angleDurationsTree = DataTree[int]()

# 1. Collect unique Plane_Indices from the Lines input tree.
unique_plane_indices = set()
if Lines is not None and Lines.BranchCount > 0:
    for i in range(Lines.BranchCount):
        path = Lines.Path(i) 
        if path.Length >= 1: # Plane_Index is the first element in the path
            unique_plane_indices.add(path.Indices[0])
sorted_plane_indices = sorted(list(unique_plane_indices))

# Proceed with main logic only if essential inputs are valid and present.
if Meshes is not None and Meshes.BranchCount > 0 and \
   Lines is not None and Lines.BranchCount > 0 and \
   len(sorted_plane_indices) > 0:

    # 2. Iterate through each mesh in the input Meshes tree.
    for mesh_branch_idx in range(Meshes.BranchCount):
        mesh_gh_path = Meshes.Path(mesh_branch_idx)
        
        mesh_id_for_output = -1
        if mesh_gh_path.Length > 0:
            mesh_id_for_output = mesh_gh_path.Indices[0]
        else: 
            mesh_id_for_output = mesh_branch_idx 
            print("Info: Mesh path was empty. Using branch index {} as mesh ID.".format(mesh_branch_idx))

        if not Meshes.Branch(mesh_branch_idx) or len(Meshes.Branch(mesh_branch_idx)) == 0:
            print("Info: Empty branch found for mesh ID {}. Skipping this item.".format(mesh_id_for_output))
            continue
            
        # Retrieve the mesh object. Based on guarantee, it's rg.Mesh or GH_Mesh.
        current_mesh_object_from_tree = Meshes.Branch(mesh_branch_idx)[0]
        valid_mesh_geometry = None 

        if isinstance(current_mesh_object_from_tree, rg.Mesh):
            valid_mesh_geometry = current_mesh_object_from_tree
        elif hasattr(current_mesh_object_from_tree, 'Value') and isinstance(current_mesh_object_from_tree.Value, rg.Mesh): # Handles GH_Mesh Goo wrappers
            valid_mesh_geometry = current_mesh_object_from_tree.Value
        # No further 'else' for general conversion, relying on input guarantee.
        
        if valid_mesh_geometry is None:
            # This warning now implies the input was None or an unexpected structure despite guarantees.
            print("Warning: Item for mesh ID {} is not a usable mesh. Skipping.".format(mesh_id_for_output))
            continue
        
        # 3. For the current mesh, iterate through each unique plane index.
        for plane_idx in sorted_plane_indices:
            # 4. Perform a binary search to find 'first_intersecting_angle_idx'.
            low = MIN_ANGLE_IDX
            high = MAX_ANGLE_IDX
            first_intersecting_angle_idx = MAX_ANGLE_IDX + 1 

            while low <= high:
                mid_angle_idx = low + (high - low) // 2
                
                line_path_to_check = GH_Path(System.Array[System.Int32]([plane_idx, mid_angle_idx]))
                current_line_geometry = None 
                
                if Lines.PathExists(line_path_to_check):
                    line_branch_content = Lines.Branch(line_path_to_check)
                    if line_branch_content and len(line_branch_content) > 0:
                        line_object_from_tree = line_branch_content[0]
                        
                        # Retrieve the line object. Based on guarantee, it's rg.Line or GH_Line.
                        if isinstance(line_object_from_tree, rg.Line):
                            current_line_geometry = line_object_from_tree
                        elif hasattr(line_object_from_tree, 'Value') and isinstance(line_object_from_tree.Value, rg.Line): # For GH_Line wrappers
                            current_line_geometry = line_object_from_tree.Value
                        # No further 'else' for LineCurve or general Curve conversion due to input guarantee.
                
                intersection_found_at_mid_angle = False
                if current_line_geometry: 
                    try:
                        intersection_points = rg.Intersect.Intersection.MeshLine(valid_mesh_geometry, current_line_geometry)
                        if intersection_points is not None and len(intersection_points) > 0:
                            intersection_found_at_mid_angle = True
                    except Exception as e:
                        print("Error during MeshLine intersection for Mesh ID {}, Plane {}, Angle {}: {}".format(mesh_id_for_output, plane_idx, mid_angle_idx, e))
                
                if intersection_found_at_mid_angle:
                    first_intersecting_angle_idx = mid_angle_idx 
                    high = mid_angle_idx - 1                    
                else:
                    low = mid_angle_idx + 1                     

            # 5. Calculate the "angle duration" (count of intersecting angles).
            calculated_angle_duration = 0 
            if first_intersecting_angle_idx <= MAX_ANGLE_IDX: 
                # Formula using MAX_ANGLE_IDX (e.g., 89): (89 + 1) - first_intersecting_angle_idx
                calculated_angle_duration = (MAX_ANGLE_IDX + 1) - first_intersecting_angle_idx
            
            result_path_indices = [mesh_id_for_output, plane_idx]
            result_gh_path = GH_Path(System.Array[System.Int32](result_path_indices))
            angleDurationsTree.Add(calculated_angle_duration, result_gh_path)
else:
    if Meshes is None or Meshes.BranchCount == 0:
        print("Info: 'Meshes' input is empty or not provided.")
    if Lines is None or Lines.BranchCount == 0:
        print("Info: 'Lines' input is empty or not provided.")
    if len(sorted_plane_indices) == 0 and Lines is not None and Lines.BranchCount > 0 :
         print("Info: Could not find any valid Plane_Indices in the 'Lines' tree. Check path structure or ensure it's not empty.")

a = angleDurationsTree
# ---------- end python_3_script ----------

# ---- group: Testing all Rays
python_3_script_2 = Python3Script(Meshes=mesh, Lines=line)  # -> out, a, flatten(b); inputs Meshes: tree of Mesh, Lines: tree of Line; disabled
# ---------- python_3_script_2: Python ----------
import Rhino.Geometry as rg
from Grasshopper import DataTree
from Grasshopper.Kernel.Data import GH_Path
import System # Wird für System.Array benötigt
import traceback # Für detailliertere Fehlermeldungen

# --- Eingänge ---
# Meshes: Grasshopper Tree Input. Typ-Hint: "Mesh", Zugriff: "Tree Access".
# Lines: Grasshopper Tree Input. Typ-Hint: "Line" (oder Curve), Zugriff: "Tree Access".

# --- Ausgänge ---
# a: IntersectionData - Detaillierter Baum der Schnittpunkte oder None ({Mesh; Ebene; Winkel})
# b: ScanResultData - Baum mit Anzahl konsekutiver Treffer von oben ({Mesh; Ebene} -> Anzahl)

# --------------------------------------------------------------------------
# TEIL 1: SCHNITTPUNKTBERECHNUNG (Unverändert)
# --------------------------------------------------------------------------

# Initialisiere den Datenbaum für Schnittdaten
IntersectionData = DataTree[object]()

# Prüfe, ob die Eingaben gültig sind
if Meshes is None or Lines is None or Meshes.BranchCount == 0 or Lines.BranchCount == 0:
    print("Warnung: Eingabe 'Meshes' oder 'Lines' fehlt oder ist leer.")
else:
    # Iteriere durch jeden Branch im Meshes-Baum
    for i in range(Meshes.BranchCount):
        mesh_path = Meshes.Path(i)
        mesh_branch = Meshes.Branch(i)

        if not mesh_branch or len(mesh_branch) == 0: continue
        mesh = mesh_branch[0]
        if not isinstance(mesh, rg.Mesh): continue
        if mesh_path.Length == 0: continue
        mesh_index = mesh_path.Indices[0]

        # Iteriere nun durch jeden Branch (jede Linie) im Lines-Baum
        for j in range(Lines.BranchCount):
            line_path = Lines.Path(j)
            line_branch = Lines.Branch(j)

            # Konstruiere den Output-Pfad für IntersectionData
            if line_path.Length < 2: continue # Erwarte {Ebene, Winkel}
            output_path_indices_detail = [mesh_index] + list(line_path.Indices)
            output_gh_path_detail = GH_Path(System.Array[System.Int32](output_path_indices_detail))

            if not line_branch or len(line_branch) == 0:
                IntersectionData.Add(None, output_gh_path_detail)
                continue

            line_obj = line_branch[0]
            line = None
            if isinstance(line_obj, rg.Line): line = line_obj
            elif isinstance(line_obj, rg.LineCurve): line = line_obj.Line
            elif hasattr(line_obj, 'TryGetLine'):
                 success, test_line = line_obj.TryGetLine()
                 if success: line = test_line

            if line is None:
                IntersectionData.Add(None, output_gh_path_detail)
                continue

            # --- Schnittprüfung ---
            intersection_results = None
            try:
                intersection_results = rg.Intersect.Intersection.MeshLine(mesh, line)
            except Exception as intersect_err:
                IntersectionData.Add(None, output_gh_path_detail)
                continue

            # --- Daten zu IntersectionData hinzufügen ---
            if intersection_results is not None and len(intersection_results) > 0:
                first_result = intersection_results[0]
                if isinstance(first_result, rg.Point3d):
                    IntersectionData.AddRange(list(intersection_results), output_gh_path_detail)
                elif isinstance(first_result, (float, System.Double)):
                    # ... (Parameter-zu-Punkt Logik, falls benötigt) ...
                    # Aus Platzgründen hier gekürzt, da es in deiner Umgebung Punkte liefert
                    # Stelle sicher, dass die Logik aus der vorherigen Version hier ist,
                    # falls MeshLine doch Parameter liefern könnte.
                    # In diesem Fall nehmen wir an, es liefert Punkte oder None/empty.
                    # Wenn es Punkte liefert, wurde es oben schon behandelt.
                    # Wenn es Parameter liefert, muss die Konvertierung hier erfolgen.
                    # Der Einfachheit halber gehen wir hier von der Point3d-Rückgabe aus.
                     IntersectionData.Add(None, output_gh_path_detail) # Platzhalter, falls Parameter-Logik fehlt
                else:
                    IntersectionData.Add(None, output_gh_path_detail)
            else:
                IntersectionData.Add(None, output_gh_path_detail) # Kein Schnittpunkt

# --------------------------------------------------------------------------
# TEIL 2: AUSWERTUNG - KONSECUTIVE TREFFER VON OBEN ZÄHLEN
# --------------------------------------------------------------------------

# Initialisiere den Ausgabe-Datenbaum für die Auswertung (Anzahl als Integer)
ScanResultData = DataTree[int]()

# Prüfe ob überhaupt Schnittdaten vorhanden sind
if IntersectionData is not None and IntersectionData.BranchCount > 0:

    # Finde alle existierenden Mesh- und Ebene-Indizes
    mesh_indices_present = set()
    ebene_indices_present = {} # Dict: mesh_index -> set of ebene_indices
    max_winkel_index_found = -1

    for path in IntersectionData.Paths:
        if path.Length == 3: # Erwarte Pfad {Mesh; Ebene; Winkel}
            mesh_idx = path.Indices[0]
            ebene_idx = path.Indices[1]
            winkel_idx = path.Indices[2]
            mesh_indices_present.add(mesh_idx)
            if mesh_idx not in ebene_indices_present: ebene_indices_present[mesh_idx] = set()
            ebene_indices_present[mesh_idx].add(ebene_idx)
            max_winkel_index_found = max(max_winkel_index_found, winkel_idx)
        elif path.Length > 0:
             mesh_indices_present.add(path.Indices[0])

    # Annahme über den höchsten Winkelindex (Top-Index)
    assumed_max_winkel_index = 89 # = Top Index für die Zählung
    if max_winkel_index_found > assumed_max_winkel_index:
        # print("Warnung: Höheren Winkelindex ({}) gefunden als erwartet ({}). Verwende gefundenes Maximum.".format(max_winkel_index_found, assumed_max_winkel_index)) # Optional
        assumed_max_winkel_index = max_winkel_index_found
    # elif max_winkel_index_found == -1 and IntersectionData.BranchCount > 0:
        # print("Warnung: Konnte maximalen Winkelindex nicht bestimmen. Nehme Standard an: {}".format(assumed_max_winkel_index)) # Optional

    # Iteriere durch alle gefundenen Mesh-Indizes
    for mesh_idx in sorted(list(mesh_indices_present)):
         # Iteriere durch alle gefundenen Ebene-Indizes für dieses Mesh
         if mesh_idx in ebene_indices_present:
             for ebene_idx in sorted(list(ebene_indices_present[mesh_idx])):

                 # --- Scan von Oben nach Unten ---
                 first_miss_found = False
                 first_miss_index = -1 # Index der ersten Linie (von oben), die NICHT trifft

                 # Iteriere RÜCKWÄRTS durch die Winkel-Indizes (von Top -> 0)
                 for winkel_idx in range(assumed_max_winkel_index, -1, -1):
                     # Konstruiere den Pfad im IntersectionData-Baum
                     check_path_indices = [mesh_idx, ebene_idx, winkel_idx]
                     check_gh_path = GH_Path(System.Array[System.Int32](check_path_indices))

                     # Prüfe, ob diese Linie NICHT getroffen hat
                     intersection_occurred = False # Annahme: Kein Treffer
                     if IntersectionData.PathExists(check_gh_path):
                         branch_content = IntersectionData.Branch(check_gh_path)
                         # Treffer, wenn Branch nicht leer ist UND das erste Element nicht None ist
                         if branch_content is not None and len(branch_content) > 0 and branch_content[0] is not None:
                             intersection_occurred = True

                     # Wenn KEIN Treffer erfolgte -> das ist der erste "Miss" von oben
                     if not intersection_occurred:
                         first_miss_found = True
                         first_miss_index = winkel_idx
                         break # Stoppe die Suche für diese Ebene, erster Miss gefunden

                 # --- Ergebnis berechnen ---
                 calculated_count = 0
                 if first_miss_found:
                     # Anzahl = TopIndex - IndexDesErstenMiss
                     # Beispiel: Top=89, erster Miss bei 84 -> 89 - 84 = 5 Treffer (89,88,87,86,85)
                     calculated_count = assumed_max_winkel_index - first_miss_index
                 else:
                     # Kein Miss gefunden, bedeutet alle von Top bis 0 haben getroffen
                     # Anzahl = TopIndex - (-1) = TopIndex + 1
                     # Beispiel: Top=89 -> 89 + 1 = 90 Treffer (Index 0 bis 89)
                     calculated_count = assumed_max_winkel_index + 1

                 # Füge das Ergebnis (die Anzahl) zum Auswertungsbaum hinzu
                 output_path_summary_indices = [mesh_idx, ebene_idx]
                 output_path_summary = GH_Path(System.Array[System.Int32](output_path_summary_indices))
                 ScanResultData.Add(calculated_count, output_path_summary)

# --------------------------------------------------------------------------
# AUSGABE ZUWEISEN
# --------------------------------------------------------------------------

# Weise die Ergebnisse den Ausgabeparametern 'a' und 'b' zu
# Stelle sicher, dass die GHPython Komponente einen zweiten Output 'b' hat!
a = IntersectionData
b = ScanResultData
# ---------- end python_3_script_2 ----------

# ---- group: Stop Testing when no Intersection
python_3_script_3 = Python3Script(Meshes=mesh, Lines=line)  # -> out, a, flatten(b); inputs Meshes: tree of Mesh, Lines: tree of Line; disabled
# ---------- python_3_script_3: Python ----------
import Rhino.Geometry as rg
from Grasshopper import DataTree
from Grasshopper.Kernel.Data import GH_Path
import System # Wird für System.Array benötigt
import traceback # Für detailliertere Fehlermeldungen

# --- Eingänge ---
# Meshes: Grasshopper Tree Input. Typ-Hint: "Mesh", Zugriff: "Tree Access".
# Lines: Grasshopper Tree Input. Typ-Hint: "Line" (oder Curve), Zugriff: "Tree Access".

# --- Ausgänge ---
# a: IntersectionData - Detaillierter Baum der Schnittpunkte oder None ({Mesh; Ebene; Winkel})
# b: ScanResultData - Baum mit GESAMTANZAHL der Treffer pro Ebene ({Mesh; Ebene} -> Anzahl)

# --------------------------------------------------------------------------
# TEIL 1: SCHNITTPUNKTBERECHNUNG (Unverändert)
# --------------------------------------------------------------------------

# Initialisiere den Datenbaum für Schnittdaten
IntersectionData = DataTree[object]()

# Prüfe, ob die Eingaben gültig sind
if Meshes is None or Lines is None or Meshes.BranchCount == 0 or Lines.BranchCount == 0:
    print("Warnung: Eingabe 'Meshes' oder 'Lines' fehlt oder ist leer.")
else:
    # Iteriere durch jeden Branch im Meshes-Baum
    for i in range(Meshes.BranchCount):
        mesh_path = Meshes.Path(i)
        mesh_branch = Meshes.Branch(i)

        if not mesh_branch or len(mesh_branch) == 0: continue
        mesh = mesh_branch[0]
        if not isinstance(mesh, rg.Mesh): continue
        if mesh_path.Length == 0: continue
        mesh_index = mesh_path.Indices[0]

        # Iteriere nun durch jeden Branch (jede Linie) im Lines-Baum
        for j in range(Lines.BranchCount):
            line_path = Lines.Path(j)
            line_branch = Lines.Branch(j)

            # Konstruiere den Output-Pfad für IntersectionData
            if line_path.Length < 2: continue # Erwarte {Ebene, Winkel}
            output_path_indices_detail = [mesh_index] + list(line_path.Indices)
            output_gh_path_detail = GH_Path(System.Array[System.Int32](output_path_indices_detail))

            if not line_branch or len(line_branch) == 0:
                IntersectionData.Add(None, output_gh_path_detail)
                continue

            line_obj = line_branch[0]
            line = None
            if isinstance(line_obj, rg.Line): line = line_obj
            elif isinstance(line_obj, rg.LineCurve): line = line_obj.Line
            elif hasattr(line_obj, 'TryGetLine'):
                 success, test_line = line_obj.TryGetLine()
                 if success: line = test_line

            if line is None:
                IntersectionData.Add(None, output_gh_path_detail)
                continue

            # --- Schnittprüfung ---
            intersection_results = None # Vorinitialisieren
            intersection_points = None  # Ebenfalls vorinitialisieren
            try:
                # KORREKTE PYTHON-SYNTAX:
                # Diese Methode gibt ein Array von Point3d zurück (oder None/leer).
                intersection_points = rg.Intersect.Intersection.MeshLine(mesh, line)

                # Wir speichern die Punkte als Liste, wenn vorhanden, sonst None
                if intersection_points is not None and len(intersection_points) > 0:
                     intersection_results = list(intersection_points)
                # else: intersection_results bleibt None (wie vorinitialisiert)

            except Exception as intersect_err:
                print("Fehler bei Intersection.MeshLine für Mesh {} / Line {}: {}".format(i, j, intersect_err))
                # traceback.print_exc() # Optional: Detaillierten Traceback ausgeben
                # intersection_results bleibt None
                pass # Fehler nur melden, aber den Rest des Codes nicht abbrechen

            # --- Daten zu IntersectionData hinzufügen ---
            # Hier wird jetzt intersection_results verwendet, das entweder eine Liste von Punkten oder None ist
            if intersection_results is not None:
                IntersectionData.AddRange(intersection_results, output_gh_path_detail)
            else:
                IntersectionData.Add(None, output_gh_path_detail) # Kein Schnittpunkt oder Fehler

# --------------------------------------------------------------------------
# TEIL 2: AUSWERTUNG - GESAMTE TREFFER PRO EBENE ZÄHLEN (MODIFIZIERT)
# --------------------------------------------------------------------------

# Initialisiere den Ausgabe-Datenbaum für die Auswertung (Gesamtanzahl als Integer)
ScanResultData = DataTree[int]()

# Prüfe ob überhaupt Schnittdaten vorhanden sind
if IntersectionData is not None and IntersectionData.BranchCount > 0:

    # Finde alle existierenden Mesh- und Ebene-Indizes
    mesh_indices_present = set()
    ebene_indices_present = {} # Dict: mesh_index -> set of ebene_indices
    max_winkel_index_found = -1

    for path in IntersectionData.Paths:
        if path.Length >= 3: # Erwarte Pfad {Mesh; Ebene; Winkel}
            mesh_idx = path.Indices[0]
            ebene_idx = path.Indices[1]
            winkel_idx = path.Indices[2]
            mesh_indices_present.add(mesh_idx)
            if mesh_idx not in ebene_indices_present: ebene_indices_present[mesh_idx] = set()
            ebene_indices_present[mesh_idx].add(ebene_idx)
            max_winkel_index_found = max(max_winkel_index_found, winkel_idx)
        elif path.Length > 0: # Falls Pfade nur {Mesh} oder {Mesh; Ebene} existieren
             mesh_indices_present.add(path.Indices[0])
             if path.Length > 1 and path.Indices[0] not in ebene_indices_present:
                 ebene_indices_present[path.Indices[0]] = set()
             if path.Length > 1:
                 ebene_indices_present[path.Indices[0]].add(path.Indices[1])


    # Bestimme den höchsten Winkelindex, über den iteriert werden soll
    # Falls keine Winkel gefunden wurden (z.B. nur Pfade {Mesh; Ebene}), setze einen sinnvollen Standard
    # oder behandle den Fall explizit. Hier gehen wir davon aus, dass Winkelindices existieren, wenn ebene_indices existieren.
    # Wenn max_winkel_index_found -1 bleibt, gab es keine 3-elementigen Pfade.
    # Wir brauchen einen oberen Grenzwert für die Schleife. Wenn keiner gefunden wurde,
    # können wir nicht sinnvoll zählen. Setze ihn auf 0 oder gib eine Warnung aus.
    if max_winkel_index_found == -1 and len(ebene_indices_present) > 0:
         print("Warnung: Keine Winkel-Indizes (3. Ebene) in IntersectionData gefunden. Kann Gesamttreffer nicht zählen.")
         # Optional: Setze auf 0, falls das einen Sinn ergibt.
         # max_winkel_index_found = 0

    # Iteriere durch alle gefundenen Mesh-Indizes
    for mesh_idx in sorted(list(mesh_indices_present)):
        # Iteriere durch alle gefundenen Ebene-Indizes für dieses Mesh
        if mesh_idx in ebene_indices_present:
            for ebene_idx in sorted(list(ebene_indices_present[mesh_idx])):

                # --- Zähle ALLE Treffer in dieser Ebene ---
                total_hits_in_ebene = 0

                # Iteriere VORWÄRTS durch ALLE möglichen Winkel-Indizes von 0 bis zum Maximum
                # Stelle sicher, dass max_winkel_index_found gültig ist (> -1)
                if max_winkel_index_found >= 0:
                    for winkel_idx in range(max_winkel_index_found + 1):
                        # Konstruiere den Pfad im IntersectionData-Baum
                        check_path_indices = [mesh_idx, ebene_idx, winkel_idx]
                        check_gh_path = GH_Path(System.Array[System.Int32](check_path_indices))

                        # Prüfe, ob für diese Linie ein Treffer verzeichnet wurde
                        intersection_occurred = False # Annahme: Kein Treffer
                        if IntersectionData.PathExists(check_gh_path):
                            branch_content = IntersectionData.Branch(check_gh_path)
                            # Treffer, wenn Branch nicht leer ist UND das erste Element nicht None ist
                            if branch_content is not None and len(branch_content) > 0 and branch_content[0] is not None:
                                intersection_occurred = True

                        # Wenn ein Treffer erfolgte, erhöhe den Zähler für diese Ebene
                        if intersection_occurred:
                            total_hits_in_ebene += 1

                # Füge das Ergebnis (die Gesamtanzahl) zum Auswertungsbaum hinzu
                output_path_summary_indices = [mesh_idx, ebene_idx]
                output_path_summary = GH_Path(System.Array[System.Int32](output_path_summary_indices))
                ScanResultData.Add(total_hits_in_ebene, output_path_summary)
        else:
             # Optional: Handle den Fall, dass für ein Mesh keine Ebenen gefunden wurden
             # Ggf. einen Eintrag mit 0 Treffern für das Mesh hinzufügen?
             # Hängt von der gewünschten Ausgabe ab. Aktuell wird nichts hinzugefügt.
             pass


# --------------------------------------------------------------------------
# AUSGABE ZUWEISEN
# --------------------------------------------------------------------------

# Weise die Ergebnisse den Ausgabeparametern 'a' und 'b' zu
a = IntersectionData
b = ScanResultData
# ---------- end python_3_script_3 ----------

# ----
intersection_points_as_output_2 = BooleanToggle(False)

# ---- group: Testing Binary Search like
python_3_script_4 = Python3Script(Meshes=mesh_2, Lines=line)  # -> out, flatten(a); inputs Meshes: tree of Mesh, Lines: tree of Line; disabled
# ---------- python_3_script_4: Python ----------
import Rhino.Geometry as rg
from Grasshopper import DataTree
from Grasshopper.Kernel.Data import GH_Path
import System

MIN_ANGLE_IDX = 0
MAX_ANGLE_IDX = 89 # Defines the range of angle indices (0-89 means 90 angle steps)

# Initialize the output DataTree
reported_angle_value_tree = DataTree[int]()

# 1. Collect unique Plane_Indices from the Lines input tree.
#    Ensures processing focuses only on planes with defined line data.
unique_plane_indices = set()
if Lines is not None and Lines.BranchCount > 0:
    for i in range(Lines.BranchCount):
        path = Lines.Path(i) 
        if path.Length >= 1: # Plane_Index is the first element in the path
            unique_plane_indices.add(path.Indices[0])
sorted_plane_indices = sorted(list(unique_plane_indices))

# Proceed with main logic only if essential inputs are valid and present.
if Meshes is not None and Meshes.BranchCount > 0 and \
   Lines is not None and Lines.BranchCount > 0 and \
   len(sorted_plane_indices) > 0:

    # 2. Iterate through each mesh in the input Meshes tree.
    for mesh_branch_idx in range(Meshes.BranchCount):
        mesh_gh_path = Meshes.Path(mesh_branch_idx)
        
        # Determine the mesh ID for the output DataTree path.
        mesh_id_for_output = -1
        if mesh_gh_path.Length > 0:
            mesh_id_for_output = mesh_gh_path.Indices[0]
        else: 
            mesh_id_for_output = mesh_branch_idx 
            print("Info: Mesh path was empty. Using branch index {} as mesh ID.".format(mesh_branch_idx))

        if not Meshes.Branch(mesh_branch_idx) or len(Meshes.Branch(mesh_branch_idx)) == 0:
            print("Info: Empty branch found for mesh ID {}. Skipping this item.".format(mesh_id_for_output))
            continue
            
        # Retrieve the mesh object, relying on input guarantees (rg.Mesh or GH_Mesh).
        current_mesh_object_from_tree = Meshes.Branch(mesh_branch_idx)[0]
        valid_mesh_geometry = None 

        if isinstance(current_mesh_object_from_tree, rg.Mesh):
            valid_mesh_geometry = current_mesh_object_from_tree
        elif hasattr(current_mesh_object_from_tree, 'Value') and isinstance(current_mesh_object_from_tree.Value, rg.Mesh): # Handles GH_Mesh Goo wrappers
            valid_mesh_geometry = current_mesh_object_from_tree.Value
        
        if valid_mesh_geometry is None:
            print("Warning: Item for mesh ID {} is not a usable mesh. Skipping.".format(mesh_id_for_output))
            continue
        
        # 3. For the current mesh, iterate through each unique plane index.
        for plane_idx in sorted_plane_indices:
            # 4. Perform a binary search to find 'last_intersecting_angle_idx_from_bottom':
            #    the highest 0-based angle index within [MIN_ANGLE_IDX, MAX_ANGLE_IDX] that causes an intersection.
            low = MIN_ANGLE_IDX
            high = MAX_ANGLE_IDX
            # Initialize to a value indicating no intersection found yet.
            last_intersecting_angle_idx_from_bottom = 0 

            while low <= high:
                mid_angle_idx = low + (high - low) // 2
                
                line_path_to_check = GH_Path(System.Array[System.Int32]([plane_idx, mid_angle_idx]))
                current_line_geometry = None 
                
                if Lines.PathExists(line_path_to_check):
                    line_branch_content = Lines.Branch(line_path_to_check)
                    if line_branch_content and len(line_branch_content) > 0:
                        line_object_from_tree = line_branch_content[0]
                        
                        # Retrieve the line object, relying on input guarantees (rg.Line or GH_Line).
                        if isinstance(line_object_from_tree, rg.Line):
                            current_line_geometry = line_object_from_tree
                        elif hasattr(line_object_from_tree, 'Value') and isinstance(line_object_from_tree.Value, rg.Line): # For GH_Line wrappers
                            current_line_geometry = line_object_from_tree.Value
                
                intersection_found_at_mid_angle = False
                if current_line_geometry and valid_mesh_geometry: 
                    try:
                        intersection_points = rg.Intersect.Intersection.MeshLine(valid_mesh_geometry, current_line_geometry)
                        if intersection_points is not None and len(intersection_points) > 0:
                            intersection_found_at_mid_angle = True
                    except Exception as e:
                        # Report any exceptions during the intersection process.
                        print("Error during MeshLine intersection for Mesh ID {}, Plane {}, Angle {}: {}".format(mesh_id_for_output, plane_idx, mid_angle_idx, e))
                # If no valid line geometry exists for mid_angle_idx, intersection_found_at_mid_angle remains False.
                
                if intersection_found_at_mid_angle:
                    # If an intersection occurs, this mid_angle_idx is a candidate for the last one.
                    last_intersecting_angle_idx_from_bottom = mid_angle_idx 
                    # Search in the upper half for an even later (higher index) intersection.
                    low = mid_angle_idx + 1                    
                else:
                    # If no intersection occurs, the last intersection must be at a lower angle index.
                    high = mid_angle_idx - 1                     

            # 5. Determine the output value.
            # If an intersection was found (index is not -1), add 1 to match the "expected number".
            # Otherwise, keep -1 to indicate no intersection.
            output_value_to_store = -1 
            if last_intersecting_angle_idx_from_bottom > -1: 
                output_value_to_store = last_intersecting_angle_idx_from_bottom + 1
            # else: output_value_to_store remains -1 (no intersection found)
            
            # Add the processed value to the output DataTree.
            result_path_indices = [mesh_id_for_output, plane_idx]
            result_gh_path = GH_Path(System.Array[System.Int32](result_path_indices))
            reported_angle_value_tree.Add(output_value_to_store, result_gh_path)
else:
    # Provide warnings if essential inputs are missing or insufficient for processing.
    if Meshes is None or Meshes.BranchCount == 0:
        print("Info: 'Meshes' input is empty or not provided.")
    if Lines is None or Lines.BranchCount == 0:
        print("Info: 'Lines' input is empty or not provided.")
    if len(sorted_plane_indices) == 0 and Lines is not None and Lines.BranchCount > 0 :
         print("Info: Could not find any valid Plane_Indices in the 'Lines' tree. Check path structure or ensure it's not empty.")

# Assign the resulting DataTree to the output parameter 'a'.
a = reported_angle_value_tree
# ---------- end python_3_script_4 ----------

# ---- group: Testing all Rays
python_3_script_5 = Python3Script(Meshes=mesh_2, Lines=line)  # -> out, a, flatten(b); inputs Meshes: tree of Mesh, Lines: tree of Line; disabled
# ---------- python_3_script_5: Python ----------
import Rhino.Geometry as rg
from Grasshopper import DataTree
from Grasshopper.Kernel.Data import GH_Path
import System # Wird für System.Array benötigt
import traceback # Für detailliertere Fehlermeldungen

# --- Eingänge ---
# Meshes: Grasshopper Tree Input. Typ-Hint: "Mesh", Zugriff: "Tree Access".
# Lines: Grasshopper Tree Input. Typ-Hint: "Line" (oder Curve), Zugriff: "Tree Access".

# --- Ausgänge ---
# a: IntersectionData - Detaillierter Baum der Schnittpunkte oder None ({Mesh; Ebene; Winkel})
# b: LastAngleIndexData - Baum mit höchstem Winkelindex pro Mesh/Ebene ({Mesh; Ebene} -> Index)

# --------------------------------------------------------------------------
# TEIL 1: SCHNITTPUNKTBERECHNUNG (Wie zuvor, aber Ergebnis in 'IntersectionData')
# --------------------------------------------------------------------------

# Initialisiere den Datenbaum für Schnittdaten
IntersectionData = DataTree[object]()

# Prüfe, ob die Eingaben gültig sind
if Meshes is None or Lines is None or Meshes.BranchCount == 0 or Lines.BranchCount == 0:
    print("Warnung: Eingabe 'Meshes' oder 'Lines' fehlt oder ist leer.")
    # Belasse IntersectionData als leeren Baum
else:
    # Iteriere durch jeden Branch im Meshes-Baum
    for i in range(Meshes.BranchCount):
        mesh_path = Meshes.Path(i)
        mesh_branch = Meshes.Branch(i)

        if not mesh_branch or len(mesh_branch) == 0: continue
        mesh = mesh_branch[0]
        if not isinstance(mesh, rg.Mesh): continue
        if mesh_path.Length == 0: continue
        mesh_index = mesh_path.Indices[0]

        # Iteriere nun durch jeden Branch (jede Linie) im Lines-Baum
        for j in range(Lines.BranchCount):
            line_path = Lines.Path(j)
            line_branch = Lines.Branch(j)

            # Konstruiere den Output-Pfad für IntersectionData
            # Annahme: line_path = {EbeneIndex, WinkelIndex}
            if line_path.Length < 2:
                print("Warnung: Unerwarteter Linien-Pfad-Aufbau: {}".format(line_path))
                continue
            output_path_indices_detail = [mesh_index] + list(line_path.Indices)
            output_gh_path_detail = GH_Path(System.Array[System.Int32](output_path_indices_detail))

            if not line_branch or len(line_branch) == 0:
                IntersectionData.Add(None, output_gh_path_detail)
                continue

            line_obj = line_branch[0]
            line = None
            if isinstance(line_obj, rg.Line): line = line_obj
            elif isinstance(line_obj, rg.LineCurve): line = line_obj.Line
            elif hasattr(line_obj, 'TryGetLine'):
                 success, test_line = line_obj.TryGetLine()
                 if success: line = test_line

            if line is None:
                IntersectionData.Add(None, output_gh_path_detail)
                continue

            # --- Schnittprüfung ---
            intersection_results = None
            try:
                intersection_results = rg.Intersect.Intersection.MeshLine(mesh, line)
            except Exception as intersect_err:
                print("Fehler bei rg.Intersect.Intersection.MeshLine für Mesh {} und Linie {}:".format(mesh_path, line_path))
                traceback.print_exc()
                IntersectionData.Add(None, output_gh_path_detail)
                continue

            # --- Daten zu IntersectionData hinzufügen ---
            if intersection_results is not None and len(intersection_results) > 0:
                first_result = intersection_results[0]
                if isinstance(first_result, rg.Point3d):
                    IntersectionData.AddRange(list(intersection_results), output_gh_path_detail)
                elif isinstance(first_result, (float, System.Double)):
                    intersection_points = []
                    calc_ok = True
                    try:
                        for t_param in intersection_results:
                            try:
                                point = line.PointAt(float(t_param))
                                intersection_points.append(point)
                            except Exception as e_pointat:
                                print("Fehler bei line.PointAt für Pfad {}: {}".format(output_gh_path_detail, e_pointat))
                                calc_ok = False; break
                        if calc_ok and intersection_points:
                            IntersectionData.AddRange(intersection_points, output_gh_path_detail)
                        else: IntersectionData.Add(None, output_gh_path_detail)
                    except Exception as e_loop:
                         print("Fehler Parameterverarbeitung Pfad {}: {}".format(output_gh_path_detail, e_loop))
                         IntersectionData.Add(None, output_gh_path_detail)
                else:
                    print("Warnung: Unerwarteter Rückgabetyp ({}) von MeshLine für Pfad {}".format(type(first_result), output_gh_path_detail))
                    IntersectionData.Add(None, output_gh_path_detail)
            else:
                IntersectionData.Add(None, output_gh_path_detail) # Kein Schnittpunkt

# --------------------------------------------------------------------------
# TEIL 2: AUSWERTUNG - HÖCHSTEN WINKELINDEX FINDEN
# --------------------------------------------------------------------------

# Initialisiere den zweiten Ausgabe-Datenbaum für die Auswertung (Index als Integer)
LastAngleIndexData = DataTree[int]()

# Prüfe ob überhaupt Schnittdaten vorhanden sind
if IntersectionData is not None and IntersectionData.BranchCount > 0:

    # Finde alle existierenden Mesh- und Ebene-Indizes aus den Pfaden
    mesh_indices_present = set()
    ebene_indices_present = {} # Dict: mesh_index -> set of ebene_indices
    max_winkel_index_found = -1 # Um den Bereich 0-89 zu bestätigen/finden

    for path in IntersectionData.Paths:
        if path.Length == 3: # Erwarte Pfad {Mesh; Ebene; Winkel}
            mesh_idx = path.Indices[0]
            ebene_idx = path.Indices[1]
            winkel_idx = path.Indices[2]

            mesh_indices_present.add(mesh_idx)
            if mesh_idx not in ebene_indices_present:
                ebene_indices_present[mesh_idx] = set()
            ebene_indices_present[mesh_idx].add(ebene_idx)
            max_winkel_index_found = max(max_winkel_index_found, winkel_idx)
        elif path.Length > 0: # Erfasse auch Mesh-Indizes aus kürzeren Pfaden (sollte nicht vorkommen bei voller Struktur)
             mesh_indices_present.add(path.Indices[0])


    # Wenn kein Winkelindex > -1 gefunden wurde, stimmt etwas nicht, aber wir nehmen an 0..89
    # Falls du einen anderen Winkelbereich hast, musst du diesen Wert anpassen!
    assumed_max_winkel_index = 89
    if max_winkel_index_found > assumed_max_winkel_index:
        print("Warnung: Höherer Winkelindex ({}) gefunden als erwartet ({}). Verwende gefundenes Maximum.".format(max_winkel_index_found, assumed_max_winkel_index))
        assumed_max_winkel_index = max_winkel_index_found
    elif max_winkel_index_found == -1 and IntersectionData.BranchCount > 0:
         print("Warnung: Konnte maximalen Winkelindex nicht bestimmen. Nehme Standard an: {}".format(assumed_max_winkel_index))
         # assumed_max_winkel_index bleibt 89


    # Iteriere durch alle gefundenen Mesh-Indizes
    for mesh_idx in sorted(list(mesh_indices_present)):
         # Iteriere durch alle gefundenen Ebene-Indizes für dieses Mesh
         # Wenn für ein Mesh keine Ebenen gefunden wurden (seltsam), wird es übersprungen
         if mesh_idx in ebene_indices_present:
             for ebene_idx in sorted(list(ebene_indices_present[mesh_idx])):
                 highest_found_winkel_index = 0 # Default: Kein Schnittpunkt für diese Ebene gefunden

                 # Iteriere RÜCKWÄRTS durch die Winkel-Indizes (von 89 -> 0)
                 for winkel_idx in range(assumed_max_winkel_index, -1, -1):
                     # Konstruiere den Pfad im IntersectionData-Baum
                     check_path_indices = [mesh_idx, ebene_idx, winkel_idx]
                     check_gh_path = GH_Path(System.Array[System.Int32](check_path_indices))

                     # Prüfe, ob dieser Pfad existiert UND ob er Daten enthält (nicht nur None)
                     if IntersectionData.PathExists(check_gh_path):
                         branch_content = IntersectionData.Branch(check_gh_path)
                         # Erfolgreiche Durchstossung, wenn Branch nicht leer ist UND das erste Element nicht None ist
                         if branch_content is not None and len(branch_content) > 0 and branch_content[0] is not None:
                             highest_found_winkel_index = winkel_idx
                             break # Höchsten Index gefunden, Abbruch der Schleife für diese Ebene

                 # Füge das Ergebnis (den höchsten gefundenen Index oder -1) zum Auswertungsbaum hinzu
                 output_path_summary_indices = [mesh_idx, ebene_idx]
                 output_path_summary = GH_Path(System.Array[System.Int32](output_path_summary_indices))
                 LastAngleIndexData.Add(highest_found_winkel_index, output_path_summary)


# --------------------------------------------------------------------------
# AUSGABE ZUWEISEN
# --------------------------------------------------------------------------

# Weise die Ergebnisse den Ausgabeparametern 'a' und 'b' zu
# Stelle sicher, dass die GHPython Komponente einen zweiten Output 'b' hat!
a = IntersectionData
b = LastAngleIndexData
# ---------- end python_3_script_5 ----------

# ----
ironpython_2_script_2 = IronPython2Script(Meshes=mesh_2, Lines=line, CollectPoints=intersection_points_as_output_2)  # -> out, flatten(lastAngleIndices), flatten(intersectionPoints); inputs Meshes: tree of Mesh, Lines: tree of Line, CollectPoints: Boolean
# ---------- ironpython_2_script_2: IronPython ----------
# coding=utf-8

import Rhino.Geometry as rg
from Grasshopper import DataTree
from Grasshopper.Kernel.Data import GH_Path
import System
import System.Threading.Tasks as tasks
import System.Collections.Generic as generic
import threading

# --- Configuration ---
MIN_ANGLE_IDX = 0
MAX_ANGLE_IDX = 89

# --- Global Variables for Parallel Access ---
lines_dict = {}
results_dict = {}
results_lock = threading.Lock()
collect_points_flag = False

# --- Helper Function to Get Geometry ---
def get_geometry(obj, target_type):
    """Handles GH Goo and returns the base geometry or None."""
    if obj is None: # Frühe Prüfung auf None
        return None
    if isinstance(obj, target_type):
        return obj
    if hasattr(obj, 'Value') and isinstance(obj.Value, target_type):
        return obj.Value
    if target_type == rg.Line and isinstance(obj, rg.LineCurve):
        return obj.Line
    if target_type == rg.Line and hasattr(obj, 'TryGetLine'):
        success, test_line = obj.TryGetLine()
        if success: return test_line
    return None

# --- Function to Process a Single Mesh-Plane Pair (Find Last) ---
def process_pair_last(pair):
    """Performs binary search (for last) and optionally intersection collection."""
    # mesh_geom wird hier nur None sein, wenn die Logik unten angepasst wird,
    # um den Fall ohne Mesh speziell zu behandeln.
    # Im Normalfall (Meshes vorhanden) ist mesh_geom hier immer ein gültiges Mesh.
    mesh_id, mesh_geom, plane_idx = pair

    # Wenn kein mesh_geom übergeben wird (Spezialfall "freie Sicht"),
    # dann ist der letzte Winkelindex 0.
    if mesh_geom is None:
        last_intersecting_angle_idx = -1 # Wird zu 0 für Output
        all_points_for_plane = generic.List[rg.Point3d]()
    else:
        low = MIN_ANGLE_IDX
        high = MAX_ANGLE_IDX
        last_intersecting_angle_idx = -1 # Default: Kein Schnittpunkt

        while low <= high:
            mid_angle_idx = low + (high - low) // 2
            current_line = lines_dict.get((plane_idx, mid_angle_idx))
            intersection_found = False

            if current_line: # mesh_geom ist hier sicher vorhanden
                try:
                    intersection_data = rg.Intersect.Intersection.MeshLine(mesh_geom, current_line)
                    if intersection_data is not None and len(intersection_data) > 0:
                        intersection_found = True
                except Exception as e:
                    pass # Error handling

            if intersection_found:
                last_intersecting_angle_idx = mid_angle_idx
                low = mid_angle_idx + 1
            else:
                high = mid_angle_idx - 1

        all_points_for_plane = generic.List[rg.Point3d]()
        if collect_points_flag and last_intersecting_angle_idx != -1 and mesh_geom is not None:
            for angle_idx_to_collect in range(MIN_ANGLE_IDX, last_intersecting_angle_idx + 1):
                line_to_collect = lines_dict.get((plane_idx, angle_idx_to_collect))
                if line_to_collect:
                    try:
                        points = rg.Intersect.Intersection.MeshLine(mesh_geom, line_to_collect)
                        if points is not None and len(points) > 0:
                            all_points_for_plane.AddRange(points)
                    except Exception as e:
                       pass

    output_index = 0 if last_intersecting_angle_idx == -1 else last_intersecting_angle_idx

    key = (mesh_id, plane_idx)
    value = (output_index, all_points_for_plane)

    with results_lock:
        results_dict[key] = value

# --- Main Script Execution ---

lastAngleIndexTree = DataTree[int]()
intersectionPointsTree = DataTree[rg.Point3d]()
print_output = []

if "CollectPoints" in globals() and isinstance(CollectPoints, bool):
    collect_points_flag = CollectPoints
    print_output.append("Info: Collecting points set to {}.".format(collect_points_flag))
else:
    collect_points_flag = False
    print_output.append("Warning: 'CollectPoints' input missing/invalid. Defaulting to False.")

unique_plane_indices = set()
if Lines is not None and Lines.BranchCount > 0:
    for i in range(Lines.BranchCount):
        path = Lines.Path(i)
        if path.Length >= 2:
            plane_idx = path.Indices[0]
            angle_idx = path.Indices[1]
            unique_plane_indices.add(plane_idx)
            branch_content = Lines.Branch(path)
            if branch_content and len(branch_content) > 0:
                line_geom = get_geometry(branch_content[0], rg.Line)
                if line_geom:
                    lines_dict[(plane_idx, angle_idx)] = line_geom
sorted_plane_indices = sorted(list(unique_plane_indices))

meshes_provided = False
valid_meshes_list = []
if Meshes is not None and Meshes.BranchCount > 0:
    for i in range(Meshes.BranchCount):
        mesh_path = Meshes.Path(i)
        mesh_id_candidate = mesh_path.Indices[0] if mesh_path.Length > 0 else i
        
        branch_content = Meshes.Branch(i)
        if not branch_content or len(branch_content) == 0:
            # print_output.append("Info: Empty branch for potential mesh ID {}. Skipping this item for processing.".format(mesh_id_candidate))
            continue # Diese Mesh-Branch ist leer, nicht unbedingt ein Fehler für die Gesamtlogik
            
        mesh_geom = get_geometry(branch_content[0], rg.Mesh)
        if mesh_geom is not None: # Explizit prüfen, ob ein Mesh-Objekt extrahiert wurde
            valid_meshes_list.append((mesh_id_candidate, mesh_geom))
            meshes_provided = True # Setze Flag, wenn mindestens ein gültiges Mesh gefunden wurde
        # else:
            # print_output.append("Warning: Item for potential mesh ID {} is not a usable mesh. Skipping.".format(mesh_id_candidate))

# --- Logik-Anpassung für leere Meshes ---
if not meshes_provided: # Wenn Meshes <null> oder alle Branches leer/ungültig waren
    print_output.append("Info: No valid meshes provided. Assuming 'free sight' (output 0 for all planes).")
    dummy_mesh_id = 0 # Standard-ID, wenn keine Meshes vorhanden sind
    if sorted_plane_indices:
        for plane_idx in sorted_plane_indices:
            result_path = GH_Path(System.Array[System.Int32]([dummy_mesh_id, plane_idx]))
            lastAngleIndexTree.Add(0, result_path)
            # intersectionPointsTree bleibt leer, da CollectPoints hier nicht relevant ist oder keine Punkte existieren
    else:
        print_output.append("Info: No valid planes found either. Output trees will be empty.")
        
elif lines_dict and sorted_plane_indices: # Normalfall mit gültigen Meshes und Lines
    processing_pairs = []
    for mesh_id, mesh_geom in valid_meshes_list:
        for plane_idx in sorted_plane_indices:
            processing_pairs.append((mesh_id, mesh_geom, plane_idx))

    if processing_pairs: # Nur parallelisieren, wenn es etwas zu tun gibt
        tasks.Parallel.ForEach(processing_pairs, process_pair_last)

        for key, value in results_dict.items():
            mesh_id_res = key[0]
            plane_idx_res = key[1]
            last_index = value[0]
            points_list = value[1]

            result_path = GH_Path(System.Array[System.Int32]([mesh_id_res, plane_idx_res]))
            lastAngleIndexTree.Add(last_index, result_path)

            if points_list.Count > 0: # Nur hinzufügen, wenn Punkte gesammelt wurden
                intersectionPointsTree.AddRange(points_list, result_path)
    else:
        print_output.append("Info: No valid mesh/plane pairs to process.")
else:
    # Allgemeine Informationsmeldungen, falls Inputs fehlen
    if not lines_dict: print_output.append("Info: 'Lines' input is empty or invalid. Cannot determine planes.")
    if not sorted_plane_indices: print_output.append("Info: No valid Plane_Indices found.")
    # Hier könnten auch für jeden Plane-Index Nullen erzeugt werden, wenn Lines vorhanden sind aber Meshes nicht.
    # Das wird aber bereits durch den 'not meshes_provided'-Block oben abgedeckt.

# --- Final Output ---
lastAngleIndices = lastAngleIndexTree
intersectionPoints = intersectionPointsTree

# Print collected messages
for msg in print_output:
    print(msg)

if meshes_provided: # Warnung nur ausgeben, wenn tatsächlich eine binäre Suche stattfand
    print("Warnung: Binäre Suche setzt Monotonie voraus!")
    print("(d.h. wenn Winkel X schneidet, wird angenommen, dass alle Winkel Y < X auch schneiden).")
# ---------- end ironpython_2_script_2 ----------
partition_list = PartitionList(List=ironpython_2_script.angleDurations, Size=list_length)  # -> simplify(Chunks)
partition_list_2 = PartitionList(List=ironpython_2_script_2.lastAngleIndices, Size=list_length)  # -> simplify(Chunks)
avr = Average(Input=partition_list_2)
avr_2 = Average(Input=partition_list)
dom = ConstructDomain(DomainStart="0", DomainEnd=Slider(0.7, range=0..10))
dom_2 = ConstructDomain(DomainStart="70", DomainEnd="0")
remap = RemapNumbers(Value=partition_list_2, Source=Domain(90, 0), Target=Domain(0, 1))  # -> Mapped, Clipped
remap_2 = RemapNumbers(Value=partition_list, Source=dom_2, Target=dom)  # -> Mapped, Clipped
hsv = ColourHSV(Alpha="1", Hue=remap.Clipped, Saturation="1", Value=remap_2.Clipped)
contextpixelsascrv = ClusterInput()
expression = Expression(x=avr_2, Expression="Round(x,1)")
expression_2 = Expression(x=avr, Expression="Round(x,1)")
contextpixelsascrv_2 = Curve(reverse(contextpixelsascrv))
R = ClusterOutput(expression)
R_2 = ClusterOutput(expression_2)
C = ClusterOutput(hsv)
fill = CreateGdiFill(Colour=hsv)
project_3 = Project(Geometry=contextpixelsascrv_2, Plane=PlaneXY(0, 0, 0))  # -> Geometry, Transform
shape = CreateGdiShape(Geometry=project_3.Geometry, Fill=fill)
S = ClusterOutput(shape)

# ==== cluster Cluster_7
built_in_categories = BuiltInCategories("autodesk.revit.category.family:windows-1.0.0", SearchPattern="Window")
category_filter = CategoryFilter(Categories=built_in_categories, Inverted=False)
query_elements = QueryElements(Filter=category_filter)  # -> Elements, Count
component_neighbours = ComponentNeighbours(Component=query_elements.Elements)  # -> FromRoom, ToRoom
null_item = NullItem(Item=component_neighbours.FromRoom)  # -> NullFlags, InvalidFlags, Description
null_item_2 = NullItem(Item=component_neighbours.ToRoom)  # -> NullFlags, InvalidFlags, Description
gate_and = GateAnd(A=null_item.NullFlags, B=null_item_2.NullFlags)
gate_not = GateNot(A=gate_and)
cull_pattern = CullPattern(List=component_neighbours.FromRoom, CullPattern=gate_not)
cull_pattern_2 = CullPattern(List=component_neighbours.ToRoom, CullPattern=gate_not)
element_passport = ElementPassport(Element=cull_pattern)  # -> DocumentGUID, Document, UniqueID, Id
element_passport_2 = ElementPassport(Element=cull_pattern_2)  # -> DocumentGUID, Document, UniqueID, Id
cull_pattern_3 = CullPattern(List=query_elements.Elements, CullPattern=gate_not)
ids_fromroom = ClusterOutput(element_passport.Id)  # IDs_FromRoom
ids_toroom = ClusterOutput(element_passport_2.Id)  # IDs_ToRoom
windows = ClusterOutput(cull_pattern_3)  # Windows

# ==== cluster Cluster_8
relay = ClusterInput()
element_type = ElementType(Element=relay)  # -> Element, Type
parameter = ClusterInput()
element_parameter = ElementParameter(Element=element_type.Type, Parameter=parameter)  # -> Element, Value
pattern = ClusterInput()
match_text = MatchText(Text=element_parameter.Value, Pattern=pattern, Case=True)
cull_pattern = CullPattern(List=relay, CullPattern=match_text)
list = ClusterOutput(cull_pattern)

# ==== cluster Cluster_9
list = ClusterInput()
relay = ClusterInput()
element_location = ElementLocation(Element=relay)  # -> Element, Location, Hand, Facing, WorkPlane
element = ClusterInput()
element_location_2 = ElementLocation(Element=element)  # -> Element, Location, Hand, Facing, WorkPlane
angle = Angle(VectorA=element_location_2.Hand, VectorB=element_location.Hand)  # -> Angle, Reflex
degrees = Degrees(Radians=angle.Angle)
expression = Expression(x=degrees, Expression="x = 180")
expression_2 = Expression(x=degrees, Expression="x = 0")
gate_or = GateOr(A=expression_2, B=expression)
cull_pattern = CullPattern(List=relay, CullPattern=gate_or)
cull_pattern_2 = CullPattern(List=list, CullPattern=gate_or)
list_2 = ClusterOutput(cull_pattern)
list_3 = ClusterOutput(cull_pattern_2)

# ==== cluster Cluster_10
content = ClusterInput()
relay = ClusterInput()
bounding_box = BoundingBox(Content=content, Plane=PlaneXY(0, 0, 0), UnionBox=True)  # -> Box, Box_2
volume = Volume(Geometry=bounding_box.Box)  # -> Volume, Centroid
scale_x = ClusterInput()
scale_y = ClusterInput()
scale_nu = ScaleNU(Geometry=bounding_box.Box, Plane=volume.Centroid, ScaleX=scale_x, ScaleY=scale_y, ScaleZ=1)  # -> Geometry, Transform
element_bounding_geometry = ElementBoundingGeometry(Element=relay)
brep_brep = BrepBrep(BrepA=scale_nu.Geometry, BrepB=element_bounding_geometry)  # -> Curves, Points
list_length = ListLength(List=brep_brep.Curves)
boolean = Boolean(flatten(list_length))
cull_pattern = CullPattern(List=element_bounding_geometry, CullPattern=boolean)
cull_pattern_2 = CullPattern(List=relay, CullPattern=boolean)
list = ClusterOutput(cull_pattern_2)
list_2 = ClusterOutput(cull_pattern)

# ==== cluster Orient
O = ClusterInput()
x = ClusterInput()
Z = UnitZ(Factor=1)
G = ClusterInput()
neg = Negative(Value=x)
pl = ConstructPlane(Origin=O, XAxis=neg, YAxis=Z)
yz = YZPlane(Origin=Point(0, 0, 0))
G_2 = ClusterInput()
orient = Orient(Geometry=G, Source=pl, Target=yz)  # -> Geometry, Transform
orient_2 = Orient(Geometry=G_2, Source=pl, Target=yz)  # -> Geometry, Transform
transformation_matrix = ClusterOutput(orient.Transform)
area = Area(Geometry=orient.Geometry)  # -> Area, Centroid
pdecon = Deconstruct(Point=area.Centroid)  # -> XComponent, YComponent, ZComponent
neg_2 = Negative(Value=pdecon.ZComponent)
Z_2 = UnitZ(Factor=neg_2)
move = Move(Geometry=orient_2.Geometry, Motion=Z_2)  # -> Geometry, Transform
G_3 = ClusterOutput(move.Geometry)

# ==== cluster Orient_2
x = ClusterInput()
O = ClusterInput()
G = ClusterInput()
Z = UnitZ(Factor=1)
neg = Negative(Value=x)
pl = ConstructPlane(Origin=O, XAxis=neg, YAxis=Z)
yz = YZPlane(Origin=Point(0, 0, 0))
G_2 = ClusterInput()
orient = Orient(Geometry=G, Source=pl, Target=yz)  # -> Geometry, Transform
orient_2 = Orient(Geometry=G_2, Source=pl, Target=yz)  # -> Geometry, Transform
area = Area(Geometry=orient.Geometry)
pdecon = Deconstruct(Point=area)  # -> XComponent, YComponent, ZComponent
neg_2 = Negative(Value=pdecon.ZComponent)
Z_2 = UnitZ(Factor=neg_2)
move = Move(Geometry=orient_2.Geometry, Motion=Z_2)  # -> Geometry, Transform
brep = Brep(move.Geometry)
orientation = ClusterOutput(orient_2.Transform)  # Orientation
G_3 = ClusterOutput(move.Geometry)

# ==== cluster Orient_3
O = ClusterInput()
x = ClusterInput()
G = ClusterInput()
neg = Negative(Value=x)
Z = UnitZ(Factor=1)
pl = ConstructPlane(Origin=O, XAxis=neg, YAxis=Z)
G_2 = ClusterInput()
yz = YZPlane(Origin=Point(0, 0, 0))
orient = Orient(Geometry=G, Source=pl, Target=yz)  # -> Geometry, Transform
orient_2 = Orient(Geometry=G_2, Source=pl, Target=yz)  # -> Geometry, Transform
area = Area(Geometry=orient.Geometry)  # -> Area, Centroid
pdecon = Deconstruct(Point=area.Centroid)  # -> XComponent, YComponent, ZComponent
neg_2 = Negative(Value=pdecon.ZComponent)
Z_2 = UnitZ(Factor=neg_2)
move = Move(Geometry=orient_2.Geometry, Motion=Z_2)  # -> Geometry, Transform
G_3 = ClusterOutput(move.Geometry)
