# Grasshopper definition Prepare3D.gh (Grasshopper 1.0.8)
# plug-ins: Rhino.Inside for Autodesk Revit
# Script developed by BIMTech Innovations AB

query_views = QueryViews(IsDependent=False, IsTemplate=False)
built_in_parameter_types_common = BuiltInParameterTypes("autodesk.spec:spec.string-2.0.0", DisciplineType="autodesk.spec:discipline")
define_parameter = DefineParameter(Name="UPSKR_DF", Type=built_in_parameter_types_common, Group="autodesk.parameter.group:data-1.0.0")
view_identity = ViewIdentity(View=query_views)  # -> Discipline, ViewFamily, ViewName, IsDependent, IsTemplate, IsAssembly, IsPrintable
# Create Parameter UPSKR_DF
add_parameter = AddParameter(Definition=define_parameter, Scope=1, TrackingMode=2)
# Get 3DView if already created
match_text = MatchText(Text=view_identity.ViewName, Pattern="UPSKR_DaylightFactor", Case=True)
# Create 3DView initally
unit_z = UnitZ(Factor=1)
parameter = Parameter(add_parameter)
add_3d_view = Add3DView(Frame=unit_z, Name="UPSKR_DaylightFactor")
cull_pattern = CullPattern(List=query_views, CullPattern=match_text)
merge = Merge(Data1=add_3d_view, Data2=cull_pattern)  # -> flatten(Result)
panel = Panel("""Floors
Roofs
Walls
Windows""")
# make sure only one View is passed
null_item = NullItem(Item=merge)  # -> NullFlags, InvalidFlags, Description
query_categories = QueryCategories(Type=1, Name=panel, IsVisibleUI=True, IsSubcategory=False)  # -> flatten(Categories)
# Elements in previews analyses are reset
# (no colored by filter)
panel_2 = Panel("Selected")
text_begins_rule = TextBeginsRule(Parameter=parameter, Value=panel_2, Inverted=False)
cull_pattern_2 = CullPattern(List=merge, CullPattern=invert(null_item.NullFlags))
category_filter = CategoryFilter(Categories=query_categories, Inverted=False)
parameter_filter = ParameterFilter(Rules=text_begins_rule, Inverted=False)
list_item = ListItem(List=cull_pattern_2, Index=0, Wrap=True)
query_elements = QueryElements(Filter=category_filter, Limit=100)  # -> Elements, Count
query_elements_2 = QueryElements(Filter=parameter_filter, Limit=100)  # -> Elements, Count
merge_2 = Merge(Data1=query_elements.Elements, Data2=query_elements_2.Elements)
reset_element_parameter = ResetElementParameter(Element=merge_2, Parameter=parameter)
query_fill_patterns = QueryFillPatterns(Type=0)
query_fill_patterns_2 = QueryFillPatterns(Type=0)
text = Text(query_fill_patterns)
text_2 = Text(query_fill_patterns_2)
match_text_2 = MatchText(Text=text, Pattern="*Solid fill*", Case=True)

# ----
# When setting the value of this parameter,
# if the room is inside a group, the group is exploded!
# Create Parameter UPSKR_PASSING_DF_AREA
panel_3 = Panel("UPSKR_PASSING_DF_AREA")  # disabled
built_in_parameter_types_common_2 = BuiltInParameterTypes("autodesk.spec.aec:area-2.0.0", DisciplineType="autodesk.spec:discipline")  # disabled
define_parameter_2 = DefineParameter(Name=panel_3, Type=built_in_parameter_types_common_2, Group="autodesk.parameter.group:data-1.0.0")  # disabled
add_parameter_2 = AddParameter(Definition=define_parameter_2, Scope=1, TrackingMode=2)  # disabled

match_text_3 = MatchText(Text=text_2, Pattern="*Solid fill*", Case=True)
cull_pattern_3 = CullPattern(List=query_fill_patterns, CullPattern=match_text_2)
query_fill_patterns_3 = QueryFillPatterns(Type=0)
panel_4 = Panel("""Floors
Roofs""")
panel_5 = Panel("""Floors
Roofs""")
cull_pattern_4 = CullPattern(List=query_fill_patterns_2, CullPattern=match_text_3)
colour = Colour(ColourSwatch(SwatchColor=RGB(0, 255, 102)))
# SelectedWalls
parameter_2 = Parameter(parameter)
parameter_3 = Parameter(parameter)
colour_2 = Colour(ColourSwatch(SwatchColor=RGB(78, 55, 138)))
parameter_4 = Parameter(parameter)
parameter_5 = Parameter(parameter)
text_3 = Text(query_fill_patterns_3)
match_text_4 = MatchText(Text=text_3, Pattern="*Solid fill*", Case=True)
parameter_6 = Parameter(parameter)
parameter_7 = Parameter(parameter)
parameter_8 = Parameter(parameter_4)
parameter_9 = Parameter(parameter_2)
text_4 = Text("SelectedWindow")
text_5 = Text("Windows")
text_6 = Text("UPSKR_DF_WindowSelected")
text_7 = Text("UPSKR_DF_WallSelected")
text_8 = Text("Walls")
text_9 = Text("SelectedWall")
query_categories_2 = QueryCategories(Type=1, Name="Windows", IsVisibleUI=True, IsSubcategory=False)
text_contains_rule = TextContainsRule(Parameter=parameter_6, Value="SelectedWindow", Inverted=Toggle(True))
graphic_overrides = GraphicOverrides(TransparencySurface="0.8")
query_categories_3 = QueryCategories(Type=1, Name=panel_4, IsVisibleUI=True, IsSubcategory=False)  # -> flatten(Categories)
text_contains_rule_2 = TextContainsRule(Parameter=parameter_5, Value="Selected", Inverted=Toggle(True))
query_categories_4 = QueryCategories(Type=1, Name="Walls", IsVisibleUI=True, IsSubcategory=False)
text_contains_rule_3 = TextContainsRule(Parameter=parameter_7, Value="SelectedWall", Inverted=Toggle(True))
graphic_overrides_2 = GraphicOverrides(TransparencySurface="0.8")
cull_pattern_5 = CullPattern(List=query_fill_patterns_3, CullPattern=match_text_4)
query_categories_5 = QueryCategories(Type=1, Name=panel_5, IsVisibleUI=True, IsSubcategory=False)  # -> flatten(Categories)
text_contains_rule_4 = TextContainsRule(Parameter=parameter_3, Value="SelectedFloor", Inverted=False)
text_contains_rule_5 = TextContainsRule(Parameter=parameter_3, Value="SelectedRoof", Inverted=False)
element = Element(cull_pattern_3)
# SelectedWindows
query_categories_6 = QueryCategories(Type=1, Name=text_5, IsVisibleUI=True, IsSubcategory=False)
text_contains_rule_6 = TextContainsRule(Parameter=parameter_8, Value=text_4, Inverted=False)
graphic_overrides_3 = GraphicOverrides(TransparencySurface="0.8")
query_categories_7 = QueryCategories(Type=1, Name=text_8, IsVisibleUI=True, IsSubcategory=False)
text_contains_rule_7 = TextContainsRule(Parameter=parameter_9, Value=text_9, Inverted=False)
element_2 = Element(cull_pattern_4)
parameter_filter_2 = ParameterFilter(Rules=text_contains_rule, Inverted=False)
parameter_filter_3 = ParameterFilter(Rules=text_contains_rule_2, Inverted=False)
parameter_filter_4 = ParameterFilter(Rules=text_contains_rule_3, Inverted=False)
element_3 = Element(cull_pattern_5)
parameter_filter_5 = ParameterFilter(Rules=text_contains_rule_4, Inverted=False)
parameter_filter_6 = ParameterFilter(Rules=text_contains_rule_5, Inverted=False)
graphic_overrides_4 = GraphicOverrides(ForegroundPatternSurfacePatterns=element, ForegroundColorSurfacePatterns=colour)
parameter_filter_7 = ParameterFilter(Rules=text_contains_rule_6, Inverted=False)
parameter_filter_8 = ParameterFilter(Rules=text_contains_rule_7, Inverted=False)
graphic_overrides_5 = GraphicOverrides(ForegroundPatternSurfacePatterns=element_2, ForegroundColorSurfacePatterns=colour_2)
# TransparentWalls
graphic_overrides_6 = GraphicOverrides(ForegroundPatternSurfacePatterns=element_3, ForegroundColorSurfacePatterns=ColourSwatch(SwatchColor=RGB(0, 93, 138)))
logical_or_filter = LogicalOrFilter(FilterA=parameter_filter_5, FilterB=parameter_filter_6)
# TransparentWindows
add_rule_based_filter = AddRuleBasedFilter(Name="UPSKR_DF_WindowTransparent", Categories=query_categories_2, Filter=parameter_filter_2, TrackingMode=2)
# TransparentRooftop
add_rule_based_filter_2 = AddRuleBasedFilter(Name="UPSKR_DF_RooftopTransparent", Categories=query_categories_3, Filter=parameter_filter_3, TrackingMode=2)
add_rule_based_filter_3 = AddRuleBasedFilter(Name="UPSKR_DF_WallTransparent", Categories=query_categories_4, Filter=parameter_filter_4, TrackingMode=2)
# SelectedRooftop
add_rule_based_filter_4 = AddRuleBasedFilter(Name="UPSKR_DF_RooftopSelected", Categories=query_categories_5, Filter=logical_or_filter, TrackingMode=2)
add_rule_based_filter_5 = AddRuleBasedFilter(Name=text_6, Categories=query_categories_6, Filter=parameter_filter_7, TrackingMode=2)
add_rule_based_filter_6 = AddRuleBasedFilter(Name=text_7, Categories=query_categories_7, Filter=parameter_filter_8, TrackingMode=2)
merge_3 = Merge(
    Data1=flatten(graphic_overrides_4),
    Data2=flatten(graphic_overrides_5),
    Data3=flatten(graphic_overrides_6),
    Data4=flatten(graphic_overrides_2),
    Data5=flatten(graphic_overrides),
    Data6=flatten(graphic_overrides_3))
merge_4 = Merge(
    Data1=flatten(add_rule_based_filter_5),
    Data2=flatten(add_rule_based_filter_6),
    Data3=flatten(add_rule_based_filter_4),
    Data4=flatten(add_rule_based_filter_3),
    Data5=flatten(add_rule_based_filter),
    Data6=flatten(add_rule_based_filter_2))
# Hide categories in 3D view "UPSKLR_DaylightFactor"
# Revit Category : Casework : id -2001000
# Revit Category : Electrical Equipment : id -2001040
# Revit Category : Electrical Fixtures : id -2001060
# Revit Category : Entourage : id -2001370
# Revit Category : Furniture : id -2000080
# Revit Category : Furniture Systems : id -2001100
# Revit Category : Mechanical Equipment : id -2001140
# Revit Category : Plumbing Fixtures : id -2001160
# Revit Category : Specialty Equipment : id -2001350
# Revit Category : Furniture System Tags : id -2005007
# Revit Category : Scope Boxes : id -2006000
built_in_categories = BuiltInCategories(["autodesk.revit.category.family:casework-1.0.0", "autodesk.revit.category.family:electricalEquipment-1.0.0", "autodesk.revit.category.family:electricalFixtures-1.0.0", "autodesk.revit.category.family:entourage-1.0.0", "autodesk.revit.category.family:furniture-1.0.0", "autodesk.revit.category.family:furnitureSystemTags-1.0.0", "autodesk.revit.category.family:furnitureSystems-1.0.0", "autodesk.revit.category.family:mechanicalEquipment-1.0.0", "autodesk.revit.category.family:plumbingFixtures-1.0.0", "autodesk.revit.category.local:volumeOfInterest-1.0.0", "autodesk.revit.category.family:specialityEquipment-1.0.0"])
view_filters = ViewFilters(View=list_item, Filters=merge_4)  # -> View, Filters
filter_graphic_overrides = FilterGraphicOverrides(View=view_filters.View, Filter=view_filters.Filters, Overrides=merge_3)  # -> View, Filter, Hidden, Overrides
category_graphic_overrides = CategoryGraphicOverrides(View=view_filters.View, Category=built_in_categories, Hidden=Toggle(True))  # -> View, Category, Hidden, Overrides
